# Grasshopper definition ClovisBruynoghe en LukasDegraeuwe.gh (Grasshopper 1.0.7)
# plug-ins: Pufferfish, PlanGraph

geo = Geometry(<curve referenced from the Rhino model>)  # disabled
number_slider = Slider(0, range=0..19)  # disabled
number_slider_2 = Slider(0, range=0..19)  # disabled
number_slider_3 = Slider(0, range=0..19)  # disabled
number_slider_4 = Slider(0, range=0..19)  # disabled
number_slider_5 = Slider(0, range=0..19)  # disabled
number_slider_6 = Slider(0, range=0..19)  # disabled
number_slider_7 = Slider(0, range=0..19)  # disabled
number_slider_8 = Slider(0, range=0..19)  # disabled
number_slider_9 = Slider(0, range=0..19)  # disabled
number_slider_10 = Slider(0, range=0..19)  # disabled
number_slider_11 = Slider(0, range=0..19)  # disabled
number_slider_12 = Slider(3, range=0..19)  # disabled
number_slider_13 = Slider(3, range=0..19)  # disabled
number_slider_14 = Slider(0, range=0..19)  # disabled
number_slider_15 = Slider(0, range=0..19)  # disabled
number_slider_16 = Slider(0, range=0..19)  # disabled
number_slider_17 = Slider(0, range=0..19)  # disabled
number_slider_18 = Slider(3, range=0..19)  # disabled
number_slider_19 = Slider(3, range=0..19)  # disabled
number_slider_20 = Slider(3, range=0..19)  # disabled
number_slider_21 = Slider(0, range=0..19)  # disabled
number_slider_22 = Slider(3, range=0..19)  # disabled
number_slider_23 = Slider(0, range=0..19)  # disabled
number_slider_24 = Slider(3, range=0..19)  # disabled
number_slider_25 = Slider(0, range=0..19)  # disabled
number_slider_26 = Slider(3, range=0..19)  # disabled
number_slider_27 = Slider(0, range=0..19)  # disabled
number_slider_28 = Slider(3, range=0..19)  # disabled
number_slider_29 = Slider(3, range=0..19)  # disabled
number_slider_30 = Slider(3, range=0..19)  # disabled
geo_2 = Geometry(<curve referenced from the Rhino model>)  # disabled
geo_3 = Geometry(<curve referenced from the Rhino model>)  # disabled
geo_4 = Geometry(<curve referenced from the Rhino model>)  # disabled
geo_5 = Geometry(<curve referenced from the Rhino model>)  # disabled
geo_6 = Geometry(<curve referenced from the Rhino model>)  # disabled
geo_7 = Geometry(<curve referenced from the Rhino model>)  # disabled
geo_8 = Geometry(<curve referenced from the Rhino model>)  # disabled
geo_9 = Geometry(<curve referenced from the Rhino model>)  # disabled
geo_10 = Geometry(<curve referenced from the Rhino model>)  # disabled
geo_11 = Geometry(<curve referenced from the Rhino model>)  # disabled
geo_12 = Geometry(<curve referenced from the Rhino model>)  # disabled
geo_13 = Geometry(<curve referenced from the Rhino model>)  # disabled
geo_14 = Geometry(<curve referenced from the Rhino model>)  # disabled
geo_15 = Geometry(<curve referenced from the Rhino model>)  # disabled
geo_16 = Geometry(<curve referenced from the Rhino model>)  # disabled
geo_17 = Geometry(<curve referenced from the Rhino model>)  # disabled
geo_18 = Geometry(<curve referenced from the Rhino model>)  # disabled
geo_19 = Geometry(<curve referenced from the Rhino model>)  # disabled
geo_20 = Geometry(<curve referenced from the Rhino model>)  # disabled
geo_21 = Geometry(<curve referenced from the Rhino model>)  # disabled
geo_22 = Geometry(<curve referenced from the Rhino model>)  # disabled
geo_23 = Geometry(<curve referenced from the Rhino model>)  # disabled
geo_24 = Geometry(<curve referenced from the Rhino model>)  # disabled
geo_25 = Geometry(<curve referenced from the Rhino model>)  # disabled
geo_26 = Geometry(<curve referenced from the Rhino model>)  # disabled
geo_27 = Geometry(<curve referenced from the Rhino model>)  # disabled
geo_28 = Geometry(<curve referenced from the Rhino model>)  # disabled
geo_29 = Geometry(<curve referenced from the Rhino model>)  # disabled
geo_30 = Geometry(<curve referenced from the Rhino model>)  # disabled
node = ConstructNode2(Name="a room", Type=number_slider, Boundary=geo_2)  # disabled
node_2 = ConstructNode2(Name="a room", Type=number_slider_7, Boundary=geo_8)  # disabled
node_3 = ConstructNode2(Name="a room", Type=number_slider_3, Boundary=geo_4)  # disabled
node_4 = ConstructNode2(Name="a room", Type=number_slider_5, Boundary=geo_6)  # disabled
node_5 = ConstructNode2(Name="a room", Type=number_slider_6, Boundary=geo_7)  # disabled
node_6 = ConstructNode2(Name="a room", Type=number_slider_2, Boundary=geo_3)  # disabled
node_7 = ConstructNode2(Name="a room", Type=number_slider_4, Boundary=geo_5)  # disabled
extnode = ExternalNode()  # disabled
node_8 = ConstructNode2(Name="a room", Type=number_slider_13, Boundary=geo_12)  # disabled
node_9 = ConstructNode2(Name="a room", Type=number_slider_12, Boundary=geo_10)  # disabled
node_10 = ConstructNode2(Name="a room", Type=number_slider_10, Boundary=geo_13)  # disabled
node_11 = ConstructNode2(Name="a room", Type=number_slider_11, Boundary=geo_11)  # disabled
node_12 = ConstructNode2(Name="a room", Type=number_slider_9, Boundary=geo_9)  # disabled
node_13 = ConstructNode2(Name="a room", Type=number_slider_14, Boundary=geo_14)  # disabled
node_14 = ConstructNode2(Name="a room", Type=number_slider_18, Boundary=geo_16)  # disabled
node_15 = ConstructNode2(Name="a room", Type=number_slider_19, Boundary=geo_20)  # disabled
node_16 = ConstructNode2(Name="a room", Type=number_slider_20, Boundary=geo_21)  # disabled
node_17 = ConstructNode2(Name="a room", Type=number_slider_22, Boundary=geo_19)  # disabled
node_18 = ConstructNode2(Name="a room", Type=number_slider_24, Boundary=geo_24)  # disabled
node_19 = ConstructNode2(Name="a room", Type=number_slider_17, Boundary=geo)  # disabled
node_20 = ConstructNode2(Name="a room", Type=number_slider_23, Boundary=geo_23)  # disabled
node_21 = ConstructNode2(Name="a room", Type=number_slider_15, Boundary=geo_15)  # disabled
node_22 = ConstructNode2(Name="a room", Type=number_slider_16, Boundary=geo_17)  # disabled
node_23 = ConstructNode2(Name="a room", Type=number_slider_8, Boundary=geo_22)  # disabled
node_24 = ConstructNode2(Name="a room", Type=number_slider_26, Boundary=geo_26)  # disabled
node_25 = ConstructNode2(Name="a room", Type=number_slider_21, Boundary=geo_18)  # disabled
node_26 = ConstructNode2(Name="a room", Type=number_slider_25, Boundary=geo_25)  # disabled
node_27 = ConstructNode2(Name="a room", Type=number_slider_27, Boundary=geo_27)  # disabled
node_28 = ConstructNode2(Name="a room", Type=number_slider_28, Boundary=geo_28)  # disabled
node_29 = ConstructNode2(Name="a room", Type=number_slider_29, Boundary=geo_29)  # disabled
node_30 = ConstructNode2(Name="a room", Type=number_slider_30, Boundary=geo_30)  # disabled
number_slider_31 = Slider(2, range=1..3)  # disabled
edge = ConstructEdge(Node1=node_21, Node2=node_19, Type=number_slider_31)  # disabled
edge_2 = ConstructEdge(Node1=node_27, Node2=node_14, Type=number_slider_31)  # disabled
edge_3 = ConstructEdge(Node1=node_27, Node2=extnode, Type=number_slider_31)  # disabled
edge_4 = ConstructEdge(Node1=node_21, Node2=node_14, Type=number_slider_31)  # disabled
edge_5 = ConstructEdge(Node1=node_27, Node2=node_19, Type=number_slider_31)  # disabled
edge_6 = ConstructEdge(Node1=node_21, Node2=node_9, Type=number_slider_31)  # disabled
merge = Merge()  # disabled
merge_2 = Merge(
    Data1=node_27,
    Data2=node_21,
    Data3=node_22,
    Data4=node_19,
    Data5=node_26,
    Data6=node_25,
    Data7=node_6,
    Data8=node_7,
    Data9=node_4,
    Data10=node_12,
    Data11=node_5,
    Data12=node_3,
    Data13=node,
    Data14=node_10,
    Data15=node_23,
    Data16=node_13,
    Data17=node_11,
    Data18=node_2,
    Data19=node_17,
    Data20=node_15,
    Data21=node_20,
    Data22=extnode,
    Data23=node_9,
    Data24=node_14)  # disabled
geo_31 = Geometry([<curve referenced from the Rhino model> x36])  # disabled
graph = ConstructGraph(
    Nodes=merge_2,
    Edges=merge,
    NodeTypes=["Living room", "Master room", "Kitchen", "Bathroom", "Dining room", "Child room", "Study room", "Second room", "Guest room", "Balcony/Garden", "Entrance", "Storage", "Wall-in", "External area", "Exterior wall", "Front door", "Interior wall", "Interior door", "Corridor", "other"],
    EdgeTypes=["Wall", "Door", "Air"],
    EdgetypeToShow=0)  # -> PlanGraph, GraphVisualisation; disabled
gfeats = GraphFeatures(PlanGraph=graph.PlanGraph)  # -> NF, NF_t, Adj, Adj_t, ni; disabled
panel = Panel(gfeats.ni)  # disabled

item = CherryPicker(ListIndex=3, TreePath_path="{0}")  # disabled
list_convert = GhPythonScript(list=item)  # -> flatten(params); disabled
# ---------- list_convert: Python ----------
import rhinoscriptsyntax as rs

params = [el for el in list_]
# ---------- end list_convert ----------

geo_32 = Geometry(<curve referenced from the Rhino model>)  # disabled
geo_33 = Geometry(<curve referenced from the Rhino model>)  # disabled
number_slider_32 = Slider(9, range=1..19)  # disabled
# opp leefgroep?
# mssn als opp is opgesplitst en niet haalbaar voor 1 geheel --> meerdere triagepunten, max 3?
# 
# bij 3 mssn al indicatie geven van zoek een andere trekker
number_slider_33 = Slider(7, range=1..19)  # disabled
area = Area(Geometry=geo_32)  # -> Area, Centroid; disabled
area_2 = Area(Geometry=geo_33)  # -> Area, Centroid; disabled
extnode_2 = ExternalNode()  # disabled
number_slider_34 = Slider(1, range=0..3)  # disabled
node_31 = ConstructNode(Name="A room", Type=number_slider_32, Area=area_2.Area, Center=area_2.Centroid)  # disabled
node_32 = ConstructNode(Name="A room", Type=number_slider_33, Area=area.Area, Center=area.Centroid)  # disabled
edge_7 = ConstructEdge(Node1=node_32, Node2=node_31, Type=number_slider_34)  # disabled
edge_8 = ConstructEdge(Node1=extnode_2, Node2=node_31, Type=number_slider_34)  # disabled
merge_3 = Merge(Data1=node_32, Data2=node_31, Data3=extnode_2)  # disabled
merge_4 = Merge(Data1=edge_7, Data2=edge_8)  # disabled
graph_2 = ConstructGraph(
    Nodes=merge_3,
    Edges=merge_4,
    NodeTypes=["Living room", "Master room", "Kitchen", "Bathroom", "Dining room", "Child room", "Study room", "Second room", "Guest room", "Balcony/Garden", "Entrance", "Storage", "Wall-in", "External area", "Exterior wall", "Front door", "Interior wall", "Interior door", "Corridor", "other"],
    EdgeTypes=["Wall", "Door", "Air"],
    EdgetypeToShow=0)  # -> PlanGraph, GraphVisualisation; disabled
gfeats_2 = GraphFeatures(PlanGraph=graph_2.PlanGraph)  # -> NF, NF_t, Adj, Adj_t, ni; disabled
panel_2 = Panel(gfeats_2.ni)  # disabled

item_2 = CherryPicker(ListIndex=0, TreePath_path="{0}")  # disabled
item_3 = CherryPicker(ListIndex=1, TreePath_path="{0}")  # disabled
merge_5 = Merge(Data1=item_2, Data2=item_3)  # disabled

# ---- group: inkom & zitruimte
swatch = ColourSwatch(SwatchColor=RGB(255, 228, 20))  # disabled
srf = Surface(merge_5)  # disabled
preview = CustomPreview(Geometry=srf, Material=swatch)  # disabled

# ----
panel_3 = Panel("""Zitruimte
Eetruimte
Keuken
Keukenberging
wasruimte
sportruimte
private unit
private buitenruimte
time out - ruimte
buitenruimte
inkom
tocht- /veiligheidssas
toillet bezoekers
wachtruimte
administratieruimte
controle - handscanner
fouilleerruimte
triagepunt
personeelsruimte
dokterskabinet
bezoekersruimte
buurtfunctie""")  # disabled
panel_4 = Panel("verander inkom/ tocht nog")  # disabled
item_4 = CherryPicker(ListIndex=2, TreePath_path="{0}")  # disabled

supernodes = GhPythonScript()  # -> superNodeEindOpp, superNodeBeginOpp, superNodeEind, superNodeBegin, leefNodeOpp; inputs Nodes: list; disabled
# ---------- supernodes: Python ----------
__author__ = "Ellen De Sloovere"
__version__ = "2022.04.15"

import klasDefinities
reload(klasDefinities)

from klasDefinities import *

#superNode bevat alle nodes gekoppeld aan triagepunte + triagepunte zelf
superNodeEindOpp = 0.
superNodeEind = []

#superNode bevat alle nodes gekoppeld aan wachtruimte (incl cyclische) + wachtruimte zelf
superNodeBeginOpp = 0.
superNodeBegin = []

#leefgroep wordt als een Node gezien voor de topdown approach (gelezen in dynamic programming dif met divide en conquer)
leefNodeOpp = 0.
leefNode = []

#bevat cyclische verbinding aan wachtruimte + wachtruimte zelf
cyclischeNodeOpp = 0.
cyclischeNode =[]

# onbeduidend --> samennemen
toilletNodeOpp =0.
toilletNode =[]

inkomNodeOpp =0.
inkomNode =[]


for el in Nodes:
    if el.getRoomType() in ('inkom leefgroep', 'zit- en eetruimte', 'keuken', 'keukenberging', 'wasruimte', 'time out - ruimte', 'private unit', 'private buitenruimte'):
        leefNodeOpp += el.getOpp()
        leefNode.append(el)
    
    elif el.getRoomType() in ('controle - handscanner', 'fouille', 'administratieruimte', 'wachtruimte'):
        cyclischeNodeOpp += el.getOpp()
        cyclischeNode.append(el)
        
    elif el.getRoomType() in ('tocht-/veiligheidssas', 'inkom'):
        inkomNodeOpp += el.getOpp()
        inkomNode.append(el)
        
    elif el.getRoomType() in ('sas toilet', 'toilet bezoekers'):
        toilletNodeOpp += el.getOpp()
        toilletNode.append(el)

    else:
        superNodeEindOpp += el.getOpp()
        superNodeEind.append(el)

superNodeEindOpp += leefNodeOpp
superNodeEind.append(leefNode)

superNodeBeginOpp += (cyclischeNodeOpp + toilletNodeOpp + inkomNodeOpp)
superNodeBegin.append(cyclischeNode)
superNodeBegin.append(toilletNode)
superNodeBegin.append(inkomNode)
# ---------- end supernodes ----------
delta_opp = Slider(13, range=0..50)  # disabled
pt = Point(Point(-10126.93956, 4684.096111, 0))  # disabled

swatch_2 = ColourSwatch(SwatchColor=RGBA(255, 153, 153, 89))  # disabled
floor = Slider(0, range=0..3)  # disabled
filter = GhPythonScript(floor=floor)  # -> x_Floor_Nodes, visueel; inputs floor: Int32, nodes: list; disabled
# ---------- filter: Python ----------
__author__ = "Ellen De Sloovere"
__version__ = "2022.05.16"

import Rhino.Geometry as rg
import csv
import Rhino
import klasDefinities
import rhinoscriptsyntax as rs
reload(klasDefinities)

from klasDefinities import *

x_Floor_Nodes = []
for el in nodes:
    if el.getFloor() == floor:
        x_Floor_Nodes.append(el)
        
visueel = []
for el in x_Floor_Nodes:
    visueel.append(el.getGeo())
# ---------- end filter ----------
panel_5 = Panel(filter.visueel)  # disabled
srf_2 = Surface(filter.visueel)  # disabled
preview_2 = CustomPreview(Geometry=srf_2, Material=swatch_2)  # disabled

delta_opp_2 = Slider(14, range=0..50)  # disabled
list_convert_2 = GhPythonScript(list=item_4)  # -> flatten(params); disabled
# ---------- list_convert_2: Python ----------
import rhinoscriptsyntax as rs
print list_

params = []
#moet nog geautomatiseerd worden, nu maar 1 deel van een unit in graph
for el in list_:
    if isinstance(el, list): params.append(el[0])
        
    else:
        params.append(el)
print list_
# ---------- end list_convert_2 ----------
number_slider_35 = Slider(15, range=0..21)  # disabled

item_5 = CherryPicker(ListIndex=2, TreePath_path="{0}")  # disabled

endnodes = GhPythonScript(trekker=pt, eindOpp=supernodes.superNodeEindOpp, deltaOpp=delta_opp_2)  # -> afwijking, knopen, visueel; inputs trekker: Point3d, beginKnopen: list, planNodes: list; disabled
# ---------- endnodes: Python ----------
__author__ = "Ellen De Sloovere"
__version__ = "2022.04.17"

import klasDefinities
reload(klasDefinities)
from klasDefinities import *
import scriptcontext

def TimeConsumingTask():    
    for i in range(30000):
        # Was escape key pressed?
        if (scriptcontext.escape_test(False)):
            print "TimeConsumingTask cancelled."
            break

TimeConsumingTask()

visueel =[]

while len(planNodes) > len(visueel)  + len(beginKnopen):
    tussenopl = []
    
    for n in planNodes:
        if n.getFreeNodeDegree(planNodes) + 1 >= triage and n.getType() is False and overlap(n.getID(), beginKnopen, planNodes, True) is True:

            comp = [n]
            totOpp = n.getOpp()
            for ni in getNodes(n.getBuren(True),planNodes):
                if ni.getType() is False and totOpp + ni.getOpp() <= eindOpp + deltaOpp:
                    totOpp += ni.getOpp()
                    comp.append(ni)
            
            tussenopl.append(comp)

    
    if tussenopl:
        if not afwijking:
            afwijking = None
            knopen = None
            
            
            for el in tussenopl:
                
                if afwijking is None:
                    afwijking = abs(eindOpp - sum(i.getOpp() for i in el))
                    knopen = list(i.getID() for i in el)
                    
                elif abs(eindOpp - sum(i.getOpp() for i in el)) <= afwijking:
                    afwijking = abs(eindOpp - sum(i.getOpp() for i in el))
                    knopen = list(i.getID() for i in el)

            for k in getNodes(knopen,planNodes):
                visueel.append(k.getGeo())
                k.changeType()

        else:
            afwijk2 = None
            knopen2 = None
            
            for el in tussenopl:
                tussen = []
                for i in el:
                    if afwijking - sum(n.getOpp() for n in tussen) - i.getOpp() <= deltaOpp:
                        tussen.append(i)
                        
                if afwijk2 is None:
                    afwijk2 = afwijking - sum(n.getOpp() for n in tussen)
                    knopen2 = tussen
                    
                elif afwijking - sum(n.getOpp() for n in tussen) <= afwijk2 :
                    afwijk2 = afwijking - sum(n.getOpp() for n in tussen)
                    knopen2 = tussen
                    
            
            for k in knopen2:
                visueel.append(k.getGeo())
                knopen.append(k.getID())
                k.changeType()
                afwijking -= k.getOpp()
    else:
        id =[]
        deg = []
        for n in planNodes:
            if n.getType() is False:
                id.append(n)
                deg.append(n.getPosNodeDegree())
                
        if len(id) > 0:
            knoop = id[deg.index(max(deg))]
            visueel.append(knoop.getGeo())
            knoop.changeType()
            afwijking -= knoop.getOpp()
            knopen.append(knoop.getID())
        else:
            break
        
    geomKnopen = getNodes(knopen, planNodes)
    while len(geomKnopen) > 0:
        tussen =[]
        for el in geomKnopen:
            for i in getNodes(el.getBuren(True),planNodes):
                if not i.getType() :
                    i.changeType()
                    tussen.append(i)
                    afwijking -= i.getOpp()
                    visueel.append(i.getGeo())
                    knopen.append(i.getID())
        geomKnopen = tussen

    print 'runned'
    
    
    
    
    
    
    
    
    
    
    
    
    
    
    
    
    """if overlap(i.getID(), beginKnopen, planNodes, True) and i.getType() is False:
            i.changeType()
            knopen.append(i.getID())
            geomKnopen.append(i)
            afwijking -= i.getOpp() 
    
    for el in planNodes:
    
        if el.getID() not in knopen:
            if el.getType() == True:
                el.changeType()
            
        elif el.getID() in knopen:
            visueel.append(el.getGeo())"""
# ---------- end endnodes ----------
knopen = Panel(endnodes.knopen)  # disabled
afwijking = Panel(endnodes.afwijking)  # disabled
geom = Panel(endnodes.visueel)  # disabled

# ----
# om verder te verdelen
# Voor mezelf:
# 
# programma zelf
# kostenwaarden
# extra deuren of verwijderde deuren
number_slider_36 = Slider(1, range=0..20)  # disabled
vec2pt = Vector2Pt(PointA=Point(-10077.64948, 4671.345342, 0), PointB=Point(-10077.64948, 4674.705743, 0), Unitize=False)  # -> Vector, Length; disabled
vec2pt_2 = Vector2Pt(PointA=Point(-10077.64948, 4671.345342, 0), PointB=Point(-10075.56975, 4671.345342, 0), Unitize=False)  # -> Vector, Length; disabled
geo_34 = Geometry()  # disabled
geo_35 = Geometry(endnodes.visueel)  # disabled
angle = Angle(VectorA=vec2pt.Vector, VectorB=vec2pt_2.Vector)  # -> Angle, Reflex; disabled
geo_36 = Geometry(<curve referenced from the Rhino model>)  # disabled
number_slider_37 = Slider(2, range=0..20)  # disabled
number_slider_38 = Slider(50, range=0..50)  # disabled
srf_3 = Surface(geo_34)  # disabled
number_slider_39 = Slider(2, range=0..20)  # disabled
number_slider_40 = Slider(7, range=0..20)  # disabled
srf_4 = Surface(geo_35)  # disabled
area_3 = Area(Geometry=geo_34)  # -> Area, Centroid; disabled
area_4 = Area(Geometry=geo_35)  # -> Area, Centroid; disabled
item_6 = CherryPicker(srf_3, ListIndex=2, TreePath_path="{0;0;0;0}")  # disabled
item_7 = CherryPicker(srf_4, ListIndex=2, TreePath_path="{0;0;0;0;0}")  # disabled
substrate = Substrate(Border=geo_36, Count=number_slider_36, Angles=angle.Reflex, Deviation=0, Seed=5)  # disabled
sdivide = DivideSurface(Surface=item_6, UCount=number_slider_37, VCount=number_slider_38)  # -> Points, Normals, Parameters; disabled
sdivide_2 = DivideSurface(Surface=item_7, UCount=number_slider_39, VCount=number_slider_40)  # -> Points, Normals, Parameters; disabled
int = Integer(2)  # disabled
pline = PolyLine(Vertices=sdivide.Points, Closed=False)  # disabled
div = DivideDomain(Domain=pline, Count=number_slider_37)  # -> simplify(flatten(Segments)); disabled
pline_2 = PolyLine(Vertices=sdivide_2.Points, Closed=False)  # disabled
panel_6 = Panel(div)  # disabled
paramcrvdivsrf = ParameterCurveDivideSurface(Surface=item_6, ParametersU=div, ParametersV=div)  # -> CurvesU, CurvesV; disabled
geo_37 = Geometry(pline_2)  # disabled
geo_38 = Geometry(pline)  # disabled
geo_39 = Geometry(paramcrvdivsrf.CurvesU)  # disabled
geo_40 = Geometry(paramcrvdivsrf.CurvesV)  # disabled

srf_5 = Surface()  # disabled
srf_6 = Surface(endnodes.visueel)  # disabled
geo_41 = Geometry()  # disabled
geo_42 = Geometry(srf_5)  # disabled
geo_43 = Geometry(srf_6)  # disabled
explode = Explode(Curve=geo_41, Recursive=True)  # -> Segments, Vertices; disabled
area_5 = Area(Geometry=geo_43)  # -> Area, Centroid; disabled
area_6 = Area(Geometry=geo_42)  # -> Area, Centroid; disabled
pline_3 = PolyLine(Vertices=explode.Vertices, Closed=False)  # disabled
geo_44 = Geometry(area_6.Centroid)  # disabled
geo_45 = Geometry(area_5.Centroid)  # disabled
pt_2 = Point(explode.Vertices)  # disabled

# ---- group: test
visueel = GhPythonScript()  # -> flatten(visueel), idKnopen, afwijking; inputs planNodes: list, knopen: list; disabled
# ---------- visueel: Python ----------
__author__ = "Ellen De Sloovere"
__version__ = "2022.05.10"

import rhinoscriptsyntax as rs
import math
import scriptcontext
import Rhino.Geometry as rg
import ghpythonlib.components as gh
import System
import klasDefinities
reload(klasDefinities)

from klasDefinities import *
from decimal import *


#afwijking = '%.3f' % (sum(el for el in afw)/len(knopen)),  tuple('%.3f' % el for el in afw)
idKnopen = knopen
print knopen


visueel = [el.getGeo() for el in knopen[0]]
# ---------- end visueel ----------
swatch_3 = ColourSwatch(SwatchColor=RGB(255, 228, 20))  # disabled
srf_7 = Surface(visueel.visueel)  # disabled
preview_3 = CustomPreview(Geometry=srf_7, Material=swatch_3)  # disabled

# ----
srf_8 = Surface()  # disabled
swatch_4 = ColourSwatch(SwatchColor=RGB(84, 235, 84))  # disabled
preview_4 = CustomPreview(Geometry=srf_8, Material=swatch_4)  # disabled

# ---- group: triage
swatch_5 = ColourSwatch(SwatchColor=RGB(44, 108, 176))  # disabled
srf_9 = Surface(item_5)  # disabled
preview_5 = CustomPreview(Geometry=srf_9, Material=swatch_5)  # disabled

# ----
# inputparameters
aantal_gedetineerden_per_leefgroep = Slider(2, range=0..100)  # disabled
# inputparameters
aantal_leefgroepen = Slider(2, range=0..100)  # disabled

panel_7 = Panel("""Room
Bathroom
Garden
Corridor
Shared space
Private
Balcony""")
crv = Curve([<curve referenced from the Rhino model> x164])
id = Guid(crv)
rhinotopls = RhinoToPls(RhinoCurvesAsGuid=id, NodeTypes=panel_7)  # -> Roomtypes, Rooms, InteriorDoors, ExteriorDoors, ExteriorWall
pls_to_graph = PolylinesToGraph(
    Roomtypes=rhinotopls.Roomtypes,
    NodeTypes=panel_7,
    Rooms=rhinotopls.Rooms,
    InteriorDoors=rhinotopls.InteriorDoors,
    ExteriorDoors=rhinotopls.ExteriorDoors,
    ExteriorWall=rhinotopls.ExteriorWall,
    ShowWholeGraph=Toggle(False),
    IncludeExterior=Toggle(False),
    Tolerance=Slider(0.1, range=0..1))  # -> PlanGraph, GraphVisualisation
gfeats_3 = GraphFeatures(PlanGraph=pls_to_graph.PlanGraph)  # -> NF, NF_t, Adj, Adj_t, ni
panel_8 = Panel(gfeats_3.ni)
wrtype = WriteRoomTypes(Graph=pls_to_graph.PlanGraph, NodeTypes=panel_7, TextHeight=Slider(0.373, range=0..1))

panel_9 = Panel("""Room
Bathroom
Garden
Corridor
Shared space
Private
Balcony""")
crv_2 = Curve([<curve referenced from the Rhino model> x38])
id_2 = Guid(crv_2)
rhinotopls_2 = RhinoToPls(RhinoCurvesAsGuid=id_2, NodeTypes=panel_9)  # -> Roomtypes, Rooms, InteriorDoors, ExteriorDoors, ExteriorWall
pls_to_graph_2 = PolylinesToGraph(
    Roomtypes=rhinotopls_2.Roomtypes,
    NodeTypes=panel_9,
    Rooms=rhinotopls_2.Rooms,
    InteriorDoors=rhinotopls_2.InteriorDoors,
    ExteriorDoors=rhinotopls_2.ExteriorDoors,
    ExteriorWall=rhinotopls_2.ExteriorWall,
    ShowWholeGraph=Toggle(False),
    IncludeExterior=Toggle(False),
    Tolerance=Slider(0.1, range=0..1))  # -> PlanGraph, GraphVisualisation
gfeats_4 = GraphFeatures(PlanGraph=pls_to_graph_2.PlanGraph)  # -> NF, NF_t, Adj, Adj_t, ni
panel_10 = Panel(gfeats_4.ni)
wrtype_2 = WriteRoomTypes(Graph=pls_to_graph_2.PlanGraph, NodeTypes=panel_9, TextHeight=Slider(0.373, range=0..1))

panel_11 = Panel("""Room
Bathroom
Garden
Corridor
Shared space
Private
Balcony""")
crv_3 = Curve([<curve referenced from the Rhino model> x129])
id_3 = Guid(crv_3)
rhinotopls_3 = RhinoToPls(RhinoCurvesAsGuid=id_3, NodeTypes=panel_11)  # -> Roomtypes, Rooms, InteriorDoors, ExteriorDoors, ExteriorWall
pls_to_graph_3 = PolylinesToGraph(
    Roomtypes=rhinotopls_3.Roomtypes,
    NodeTypes=panel_11,
    Rooms=rhinotopls_3.Rooms,
    InteriorDoors=rhinotopls_3.InteriorDoors,
    ExteriorDoors=rhinotopls_3.ExteriorDoors,
    ExteriorWall=rhinotopls_3.ExteriorWall,
    ShowWholeGraph=Toggle(False),
    IncludeExterior=Toggle(False),
    Tolerance=Slider(0.1, range=0..1))  # -> PlanGraph, GraphVisualisation
gfeats_5 = GraphFeatures(PlanGraph=pls_to_graph_3.PlanGraph)  # -> NF, NF_t, Adj, Adj_t, ni
panel_12 = Panel(gfeats_5.ni)
wrtype_3 = WriteRoomTypes(Graph=pls_to_graph_3.PlanGraph, NodeTypes=panel_11, TextHeight=Slider(0.387, range=0..1))

# ----
# programmaonderdelen detentiehuis
panel_13 = Panel("0")  # disabled
panel_14 = Panel("1")  # disabled
panel_15 = Panel("2")  # disabled
panel_16 = Panel("3")  # disabled
# programmaonderdelen detentiehuis
panel_17 = Panel("4")  # disabled
panel_18 = Panel("5")  # disabled
panel_19 = Panel("6")  # disabled
panel_20 = Panel("7")  # disabled
panel_21 = Panel("8")  # disabled
panel_22 = Panel("9")  # disabled
panel_23 = Panel("10")  # disabled
panel_24 = Panel("11")  # disabled
panel_25 = Panel("12")  # disabled
panel_26 = Panel("13")  # disabled

panel_27 = Panel("openbare weg")  # disabled
# oppervlakte
panel_28 = Panel("10")  # disabled
# opstellen graaf
# relaties ruimtes
panel_29 = Panel("1,13")  # disabled

# ----
# per leefgroep
panel_30 = Panel("inkom leefgroep")  # disabled
panel_31 = Panel("zit- en eetruimte")  # disabled
panel_32 = Panel("private unit")  # disabled

panel_33 = Panel("keukenberging")  # disabled
extra_oppervlakte_keukenberging = Slider(0.53, range=0..100)  # disabled
basisoppervlakte_keukenberging = Slider(2.67, range=0..100)  # disabled
multiplication = Multiplication(A=aantal_gedetineerden_per_leefgroep, B=extra_oppervlakte_keukenberging)  # disabled
addition = Addition(A=multiplication, B=basisoppervlakte_keukenberging)  # disabled
panel_34 = Panel("16")  # disabled

panel_35 = Panel("wasruimte")  # disabled
extra_oppervlakte_wasruimte = Slider(1, range=0..100)  # disabled
basisoppervlakte_wasruimte = Slider(5, range=0..100)  # disabled
multiplication_2 = Multiplication(A=aantal_gedetineerden_per_leefgroep, B=extra_oppervlakte_wasruimte)  # disabled
addition_2 = Addition(A=multiplication_2, B=basisoppervlakte_wasruimte)  # disabled
panel_36 = Panel("14")  # disabled

# ----
# vast programma
panel_37 = Panel("inkom")  # disabled
inkom = Slider(45, range=0..100)  # disabled
panel_38 = Panel("0,2")  # disabled

panel_39 = Panel("buurtfunctie")  # disabled
buurtfunctie = Slider(900, range=0..1000)  # disabled
panel_40 = Panel("0,9")  # disabled

panel_41 = Panel("keuken")  # disabled
extra_oppervlakte_keuken = Slider(1.07, range=0..100)  # disabled
basisoppervlakte_keuken = Slider(5.33, range=0..100)  # disabled
multiplication_3 = Multiplication(A=aantal_gedetineerden_per_leefgroep, B=extra_oppervlakte_keuken)  # disabled
addition_3 = Addition(A=multiplication_3, B=basisoppervlakte_keuken)  # disabled
panel_42 = Panel("14")  # disabled

panel_43 = Panel("sportruimte")  # disabled
extra_oppervlakte_sportruimte = Slider(1.47, range=0..100)  # disabled
basisoppervlakte_sportruimte = Slider(7.33, range=0..100)  # disabled
multiplication_4 = Multiplication(A=aantal_gedetineerden_per_leefgroep, B=extra_oppervlakte_sportruimte)  # disabled
addition_4 = Addition(A=multiplication_4, B=basisoppervlakte_sportruimte)  # disabled
panel_44 = Panel("14")  # disabled

panel_45 = Panel("buitenruimte")  # disabled
extra_oppervlakte_buitenruimte = Slider(0, range=0..100)  # disabled
basisoppervlakte_buitenruimte = Slider(0, range=0..100)  # disabled
multiplication_5 = Multiplication(A=aantal_gedetineerden_per_leefgroep, B=extra_oppervlakte_buitenruimte)  # disabled
addition_5 = Addition(A=multiplication_5, B=basisoppervlakte_buitenruimte)  # disabled
panel_46 = Panel("14")  # disabled

panel_47 = Panel("tocht-/veiligheidssas")  # disabled
tocht_veiligheidssas = Slider(7, range=0..100)  # disabled
panel_48 = Panel("1,5")  # disabled

panel_49 = Panel("sas toilet")  # disabled
sas_toilet = Slider(3, range=0..100)  # disabled
panel_50 = Panel("4,5")  # disabled

# ----
# vast programma
panel_51 = Panel("toilet bezoekers")  # disabled
extra_oppervlakte_toilet_bezoekers = Slider(0.33, range=0..100)  # disabled
# oppervlakte
basisoppervlakte_toilet_bezoekers = Slider(1.67, range=0..100)  # disabled
multiplication_6 = Multiplication(A=aantal_gedetineerden_per_leefgroep, B=aantal_leefgroepen)  # disabled
multiplication_7 = Multiplication(A=multiplication_6, B=extra_oppervlakte_toilet_bezoekers)  # disabled
# opstellen graaf
addition_6 = Addition(A=multiplication_7, B=basisoppervlakte_toilet_bezoekers)  # disabled
panel_52 = Panel("3")  # disabled

panel_53 = Panel("wachtruimte")  # disabled
extra_oppervlakte_wachtruimte = Slider(1.07, range=0..100)  # disabled
basisoppervlakte_wachtruimte = Slider(5.33, range=0..100)  # disabled
multiplication_8 = Multiplication(A=aantal_gedetineerden_per_leefgroep, B=aantal_leefgroepen)  # disabled
multiplication_9 = Multiplication(A=multiplication_8, B=extra_oppervlakte_wachtruimte)  # disabled
# relaties ruimtes
addition_7 = Addition(A=multiplication_9, B=basisoppervlakte_wachtruimte)  # disabled
panel_54 = Panel("2,3,6,8")  # disabled

panel_55 = Panel("controle - handscanner")  # disabled
controle_handscanner = Slider(7, range=0..100)  # disabled
panel_56 = Panel("5,7,9")  # disabled

panel_57 = Panel("fouilleerruimte")  # disabled
fouilleerruimte = Slider(5, range=0..100)  # disabled
panel_58 = Panel("6,8")  # disabled

panel_59 = Panel("admnistratieruimte")  # disabled
extra_oppervlakte_administratieruimte = Slider(1.13, range=0..100)  # disabled
basisoppervlakte_administratieruimte = Slider(5.67, range=0..100)  # disabled
multiplication_10 = Multiplication(A=aantal_gedetineerden_per_leefgroep, B=aantal_leefgroepen)  # disabled
multiplication_11 = Multiplication(A=multiplication_10, B=extra_oppervlakte_administratieruimte)  # disabled
addition_8 = Addition(A=multiplication_11, B=basisoppervlakte_administratieruimte)  # disabled
panel_60 = Panel("5,7")  # disabled

panel_61 = Panel("triagepunt")  # disabled

panel_62 = Panel("dokterskabinet")  # disabled
dokterskabinet = Slider(17, range=0..100)  # disabled
panel_63 = Panel("9")  # disabled

# ----
# per leefgroep
panel_64 = Panel("bezoekersruimte")  # disabled
bezoekersruimte = Slider(60, range=0..100)  # disabled
panel_65 = Panel("9")  # disabled

panel_66 = Panel("time out - ruimte")  # disabled
time_out_ruimte = Slider(25, range=0..100)  # disabled
panel_67 = Panel("14")  # disabled

panel_68 = Panel("private buitenruimte")  # disabled
private_buitenruimte = Slider(0, range=0..100)  # disabled
panel_69 = Panel("21")  # disabled
panel_70 = Panel("1")  # disabled
series = Series(Start=panel_69, Step=panel_70, Count=aantal_gedetineerden_per_leefgroep)  # disabled

panel_71 = Panel("personeelsruimte")  # disabled
extra_oppervlakte_personeelsruimte = Slider(6.67, range=0..100)  # disabled
basisoppervlakte_personeelsruimte = Slider(33.33, range=0..100)  # disabled
multiplication_12 = Multiplication(A=aantal_gedetineerden_per_leefgroep, B=aantal_leefgroepen)  # disabled
multiplication_13 = Multiplication(A=multiplication_12, B=extra_oppervlakte_personeelsruimte)  # disabled
addition_9 = Addition(A=multiplication_13, B=basisoppervlakte_personeelsruimte)  # disabled
panel_72 = Panel("9")  # disabled

extra_oppervlakte_zit_en_eetruimte = Slider(3.46, range=0..100)  # disabled
basisoppervlakte_zit_en_eetruimte = Slider(17.34, range=0..100)  # disabled
multiplication_14 = Multiplication(A=aantal_gedetineerden_per_leefgroep, B=extra_oppervlakte_zit_en_eetruimte)  # disabled
addition_10 = Addition(A=multiplication_14, B=basisoppervlakte_zit_en_eetruimte)  # disabled
panel_73 = Panel("2")  # disabled
multiplication_15 = Multiplication(A=panel_73, B=aantal_gedetineerden_per_leefgroep)  # disabled
panel_74 = Panel("21")  # disabled
panel_75 = Panel("""14
16
18
19
20""")  # disabled
panel_76 = Panel("21")  # disabled
addition_11 = Addition(A=multiplication_15, B=panel_74)  # disabled
panel_77 = Panel("1")  # disabled
series_2 = Series(Start=panel_76, Step=panel_77, Count=aantal_gedetineerden_per_leefgroep)  # disabled
merge_6 = Merge(Data1=panel_75, Data2=series_2)  # disabled
flatten = FlattenTree(Tree=merge_6, Path="{0}")  # disabled
merge_7 = Merge(Data1=flatten, Data2=addition_11)  # disabled
flatten_2 = FlattenTree(Tree=merge_7, Path="{0}")  # disabled
panel_78 = Panel(",")  # disabled
join = TextJoin(Text=flatten_2, Join=panel_78)  # disabled

extra_oppervlakte_triagepunt = Slider(10.67, range=0..100)  # disabled
basisoppervlakte_triagepunt = Slider(53.33, range=0..100)  # disabled
# relatie triagepunt tot zitruimtes
multiplication_16 = Multiplication(A=aantal_gedetineerden_per_leefgroep, B=aantal_leefgroepen)  # disabled
multiplication_17 = Multiplication(A=multiplication_16, B=extra_oppervlakte_triagepunt)  # disabled
addition_12 = Addition(A=multiplication_17, B=basisoppervlakte_triagepunt)  # disabled
number_slider_41 = Slider(2, range=0..10)  # disabled
number_slider_42 = Slider(8, range=0..10)  # disabled
number_slider_43 = Slider(14, range=0..100)  # disabled
multiplication_18 = Multiplication(A=aantal_gedetineerden_per_leefgroep, B=number_slider_41)  # disabled
addition_13 = Addition(A=number_slider_42, B=multiplication_18)  # disabled
series_3 = Series(Start=number_slider_43, Step=addition_13, Count=aantal_leefgroepen)  # disabled
panel_79 = Panel(",")  # disabled
panel_80 = Panel("6,10,11,12,13")  # disabled
join_2 = TextJoin(Text=series_3, Join=panel_79)  # disabled
merge_8 = Merge(Data1=panel_80, Data2=join_2)  # disabled
flatten_3 = FlattenTree(Tree=merge_8, Path="{0}")  # disabled
panel_81 = Panel(",")  # disabled
join_3 = TextJoin(Text=flatten_3, Join=panel_81)  # disabled
panel_82 = Panel(join_3)  # disabled

inkom_leefgroep = Slider(3, range=0..100)  # disabled
panel_84 = Panel("15")  # disabled
panel_85 = Panel("21")  # disabled
panel_86 = Panel("1")  # disabled
series_4 = Series(Start=panel_85, Step=panel_86, Count=aantal_gedetineerden_per_leefgroep)  # disabled
merge_9 = Merge(Data1=panel_84, Data2=series_4)  # disabled
flatten_4 = FlattenTree(Tree=merge_9, Path="{0}")  # disabled
panel_87 = Panel(",")  # disabled
join_4 = TextJoin(Text=flatten_4, Join=panel_87)  # disabled

private_unit = Slider(25, range=0..100)  # disabled
panel_88 = Panel("14")  # disabled
repeat = RepeatData(Data=panel_88, Length=aantal_gedetineerden_per_leefgroep)  # disabled
panel_89 = Panel("21")  # disabled
addition_14 = Addition(A=panel_89, B=aantal_gedetineerden_per_leefgroep)  # disabled
panel_90 = Panel("1")  # disabled
series_5 = Series(Start=addition_14, Step=panel_90, Count=aantal_gedetineerden_per_leefgroep)  # disabled
weave = Weave(Pattern=[0, 1], Stream0=repeat, Stream1=series_5, NullGaps=False)  # disabled

floor_2 = Slider(2, range=0..3)
floor_3 = Slider(1, range=0..3)
floor_4 = Slider(0, range=-1..3)

pt_3 = Point([<point referenced from the Rhino model> x3])
pt_4 = Point([<point referenced from the Rhino model> x3])
pipeline = GeometryPipeline(
    GroupByLayer=False,
    GroupByType=False,
    IncludeHidden=True,
    IncludeLocked=True,
    LayerFilter="Trap1",
    NameFilter="*",
    SublayerFiltering=True,
    TypeFilter=4)
pipeline_2 = GeometryPipeline(
    GroupByLayer=False,
    GroupByType=False,
    IncludeHidden=True,
    IncludeLocked=True,
    LayerFilter="Windows",
    NameFilter="*",
    SublayerFiltering=True,
    TypeFilter=4)
pipeline_3 = GeometryPipeline(
    GroupByLayer=False,
    GroupByType=False,
    IncludeHidden=True,
    IncludeLocked=True,
    LayerFilter="Trap2",
    NameFilter="*",
    SublayerFiltering=True,
    TypeFilter=4)
pipeline_4 = GeometryPipeline(
    GroupByLayer=False,
    GroupByType=False,
    IncludeHidden=True,
    IncludeLocked=True,
    LayerFilter="Trap3",
    NameFilter="*",
    SublayerFiltering=True,
    TypeFilter=4)
pt_5 = Point([<point referenced from the Rhino model> x3])

# ---- group: Fase twee
nodes2 = GhPythonScript(ni=panel_12, geom=rhinotopls_3.Rooms, windows=pipeline_2, floor=floor_4, trap=pipeline, points=pt_5)  # -> ruimtesArea, ruimteNodes, connectionNodes; inputs ni: list, geom: list of Polyline, windows: list of Curve, floor: Int32, trap: list, points: list of Point3d
# ---------- nodes2: Python ----------
__author__ = "Ellen De Sloovere"
__version__ = "2022.03.10"

import Rhino.Geometry as rg
import ghpythonlib.components as gh
import csv
import math
import klasDefinities
reload(klasDefinities)


from klasDefinities import *

nodes = csv.reader(ni)
header = next(nodes)
ruimtesArea = float(0.0)


ruimteNodes = []
connectionNodes = []
x1, y1, z1,  = gh.Deconstruct(points_[0])
x2, y2, z2 = gh.Deconstruct(points_[1])
x3, y3, z3 = gh.Deconstruct(points_[2])


for ruimte, geometrie in zip(nodes, geom):
    
    nId, nType, nArea, wallRel, doorRel, airRel = ruimte

    ramen =[]
    lijstTrappen = []
    for el in windows:
        #raamgeometrie linken aan aangrenzende ruimtes als eigenschap
        if rg.Intersect.Intersection.CurveCurve(geometrie.ToNurbsCurve(), el.ToNurbsCurve(),0.05, 0.05):
            ramen.append(el)
    
    for tr in trap:
        if rg.Intersect.Intersection.CurveCurve(geometrie.ToNurbsCurve(), tr.ToNurbsCurve(),0.05, 0.05) and nType != 'Bathroom':
            test,pl = tr.TryGetPolyline()
            if test:
                lijstTrappen.append(pl.CenterPoint())


            
    #print lijstTrappen
    if lijstTrappen != [] : 
        ijking =[]
        for el in lijstTrappen:
            xp, yp, zp = el
            ijking.append((math.sqrt((x1 - xp)**2 + (y1 -yp)**2 + (z1 - zp)**2), math.sqrt((x2 - xp)**2 + (y2 -yp)**2 + (z2 - zp)**2), math.sqrt((x3 - xp)**2 + (y3 -yp)**2 + (z3 - zp)**2)))
        connectionNodes.append(Node(tuple((floor, int(nId) )), nType, nArea, omzetten(wallRel, floor), omzetten(doorRel, floor), omzetten(airRel, floor), geometrie, ramen, ijking ))
        
    else: 
        ruimteNodes.append(Node(tuple((floor, int(nId))), nType, nArea, omzetten(wallRel, floor), omzetten(doorRel, floor), omzetten(airRel, floor), geometrie, ramen))

    ruimtesArea += float(nArea)
# ---------- end nodes2 ----------
nodes2_2 = GhPythonScript(ni=panel_8, geom=rhinotopls.Rooms, windows=pipeline_2, floor=floor_3, trap=pipeline_3, points=pt_4)  # -> ruimtesArea, ruimteNodes, connectionNodes; inputs ni: list, geom: list of Polyline, windows: list of Curve, floor: Int32, trap: list, points: list of Point3d
# ---------- nodes2_2: Python ----------
__author__ = "Ellen De Sloovere"
__version__ = "2022.03.10"

import Rhino.Geometry as rg
import ghpythonlib.components as gh
import csv
import math
import klasDefinities
reload(klasDefinities)


from klasDefinities import *

nodes = csv.reader(ni)
header = next(nodes)
ruimtesArea = float(0.0)


ruimteNodes = []
connectionNodes = []
x1, y1, z1,  = gh.Deconstruct(points_[0])
x2, y2, z2 = gh.Deconstruct(points_[1])
x3, y3, z3 = gh.Deconstruct(points_[2])


for ruimte, geometrie in zip(nodes, geom):
    nId, nType, nArea, wallRel, doorRel, airRel = ruimte

    ramen =[]
    lijstTrappen = []
    for el in windows:
        #raamgeometrie linken aan aangrenzende ruimtes als eigenschap
        if rg.Intersect.Intersection.CurveCurve(geometrie.ToNurbsCurve(), el.ToNurbsCurve(),0.05, 0.05):
            ramen.append(el)
    
    for tr in trap:
        if rg.Intersect.Intersection.CurveCurve(geometrie.ToNurbsCurve(), tr.ToNurbsCurve(),0.05, 0.05) and nType != 'Bathroom':
            test,pl = tr.TryGetPolyline()
            if test:
                lijstTrappen.append(pl.CenterPoint())


            
    #print lijstTrappen
    if lijstTrappen != [] : 
        ijking =[]
        for el in lijstTrappen:
            xp, yp, zp = el
            ijking.append((math.sqrt((x1 - xp)**2 + (y1 -yp)**2 + (z1 - zp)**2), math.sqrt((x2 - xp)**2 + (y2 -yp)**2 + (z2 - zp)**2), math.sqrt((x3 - xp)**2 + (y3 -yp)**2 + (z3 - zp)**2)))
        connectionNodes.append(Node(tuple((floor, int(nId) )), nType, nArea, omzetten(wallRel, floor), omzetten(doorRel, floor), omzetten(airRel, floor), geometrie, ramen, ijking ))
        
    else: 
        ruimteNodes.append(Node(tuple((floor, int(nId))), nType, nArea, omzetten(wallRel, floor), omzetten(doorRel, floor), omzetten(airRel, floor), geometrie, ramen))

    ruimtesArea += float(nArea)
# ---------- end nodes2_2 ----------
nodes2_3 = GhPythonScript(ni=panel_10, geom=rhinotopls_2.Rooms, windows=pipeline_2, floor=floor_2, trap=pipeline_4, points=pt_3)  # -> ruimtesArea, ruimteNodes, connectionNodes; inputs ni: list, geom: list of Polyline, windows: list of Curve, floor: Int32, trap: list, points: list of Point3d
# ---------- nodes2_3: Python ----------
__author__ = "Ellen De Sloovere"
__version__ = "2022.03.10"

import Rhino.Geometry as rg
import ghpythonlib.components as gh
import csv
import math
import klasDefinities
reload(klasDefinities)


from klasDefinities import *

nodes = csv.reader(ni)
header = next(nodes)
ruimtesArea = float(0.0)


ruimteNodes = []
connectionNodes = []
x1, y1, z1,  = gh.Deconstruct(points_[0])
x2, y2, z2 = gh.Deconstruct(points_[1])
x3, y3, z3 = gh.Deconstruct(points_[2])


for ruimte, geometrie in zip(nodes, geom):

    nId, nType, nArea, wallRel, doorRel, airRel = ruimte

    ramen =[]
    lijstTrappen = []
    for el in windows:
        #raamgeometrie linken aan aangrenzende ruimtes als eigenschap
        if rg.Intersect.Intersection.CurveCurve(geometrie.ToNurbsCurve(), el.ToNurbsCurve(),0.05, 0.05):
            ramen.append(el)
    
    for tr in trap:
        if rg.Intersect.Intersection.CurveCurve(geometrie.ToNurbsCurve(), tr.ToNurbsCurve(),0.05, 0.05) and nType != 'Bathroom':
            test,pl = tr.TryGetPolyline()
            if test:
                lijstTrappen.append(pl.CenterPoint())


            
    #print lijstTrappen
    if lijstTrappen != [] : 
        ijking =[]
        for el in lijstTrappen:
            xp, yp, zp = el
            ijking.append((math.sqrt((x1 - xp)**2 + (y1 -yp)**2 + (z1 - zp)**2), math.sqrt((x2 - xp)**2 + (y2 -yp)**2 + (z2 - zp)**2), math.sqrt((x3 - xp)**2 + (y3 -yp)**2 + (z3 - zp)**2)))
        connectionNodes.append(Node(tuple((floor, int(nId) )), nType, nArea, omzetten(wallRel, floor), omzetten(doorRel, floor), omzetten(airRel, floor), geometrie, ramen, ijking ))
        
    else: 
        ruimteNodes.append(Node(tuple((floor, int(nId))), nType, nArea, omzetten(wallRel, floor), omzetten(doorRel, floor), omzetten(airRel, floor), geometrie, ramen))

    ruimtesArea += float(nArea)
# ---------- end nodes2_3 ----------

# csv file wordt automatisch opgeslaan in juiste map.
# Verander het ... deeltje na       Files\....csv      in de juiste bestandsnaam
panel_91 = Panel("C:\Users\info\OneDrive\Documenten\Thesis\Ellen\Files\2 gedetineerden 1 leefgroep zonder buitenruimte.csv")
merge_10 = Merge(Data1=nodes2.ruimtesArea, Data2=nodes2_2.ruimtesArea, Data3=nodes2_3.ruimtesArea)
idealcsv = GhPythonScript(bestand=panel_91, floor=floor_4)  # -> verdeelruimteNodes, verdeelruimtesArea, triagepunt, aantalLeefgroepen, aantalUnits_leefgroep
# ---------- idealcsv: Python ----------
__author__ = "Ellen De Sloovere"
__version__ = "2022.03.10"

import Rhino.Geometry as rg
import csv
import klasDefinities
reload(klasDefinities)

from klasDefinities import *




# uit ideale graaf van Margo
bestand = open(bestand, 'r')
inodes = csv.reader(bestand)
iheader = next(inodes)

verdeelruimteNodes = []
verdeelruimtesArea = float(0.0)
aantalLeefgroepen = 0
for ruimte in inodes:
    inId, inType, inArea, iwallRel, idoorRel, iairRel = ruimte
    
    if inType == 'buurtfunctie':
        inArea = 0.22 * float(inArea)

    verdeelruimteNodes.append(Node(id = int(inId), roomType = inType, opp = inArea, muurRel = omzetten(iwallRel, floor), deurRel = omzetten(idoorRel, floor), buitenRel = omzetten(iairRel, floor))) 
    verdeelruimtesArea += float(inArea)

    if inType == 'inkom leefgroep':
        aantalLeefgroepen += 1
        
bestand.close()

    
#assert genoeg_opp is True, 'niet genoeg oppervlakte voor gekozen programma'
triagepunt = 0
aantalUnits_leefgroep = 0
for n in verdeelruimteNodes:
    if n.getRoomType() == 'triagepunt':
        triagepunt = n.getNodeDegree()
    if n.getRoomType() == 'private unit':
        aantalUnits_leefgroep += 1
        
aantalUnits_leefgroep = aantalUnits_leefgroep / aantalLeefgroepen
# ---------- end idealcsv ----------
totalopp = GhPythonScript(nodigOpp=idealcsv.verdeelruimtesArea, projectOpp=flatten(merge_10))  # -> genoeg_opp; inputs projectOpp: list
# ---------- totalopp: Python ----------
projectOpp = sum(el for el in projectOpp)
print projectOpp
if projectOpp < nodigOpp:
    genoeg_opp = 'Niet genoeg oppervlakte voor programma'
else:
    genoeg_opp = 'Genoeg oppervlakte voor programma'
# ---------- end totalopp ----------
genoeg_oppervlakte = Panel(totalopp)
panel_92 = Panel(idealcsv.verdeelruimteNodes)

delta = Slider(0.055, range=0..2)
connectionnodes = Merge(Data1=nodes2.connectionNodes, Data2=nodes2_2.connectionNodes, Data3=nodes2_3.connectionNodes)  # -> flatten(Result)
verticallink = GhPythonScript(nodes=connectionnodes, delta=delta)  # -> nodes; inputs nodes: list
# ---------- verticallink: Python ----------
__author__ = "Ellen De Sloovere"
__version__ = "2022.05.16"

import Rhino.Geometry as rg
import csv
import Rhino
import klasDefinities
import rhinoscriptsyntax as rs
reload(klasDefinities)

from klasDefinities import *


for el1 in nodes:
    for el2 in nodes: 
        for tr1 in el1.getDistanceTP():
            for tr2 in el2.getDistanceTP():
                if el1.getFloor() != el2.getFloor() and abs(tr1[0] - tr2[0]) <= delta and abs(tr1[1] - tr2[1]) <= delta and abs(tr1[2] - tr2[2]): el1.changeVConnection(el2.getID()[0], el2.getID()[1])
# ---------- end verticallink ----------
nodes = Merge(Data1=nodes2.ruimteNodes, Data2=nodes2_2.ruimteNodes, Data3=nodes2_3.ruimteNodes, Data4=verticallink)  # -> flatten(Result)
panel_93 = Panel(nodes)

# ----
# lijst oppervlaktes
repeat_2 = RepeatData(Data=private_unit, Length=aantal_gedetineerden_per_leefgroep)  # disabled
repeat_3 = RepeatData(Data=private_buitenruimte, Length=aantal_gedetineerden_per_leefgroep)  # disabled
merge_11 = Merge(
    Data1=panel_28,
    Data2=inkom,
    Data3=tocht_veiligheidssas,
    Data4=sas_toilet,
    Data5=addition_6,
    Data6=addition_7,
    Data7=controle_handscanner,
    Data8=fouilleerruimte,
    Data9=addition_8,
    Data10=addition_12,
    Data11=addition_9,
    Data12=dokterskabinet,
    Data13=bezoekersruimte,
    Data14=buurtfunctie)  # disabled
merge_12 = Merge(
    Data1=inkom_leefgroep,
    Data2=addition_10,
    Data3=addition_3,
    Data4=addition,
    Data5=addition_2,
    Data6=addition_4,
    Data7=time_out_ruimte,
    Data8=repeat_2,
    Data9=repeat_3)  # disabled
flatten_5 = FlattenTree(Tree=merge_12, Path="{0}")  # disabled
merge_13 = Merge(Data1=flatten_5, Data2=addition_5)  # disabled
panel_94 = Panel("2")  # disabled
multiplication_19 = Multiplication(A=panel_94, B=aantal_gedetineerden_per_leefgroep)  # disabled
panel_95 = Panel("8")  # disabled
addition_15 = Addition(A=multiplication_19, B=panel_95)  # disabled
multiplication_20 = Multiplication(A=aantal_leefgroepen, B=addition_15)  # disabled
repeat_4 = RepeatData(Data=merge_13, Length=multiplication_20)  # disabled
panel_96 = Panel(repeat_4)  # disabled
# lijst oppervlaktes
merge_14 = Merge(Data1=merge_11, Data2=panel_96)  # disabled
flatten_6 = FlattenTree(Tree=merge_14, Path="{0}")  # disabled
panel_97 = Panel(flatten_6)  # disabled

# ----
# lijst programmaonderdelen
repeat_5 = RepeatData(Data=panel_32, Length=aantal_gedetineerden_per_leefgroep)  # disabled
repeat_6 = RepeatData(Data=panel_68, Length=aantal_gedetineerden_per_leefgroep)  # disabled
merge_15 = Merge(
    Data1=panel_27,
    Data2=panel_37,
    Data3=panel_47,
    Data4=panel_49,
    Data5=panel_51,
    Data6=panel_53,
    Data7=panel_55,
    Data8=panel_57,
    Data9=panel_59,
    Data10=panel_61,
    Data11=panel_71,
    Data12=panel_62,
    Data13=panel_64,
    Data14=panel_39)  # disabled
merge_16 = Merge(
    Data1=panel_30,
    Data2=panel_31,
    Data3=panel_41,
    Data4=panel_33,
    Data5=panel_35,
    Data6=panel_43,
    Data7=panel_66,
    Data8=repeat_5,
    Data9=repeat_6)  # disabled
panel_98 = Panel(merge_15)  # disabled
flatten_7 = FlattenTree(Tree=merge_16, Path="{0}")  # disabled
merge_17 = Merge(Data1=flatten_7, Data2=panel_45)  # disabled
panel_99 = Panel("2")  # disabled
panel_100 = Panel(merge_17)  # disabled
multiplication_21 = Multiplication(A=panel_99, B=aantal_gedetineerden_per_leefgroep)  # disabled
panel_101 = Panel("8")  # disabled
addition_16 = Addition(A=multiplication_21, B=panel_101)  # disabled
multiplication_22 = Multiplication(A=aantal_leefgroepen, B=addition_16)  # disabled
repeat_7 = RepeatData(Data=merge_17, Length=multiplication_22)  # disabled
# lijst programmaonderdelen
panel_102 = Panel(repeat_7)  # disabled
merge_18 = Merge(Data1=merge_15, Data2=panel_102)  # disabled
flatten_8 = FlattenTree(Tree=merge_18, Path="{0}")  # disabled
panel_103 = Panel(flatten_8)  # disabled

# ----
# lijst relaties
merge_19 = Merge(Data1=weave, Data2=series)  # disabled
merge_20 = Merge(
    Data1=panel_29,
    Data2=panel_38,
    Data3=panel_48,
    Data4=panel_50,
    Data5=panel_52,
    Data6=panel_54,
    Data7=panel_56,
    Data8=panel_58,
    Data9=panel_60,
    Data10=panel_82,
    Data11=panel_72,
    Data12=panel_63,
    Data13=panel_65,
    Data14=panel_40)  # disabled
merge_21 = Merge(
    Data1=flatten_4,
    Data2=flatten_2,
    Data3=panel_42,
    Data4=panel_34,
    Data5=panel_36,
    Data6=panel_44,
    Data7=panel_67,
    Data8=merge_19)  # disabled
flatten_9 = FlattenTree(Tree=merge_21, Path="{0}")  # disabled
merge_22 = Merge(Data1=flatten_9, Data2=panel_46)  # disabled
panel_104 = Panel(merge_22)  # disabled
lng = ListLength(List=panel_104)  # disabled
multiplication_23 = Multiplication(A=lng, B=aantal_leefgroepen)  # disabled
repeat_8 = RepeatData(Data=panel_104, Length=multiplication_23)  # disabled
panel_105 = Panel(repeat_8)  # disabled
panel_106 = Panel("2")  # disabled
multiplication_24 = Multiplication(A=panel_106, B=aantal_gedetineerden_per_leefgroep)  # disabled
lng_2 = ListLength(List=flatten_4)  # disabled
panel_107 = Panel("0")  # disabled
panel_108 = Panel("1")  # disabled
panel_109 = Panel("8")  # disabled
panel_110 = Panel("1")  # disabled
series_6 = Series(Start=panel_107, Step=panel_108, Count=aantal_leefgroepen)  # disabled
addition_17 = Addition(A=panel_109, B=multiplication_24)  # disabled
repeat_9 = RepeatData(Data="2", Length=aantal_gedetineerden_per_leefgroep)
addition_18 = Addition(A=lng_2, B=panel_110)  # disabled
lng_3 = ListLength(List=flatten_2)  # disabled
lng_4 = ListLength(List=panel_42)  # disabled
lng_5 = ListLength(List=panel_34)  # disabled
lng_6 = ListLength(List=panel_36)  # disabled
lng_7 = ListLength(List=panel_44)
lng_8 = ListLength(List=panel_67)
multiplication_25 = Multiplication(A=series_6, B=addition_17)  # disabled
multiplication_26 = Multiplication(A=lng, B=aantal_leefgroepen)  # disabled
merge_23 = Merge(Data1=addition_18, Data2=lng_3, Data3=lng_4, Data4=lng_5, Data5=lng_6, Data6=lng_7, Data7=lng_8, Data8=repeat_9)
repeat_10 = RepeatData(Data=multiplication_25, Length=multiplication_26)  # disabled
flatten_10 = FlattenTree(Tree=merge_23, Path="{0}")  # disabled
panel_111 = Panel("1")  # disabled
series_7 = Series(Start=panel_111, Step="0", Count=aantal_gedetineerden_per_leefgroep)
sort = SortList(Keys=repeat_10)  # -> Keys, ValuesA; disabled
panel_112 = Panel(sort.Keys)  # disabled
merge_24 = Merge(Data1=flatten_10, Data2=series_7, Data3="1")
flatten_11 = FlattenTree(Tree=merge_24, Path="{0}")
addition_19 = Addition(A=panel_105, B=panel_112)  # disabled
panel_113 = Panel(addition_19)  # disabled
panel_114 = Panel("0")  # disabled
series_8 = Series(Start=panel_114, Step=lng, Count=aantal_leefgroepen)  # disabled
number_slider_44 = Slider(9, range=0..20)  # disabled
toggle = BooleanToggle(False)  # disabled
ins = InsertItems(List=panel_113, Item=number_slider_44, Indices=series_8, Wrap=toggle)  # disabled
panel_115 = Panel(ins)  # disabled
partition = PartitionList(List=panel_115, Size=flatten_11)  # disabled
path_mapper = PathMapper(partition, source="{a;b;c;d;e}", target="{path_index}")  # disabled
panel_116 = Panel(path_mapper)  # disabled
panel_117 = Panel(",")  # disabled
join_5 = TextJoin(Text=panel_116, Join=panel_117)  # disabled
panel_118 = Panel(join_5)  # disabled
flatten_12 = FlattenTree(Tree=panel_118, Path="{0}")  # disabled
merge_25 = Merge(Data1=merge_20, Data2=flatten_12)  # disabled
# lijst relaties
panel_119 = Panel(merge_25)  # disabled

# ---- group: Fase twee / mapping static nodes
# Op welk verdiep wil je starten?
floor_5 = Slider(0, range=-1..3)
muurrelatie = BooleanToggle(True)
panel_120 = Panel("Garden")
static_nodes = GhPythonScript(outside=panel_120, planNodes=nodes, triage=idealcsv.triagepunt, niveau_toekomen=floor_5, bool_muurRel=muurrelatie)  # -> flatten(idKnopen), designPossibilities; inputs planNodes: list
# ---------- static_nodes: Python ----------
__author__ = "Ellen De Sloovere"
__version__ = "2022.04.17"


import scriptcontext
import klasDefinities
reload(klasDefinities)

from klasDefinities import *
from itertools import *

def TimeConsumingTask():    
    for i in range(30000):
        # Was escape key pressed?
        if (scriptcontext.escape_test(False)):
            print "TimeConsumingTask cancelled."
            break

TimeConsumingTask()

        
#for el in beginGroepen

pi = []
for n in planNodes:
    #wachtruimte
    #and n.roomType != 'Corridor'
    if n.getNodeDegree(bool_muurRel) >= 4 and n.getRoomType() != outside  and n.getRoomType() != 'Balcony':
        toegang = []
        hub = []
        wc =[]
        #buren van wachtruimte: administratie, controle, toillet en inkom
        for i in getNodes(n.getBuren(bool_muurRel), planNodes):
            
            #toegang
            # and i.roomType != 'Corridor'
            if i.getRoomType() != outside and  i.getRoomType() != 'Balcony':
                #i.heeftRaam() != [] and
                if i.getID()!= n.getID() and i.identifier[0] == niveau_toekomen and i.heeftRaam(): 
                    toegang.append(i.getID())
                
                #wc
                #and i.roomType != 'Corridor'
                if i.getNodeDegree(bool_muurRel) <= 2: 
                    wc.append(i.getID())
            
            #hub (controle - handscanner - i) naar triage (el)
            """for el in getNodes(i.getBuren(bool_muurRel),planNodes):
                #ergens moet er nog een niet gelijk aan outside tussen
                if el.getNodeDegree(bool_muurRel) >= triage and el.getID() != n.getID() : 
                    hub.append((i, el))"""
            
            
            
            
            #hub (controle - handscanner - i) naar triage (el)
            for el in getNodes(i.getBuren(bool_muurRel),planNodes):
                #ergens moet er nog een niet gelijk aan outside tussen
                if el.getNodeDegree(bool_muurRel) >= triage and el.getID() != n.getID() : 
                    hub.append((i, el))
                """if i.roomType == 'Corridor': 
                    for x in getNodes(el.getBuren(bool_muurRel),planNodes):
                        if x.getNodeDegree(bool_muurRel) >= triage and el.getID() != n.getID() and len(set((el, x, i, n))) ==4: 
                            hub.append((i, el, x))
                
                else:
                    if el.getNodeDegree(bool_muurRel) >= triage and el.getID() != n.getID() : 
                        hub.append((i, el))"""
            

        #controlekamer en triage
        #hu, tussen, tri
        for elementen in hub:
            #fouille
            tussen =[]
            if len(elementen) == 3:
                hu = elementen[0]
                tri  = elementen[2]
            else:
                hu = elementen[0]
                tri  = elementen[1]
            for ni in getNodes(hu.getBuren(bool_muurRel), planNodes):
                #n.getBuren is administratie
                #and hu.roomType != 'Corridor' and ni.roomType != 'Corridor'
                if ni.getID() != tri.getID() and overlap(ni.getID(), n.getBuren(bool_muurRel), planNodes) is not None and (ni.getID() not in toegang or len(toegang) > 1):
                    #(fouille, administratie)
                    for el in overlap(ni.getID(), n.getBuren(bool_muurRel), planNodes):
                        if len(getNodes(el, planNodes)) >= 2:
                            k = getNodes(el, planNodes)
                            #k[0].roomType != 'Corridor' and  k[1].roomType != 'Corridor' 
                            if hu.getRoomType() != outside and k[0].getRoomType() != outside and  k[0].getRoomType() != 'Balcony' and k[1].getRoomType() != 'Balcony' and   k[1].getRoomType() != outside and len(set((el[0], el[1], ni.getID(), tri.getID(), n.getID(), hu.getID()))) == 5:
                                tussen.append(el)


            #wachtkamer, controle, triage naar volgend deel, 'aan hub en wachtkamer' (nu nog maar 1 kamer), inkom, wc)
            if tussen != [] and wc != [] and toegang != [] and hu.getRoomType != outside: pi.append((n.getID(), hu.getID(), tri.getID(), tussen, toegang, wc))
                


idKnopen = []
buren =[]

for i in pi:
    
    idKnopenT = [] 

    for el in i[3]:

        if el[0] not in i[0:3] and el[1] not in i[0:3]:
            reeks = [k for k in i[0:3]]
            reeks.append(el[0])
            reeks.append(el[1])
            idKnopenT.append(reeks)
            
    for combo in idKnopenT:
        reeksT = []
        for inkom in i[4]:
            combo = reeks + [inkom]
            opties = set(i[5])
            if len(i[4]) > 1:
                for element in i[4]: 
                    if element != inkom: 
                        opties.add(element)
                        
            combo.append(list(opties))
            idKnopen.append(combo)

idKnopen2 = []

for el in idKnopen:
    for i in el[6]:
        if isinstance (i,list): 
            for k in i:
                reeks = el[0:6] + [k]
                idKnopen2.append(reeks)
        else:
            reeks = el[0:6] + [i]
            idKnopen2.append(reeks)
            
            
idKnopen_ = []
for el in idKnopen2:
    if len(set(el)) == 7:
        idKnopen_.append(el)
    

designPossibilities = len(idKnopen_)

#opp

"""
deviatie = deviatie.getDictionary()
opl =[]

namen = { 0: 'wachtruimte', 1: 'controle - handscanner', 2: 'triagepunt', 3: ('administratieruimte', 'fouilleerruimte'), 4: ('inkom', 'tocht- /veiligheidssas'), 5: 'toillet bezoekers'}
for el in pi:
    tussen = ['_' for i in range(6)]
    for i in range(0, 6):
        if i in range(0, 3):

            nodeOpp = getNodes([el[i]], planNodes)[0].getOpp()
            stand, afw = deviatie[namen[i]]

            if stand - afw <= nodeOpp <= stand + afw: tussen[i] = (el[i], 1)
            elif nodeOpp <= stand - afw: tussen[i] = (el[i], 1 /(nodeOpp / (stand - afw)))
            else:
                tussen[i] = (el[i], nodeOpp / (stand + afw))
        
        
        elif i == 3:
            tussen[i] = [['_','_'] for k in range(len(el[i]))]
            for k in range(len(el[i])):
                node1, node2 = getNodes(el[i][k], planNodes)
                nodeOpp1, nodeOpp2 = node1.getOpp(), node2.getOpp()
                stand1, afw1 = deviatie[namen[i][0]]      #administratie
                stand2, afw2 = deviatie[namen[i][1]]      #fouille
                
                if el[0] in node1.getBuren():
                    na, nf = node1, node2
                    ona, onf = nodeOpp1, nodeOpp2
                else:
                    nf, na = node1, node2
                    onf, ona = nodeOpp1, nodeOpp2
                #draait soms om, hier klopt er nog iets niet
                #administratie
                if stand1 - afw1 <= ona <= stand1 + afw1: tussen[i][k][0] = (na.getID(), 1)
                elif ona <= stand1 - afw1: tussen[i][k][0] = (na.getID(), 1 /(ona / (stand1 - afw1)))
                else:
                    tussen[i][k][0] = (na.getID(), (ona / (stand1 + afw1)))
                    
                #fouille
                if stand2 - afw2 <= onf <= stand2 + afw2: tussen[i][k][1] = (nf.getID(), 1)
                elif onf <= stand2 - afw2: tussen[i][k][1] = (nf.getID(), 1 /(onf / (stand2 - afw2)))
                else:
                    tussen[i][k][1] = (nf.getID(), (onf / (stand2 + afw2)))

        
        elif i == 4:
            tussen[i] = ['_' for k in range(len(el[i]))]
            for k in range(len(el[i])):
                nodeOpp = getNodes([el[i][k]], planNodes)[0].getOpp()
                stand, afw = deviatie[namen[i][0]][0] + deviatie[namen[i][1]][0], deviatie[namen[i][0]][1] + deviatie[namen[i][1]][1]
        
                if stand - afw <= nodeOpp <= stand + afw: tussen[i][k] = (el[i][k], 1)
                elif nodeOpp <= stand - afw: tussen[i][k] = (el[i][k], 1 /(nodeOpp / (stand - afw)))
                else:
                    tussen[i][k] = (el[i][k], nodeOpp / (stand + afw))
    
        else:
            tussen[i] = ['_' for k in range(len(el[i]))]
            for k in range(len(el[i])):
                nodeOpp = getNodes([el[i][k]], planNodes)[0].getOpp()
                stand, afw = deviatie[namen[i]]
    
                if stand - afw <= nodeOpp <= stand + afw: tussen[i][k] = (el[i][k], 1)
                elif nodeOpp <= stand - afw: tussen[i][k] = (el[i][k], 1 /(nodeOpp / (stand - afw)))
                else:
                    tussen[i][k] = (el[i][k], nodeOpp / (stand + afw))
    
    opl.append(tussen)

print opl


#kan mssn nog algemener
idKnopen = []
afwijking =[]
buren =[]
for i in opl:
    
    idKnopenT = []
    afwijkingT =[]
    
    for k in range(3):
        idKnopenT.append(i[k][0])
        afwijkingT.append(i[k][1])
        
    par = []
    for el in i[3]:
        par.append(el[0][1] + el[1][1])
    idKnopenT.append(i[3][par.index(min(par))][0][0])
    idKnopenT.append(i[3][par.index(min(par))][1][0])
    afwijkingT.append(i[3][par.index(min(par))][0][1])
    afwijkingT.append(i[3][par.index(min(par))][1][1])
    
    par2 =[]
    parknoop =[]

    for el in i[4]:
        if el[0] not in set(idKnopenT):
            parknoop.append(el[0])
            par2.append(el[1])

    if parknoop != []:idKnopenT.append(parknoop[par2.index(min(par2))])
    if par2 != []:afwijkingT.append(par2[par2.index(min(par2))])
    
    par3 =[]
    parknoop3 =[]
    for el in i[5]:
        if el[0] not in set(idKnopenT):
            parknoop3.append(el[0])
            par3.append(el[1])
            

    if parknoop != []: idKnopenT.append(parknoop3[par3.index(min(par3))])
    if par2 != []: afwijkingT.append(par3[par3.index(min(par3))])

    if len(idKnopenT) == 7:
        idKnopen.append(idKnopenT)
        afwijking.append(afwijkingT)


designPossibilities = len(idKnopen)

"""
# ---------- end static_nodes ----------

item_8 = ListItem(List=static_nodes.idKnopen, Index=Slider(6, range=0..85), Wrap=True)
pick = GhPythonScript(planNodes=nodes, knopen=item_8)  # -> flatten(n), l, idKnopen; inputs planNodes: list
# ---------- pick: Python ----------
__author__ = "Ellen De Sloovere"
__version__ = "2022.05.10"

import rhinoscriptsyntax as rs
import math
import scriptcontext
import Rhino.Geometry as rg
import ghpythonlib.components as gh
import System
import klasDefinities
reload(klasDefinities)

from klasDefinities import *
from decimal import *

#afwijking = '%.3f' % (sum(el for el in afw)/len(knopen)),  tuple('%.3f' % el for el in afw)
idKnopen = knopen
n_ = [el for el in getNodes(knopen, planNodes)]
knopen = getNodes(knopen, planNodes)
print knopen

knopen[0].roomType = 'wachtruimte'
knopen[1].roomType = 'controle - handscanner'
knopen[2].roomType = 'triagepunt'
knopen[3].roomType = 'administratieruimte'
knopen[4].roomType = 'fouilleerruimte'
knopen[5].roomType = 'inkom'
knopen[6].roomType = 'toillet bezoekers'
    
l_ = []
l_.append(Edge(knopen[0], knopen[6], planNodes))
l_.append(Edge(knopen[0], knopen[5], planNodes))
l_.append(Edge(knopen[0], knopen[1], planNodes))
l_.append(Edge(knopen[0], knopen[3], planNodes))
l_.append(Edge(knopen[1], knopen[4], planNodes))
l_.append(Edge(knopen[3], knopen[4], planNodes))
l_.append(Edge(knopen[1], knopen[2], planNodes))
# ---------- end pick ----------
knopen_2 = Panel(pick.idKnopen)

# ---- group: Fase twee
# ruimtes: wachtruimte
# controle - handscanner
# triagepunt
# administratie
# fouilleerruimte
# inkom & tocht-/veiligheidssas
# toillet bezoekers
aantal_mogelijke_configuraties_van_stati = Panel(static_nodes.designPossibilities)  # "aantal mogelijke configuraties van statisch deel"

# ---- group: Fase twee / static part color
visueel_2 = GhPythonScript(planNodes=nodes, knopen=pick.n)  # -> flatten(visueel); inputs planNodes: list, knopen: list
# ---------- visueel_2: Python ----------
__author__ = "Ellen De Sloovere"
__version__ = "2022.05.10"

import rhinoscriptsyntax as rs
import math
import scriptcontext
import Rhino.Geometry as rg
import ghpythonlib.components as gh
import System
import klasDefinities
reload(klasDefinities)

from klasDefinities import *
from decimal import *


#afwijking = '%.3f' % (sum(el for el in afw)/len(knopen)),  tuple('%.3f' % el for el in afw)
idKnopen = knopen
print knopen


visueel = [el.getGeo() for el in knopen]
# ---------- end visueel_2 ----------
srf_10 = Surface(visueel_2)
preview_6 = CustomPreview(Geometry=srf_10, Material=ColourSwatch(SwatchColor=RGB(255, 225, 0)))

# ---- group: Fase twee
dynamic_nodes = GhPythonScript(
    outside=panel_120,
    planNodes=nodes,
    beginNodes=pick.idKnopen,
    aantalGroepen=idealcsv.aantalLeefgroepen,
    aantalUnits=idealcsv.aantalUnits_leefgroep,
    bool_muurRel=muurrelatie)  # -> aantal_leefgroepen, leefgroepen, alter_leefgroepen, aantal_a_leefgroepen, tracking; inputs planNodes: list, beginNodes: list, aantalGroepen: Int32, aantalUnits: Int32
# ---------- dynamic_nodes: Python ----------
__author__ = "Ellen De Sloovere"
__version__ = "2022.05.10"

import rhinoscriptsyntax as rs
import math
import scriptcontext
import Rhino.Geometry as rg
import ghpythonlib.components as gh
import System
from itertools import *
import copy
import klasDefinities
reload(klasDefinities)
from klasDefinities import *

#de beginknopen zijn hier tracking
tracking = getNodes(beginNodes,planNodes)


dyn_nodes =[]
alter_leefgroepen = []


# buren van triage zijn inkom en buitenruimte
#for el in getNodes(getNodes(beginNodes,planNodes)[2].getBuren(bool_muurRel), planNodes):
for el in getNodes(getNodes(beginNodes,planNodes)[2].getBuren(bool_muurRel), planNodes):
    
    if el.getRoomType() != outside and el not in tracking:
        #buren van inkom is zitruimte
        for ni in getNodes(el.getBuren(bool_muurRel), planNodes):
                #text met el!= outside want eigenlijk al eruit gehaald
                valid = []
                if el.getRoomType() != outside and ni.getRoomType() != outside and el not in tracking and ni not in tracking and el.getNodeDegree(bool_muurRel) >= aantalUnits + 2 and ni.getNodeDegree(bool_muurRel) >= aantalUnits + 5:
                    #buren van zitruimte en inkom --> 3de graad pad, kijk voor overlap voor units
                    tussenUnits = []
                    for un in getNodes(ni.getBuren(bool_muurRel), planNodes) : 
                        if un.getRoomType() != outside and un.roomType != 'Corridor' and un.roomType != 'Balcony'and un not in tracking:
                            if un.difFloorRel:
                                b = False
                                for x in tussenUnits:
                                    if isinstance(x, set) and un in x:
                                        b = True
                                if b is False:
                                    stack_unit = set()
                                    stack_unit.add(un)
                                    for el2 in getNodes(un.difFloorRel, planNodes):
                                        if el2.getRoomType() != outside and el2 not in tracking and len(set((el2 , el , ni)))  == 3: stack_unit.add(el2)
                                    tussenUnits.append(stack_unit)
                                        
                                else:
                                    tussenUnits.append(un)
                                    
                    #extra check of de cycle van 3 nodes effectief wordt gemaak gezocht 
                    for o in tussenUnits:
                        if isinstance(o, set):
                            con = False
                            used = False
                            for x in o:
                                if ni in getNodes(x.getBuren(),planNodes): con = True
                                if x == ni or x == el: used = True
                            if con == True and used == False: valid.append(o)
                        else:
                            if ni in getNodes(o.getBuren(), planNodes) and o.getRoomType() != outside and ni != o: valid.append(o)
                                
        
                if el!= None and ni != None and valid != []:
                    dyn_nodes.append([el, ni, valid])
                    tracking.append(el)
                    tracking.append(ni)
                    for fa in valid:
                        if isinstance(fa, set):
                            for f in fa: tracking.append(f)
                        else: tracking.append(fa)
                            
                                
                            
                
    else:
        tussen_ = []
        #check of het buitenruimte is
        if el.getRoomType() == outside and el not in tracking:
            #tussen = []
            # buren van buitenruimte is zitruimte en landing voor units
            for landing in getNodes(el.getBuren(bool_muurRel), planNodes):
                if landing not in tracking:
                    tussenUnits = []
                    for un in getNodes(landing.getBuren(bool_muurRel), planNodes):
                        if un != el and un not in tracking:
                            if un.difFloorRel and un.roomType != 'Corridor':
                                b = False
                                for x in tussenUnits:
                                    if isinstance(x, set) and un in x:
                                        b = True
                                if b is False:
                                    stack_unit = set()
                                    stack_unit.add(un)
                                    for el2 in getNodes(un.difFloorRel, planNodes):
                                        if el2.getRoomType() != outside and el2 not in tracking and len(set((el2 , el , landing))) == 3 and el2 not in tracking: stack_unit.add(el2)
                                    tussenUnits.append(stack_unit)
                                    
                            else:
                                tussenUnits.append(un)
                    if tussenUnits != [] and el != landing and len([el, landing, tussenUnits]) == 3:
                        #buitenruimte, tussenruimte, units
                        print [el, landing, tussenUnits]
                        alter_leefgroepen.append([el, landing, tussenUnits])
    
    
        
        

aantal_a_leefgroepen = len(alter_leefgroepen)


#check hoeveel leefgroepen er mogelijk zijn door verschillende zitruimtes en inkoms te bekijken + dubbele/gelijke oplossingen eruit halen
aantal_leefgroepen = len(dyn_nodes)
leefgroepen = dyn_nodes
# ---------- end dynamic_nodes ----------
mogelijk_aantal_leefgroepen = Panel(dynamic_nodes.aantal_leefgroepen)
panel_121 = Panel(dynamic_nodes.leefgroepen)
pick_2 = GhPythonScript(planN=nodes, leefgroepen=dynamic_nodes.leefgroepen, tri=pick.n)  # -> flatten(n), l, zit; inputs planN: list, leefgroepen: list, tri: list
# ---------- pick_2: Python ----------
import Rhino.Geometry as rg
import csv
from itertools import *
import klasDefinities
reload(klasDefinities)

from klasDefinities import *

import rhinoscriptsyntax as rs
delta = 0.01

n_ = []
l_ = []
zit = []

for element in leefgroepen:
    tussen_ = []
    
    tussen_.append(element[0])
    tussen_.append(element[1])
    
    element[0].roomType = 'inkom'
    element[1].roomType =  'zitruimte'
    
    zit.append(element[1])
    
    l_.append(Edge(element[0], element[1], planN))
    l_.append(Edge(element[0], tri[2], planN))
    
    tussen = []
    for el in element[2]: 
        print el
        if isinstance(el, set):
            l = el.copy()
            _list = []
            while l:
                _list.append(l.pop())
            for i in range(len(_list)-1): 
                l_.append(Edge(_list[i], _list[i+1], planN))
                
            af_inkom = []
            af_zitruimte = []
            for  i in _list:
                af_inkom.append(afstand(i, element[0]))
                af_zitruimte.append(afstand(i, element[1]))
                
            for i in range(len(af_inkom)):
                if abs(af_inkom[i] - min(af_inkom)) <= delta: l_.append(Edge(_list[i], element[0], planN))
              

            for i in range(len(af_zitruimte)):
                if abs(af_zitruimte[i] - min(af_zitruimte)) <= delta: l_.append(Edge(_list[i], element[1], planN))
           
                    
            tussen.append(_list)
            
        else: 
            tussen.append(el)
            l_.append(Edge(el,element[0], planN))
            l_.append(Edge(el,element[1], planN))


    tussen_.append(tussen)
    for el in tussen:
        if isinstance(el, list):
            for i in el:
                i.roomType = 'private unit'
                
        else:
            el.roomType = 'private unit'
    n_.append(tussen_)
# ---------- end pick_2 ----------

# ----
number_slider_45 = Slider(0, range=0..100)  # disabled
python = GhPythonScript()  # -> a; inputs x: list
# ---------- python: Python ----------
import Rhino.Geometry as rg
import csv
from itertools import *
import klasDefinities
reload(klasDefinities)

from klasDefinities import *


__author__ = "info"
__version__ = "2022.08.10"

import rhinoscriptsyntax as rs

a = [el[1].getGeo()for el in x]
# ---------- end python ----------
lng_9 = ListLength(List=panel_103)  # disabled
series_9 = Series(Start=number_slider_45, Step=1, Count=lng_9)  # disabled
panel_122 = Panel(python)
con_pick = GhPythonScript(leefgroepen=dynamic_nodes.leefgroepen, alterleefgroepen=dynamic_nodes.alter_leefgroepen, tri=pick.n)  # -> l, score; inputs planN: list, leefgroepen: list, alterleefgroepen: list, tri: list
# ---------- con_pick: Python ----------
__author__ = "Ellen De Sloovere"
__version__ = "2022.08.08"

import Rhino.Geometry as rg
import csv
from itertools import *
import klasDefinities
reload(klasDefinities)
from klasDefinities import *
import rhinoscriptsyntax as rs


l_ = []
score = []

for el in alterleefgroepen:
    if el[0] not in getNodes(tri[2].getBuren(), planN):
        n = Neighborhood(el[0], 3, planN)
        p = find_shortest_path(n, el[0], tri[2])
        if p:
            for index in range(len(p)-1):
                l_.append(Edge(p[index], p[index+1], planN))
            score.append(1/len(p))
        else: score.append(0)
            
    else: 
        l_.append(Edge(el[0], tri[2], planN))
        score.append(1)
        
for el in leefgroepen:

    if el[0] not in getNodes(tri[2].getBuren(), planN):
        n = Neighborhood(el[0], 3, planN)
        p = find_shortest_path(n, el[0], tri[2])
        if p:
            for index in range(len(p)-1):
                l_.append(Edge(p[index], p[index+1], planN))
            score.append(1/len(p))
        else: score.append(0)
            
    else: 
        l_.append(Edge(el[0], tri[2], planN))
        score.append(1)
# ---------- end con_pick ----------

panel_123 = Panel("{0},{1},{2},\"\",\"{3}\",\"\"")  # disabled
format = Format(Format=panel_123, Culture=127, Data0=series_9, Data1=panel_103, Data2=panel_97, Data3=panel_119)  # disabled
panel_124 = Panel("NodeId,NodeType,Area,WallRelation,DoorRelation,AirRelation")  # disabled
merge_26 = Merge(Data1=panel_124, Data2=format)  # disabled

geo_46 = Geometry(<curve referenced from the Rhino model>)
srf_11 = Surface(geo_46)
preview_7 = CustomPreview(Geometry=srf_11, Material=ColourSwatch(SwatchColor=RGB(255, 255, 255)))

# ----
# csv-file
# rechtermuisknop > stream contents
# opgeslaan als .txt bestand
# .txt bestand openen in kladblok op pc
# opslaan als csv file (.csv achter naam file schrijven)
panel_125 = Panel(merge_26)  # disabled

# ---- group: Fase drie / leefgroep 1
item_9 = CherryPicker(pick_2.n, ListIndex=0, TreePath_path="{0}")
filter_2 = GhPythonScript(leefgroep=item_9)  # -> ruimtes
# ---------- filter_2: Python ----------
__author__ = "Ellen De Sloovere"
__version__ = "2022.07.06"

import rhinoscriptsyntax as rs
print leefgroep
ruimtes = [el for el in leefgroep]
print ruimtes
# ---------- end filter_2 ----------
item_10 = CherryPicker(filter_2, ListIndex=0, TreePath_path="{0;0}")
item_11 = CherryPicker(filter_2, ListIndex=1, TreePath_path="{0;0}")
item_12 = CherryPicker(filter_2, ListIndex=2, TreePath_path="{0;0}")

# ----
filter_3 = GhPythonScript()  # -> ruimtes; inputs leefgroep: list
# ---------- filter_3: Python ----------
__author__ = "Ellen De Sloovere"
__version__ = "2022.07.06"

import rhinoscriptsyntax as rs

ruimtes = [el.getGeo() for el in leefgroep]
# ---------- end filter_3 ----------
srf_12 = Surface(filter_3)
preview_8 = CustomPreview(Geometry=srf_12, Material=ColourSwatch(SwatchColor=RGB(0, 0, 0)))

# ---- group: Fase drie / leefgroep 1
swatch_6 = ColourSwatch(SwatchColor=RGB(0, 68, 255))
visueel_3 = GhPythonScript(knopen=item_10)  # -> flatten(visueel); inputs planNodes: list, knopen: list; same code as visueel_2
srf_13 = Surface(visueel_3)
preview_9 = CustomPreview(Geometry=srf_13, Material=swatch_6)

visueel_4 = GhPythonScript(knopen=item_12)  # -> flatten(visueel); inputs planNodes: list, knopen: list
# ---------- visueel_4: Python ----------
__author__ = "Ellen De Sloovere"
__version__ = "2022.05.10"

import rhinoscriptsyntax as rs
import math
import scriptcontext
import Rhino.Geometry as rg
import ghpythonlib.components as gh
import System
import klasDefinities
reload(klasDefinities)

from klasDefinities import *
from decimal import *


#afwijking = '%.3f' % (sum(el for el in afw)/len(knopen)),  tuple('%.3f' % el for el in afw)
idKnopen = knopen
print knopen

visueel = []
for el in knopen:
    if isinstance(el, list):
        for i in el:
            if isinstance(i, list):
                for k in i:
                    visueel.append(k.getGeo())
            else:
                visueel.append(i.getGeo())
    else:
         visueel.append(el.getGeo())
# ---------- end visueel_4 ----------
swatch_7 = ColourSwatch(SwatchColor=RGB(41, 217, 44))
srf_14 = Surface(visueel_4)
preview_10 = CustomPreview(Geometry=srf_14, Material=swatch_7)

visueel_5 = GhPythonScript(knopen=item_11)  # -> flatten(visueel), idKnopen, afwijking; inputs planNodes: list, knopen: list; same code as visueel_2
swatch_8 = ColourSwatch(SwatchColor=RGB(181, 21, 0))
srf_15 = Surface(visueel_5.visueel)
preview_11 = CustomPreview(Geometry=srf_15, Material=swatch_8)

# ---- group: Fase drie / leefgroep 2
item_13 = CherryPicker(pick_2.n, ListIndex=1, TreePath_path="{0}")
filter_4 = GhPythonScript(leefgroep=item_13)  # -> ruimtes; same code as filter_2
item_14 = CherryPicker(filter_4, ListIndex=0, TreePath_path="{0;0}")
item_15 = CherryPicker(filter_4, ListIndex=1, TreePath_path="{0;0}")
item_16 = CherryPicker(filter_4, ListIndex=2, TreePath_path="{0;0}")

visueel_6 = GhPythonScript(knopen=item_15)  # -> flatten(visueel), idKnopen, afwijking; inputs planNodes: list, knopen: list; same code as visueel_2
srf_16 = Surface(visueel_6.visueel)
preview_12 = CustomPreview(Geometry=srf_16, Material=swatch_8)

visueel_7 = GhPythonScript(knopen=item_14)  # -> flatten(visueel); inputs planNodes: list, knopen: list; same code as visueel_2
srf_17 = Surface(visueel_7)
preview_13 = CustomPreview(Geometry=srf_17, Material=swatch_6)

visueel_8 = GhPythonScript(knopen=item_16)  # -> flatten(visueel); inputs planNodes: list, knopen: list; same code as visueel_4
srf_18 = Surface(visueel_8)
preview_14 = CustomPreview(Geometry=srf_18, Material=swatch_7)

# ---- group: Possible node distribution
node_distri_pos = GhPythonScript(nodes=nodes)  # -> distribution; inputs nodes: list
# ---------- node_distri_pos: Python ----------
__author__ = "Ellen De Sloovere"
__version__ = "2022.07.22"

import rhinoscriptsyntax as rs
import math
import scriptcontext
import Rhino.Geometry as rg
import ghpythonlib.components as gh
import System
import klasDefinities
reload(klasDefinities)

from klasDefinities import *

distribution = []
for el in nodes:
    distribution.append(el.getNodeDegree(True))
# ---------- end node_distri_pos ----------
node_distributi = BarGraph(node_distri_pos, BarColor=RGB(255, 0, 89))

# ---- group: Node distribution
node_distri = GhPythonScript(nodes=nodes)  # -> distribution; inputs nodes: list
# ---------- node_distri: Python ----------
__author__ = "Ellen De Sloovere"
__version__ = "2022.07.22"

import rhinoscriptsyntax as rs
import math
import scriptcontext
import Rhino.Geometry as rg
import ghpythonlib.components as gh
import System
import klasDefinities
reload(klasDefinities)

from klasDefinities import *

distribution = []
for el in nodes:
    distribution.append(el.getNodeDegree())
# ---------- end node_distri ----------
node_distributi_2 = BarGraph(node_distri, BarColor=RGB(255, 0, 89))

# ---- group: input multi-plane graph
hoogte_verdiepen = Panel("""3
3
3""")
pt_6 = Point([Point(219.150601, -137.2481112, 0), Point(188.1757288, -176.6907351, 0), Point(180.5523238, -118.6932481, 0)])
panel_126 = Panel("""True
False
False""")
merge_27 = Merge(Data1=pt_5, Data2=pt_4, Data3=pt_3)
item_17 = ListItem(List=pt_6, Index=0, Wrap=True)
lng_10 = ListLength(List=merge_27)
repeat_11 = RepeatData(Data=panel_126, Length=lng_10)
cull = CullPattern(List=merge_27, CullPattern=repeat_11)
pt_7 = Point(cull)

# ----
planar_graph = GhPythonScript(nodes=nodes, height_floors=hoogte_verdiepen, n_ref_point=item_17, o_ref_points=pt_7)  # -> graph; inputs nodes: list, height_floors: list, n_ref_point: Point3d, o_ref_points: list of Point3d
# ---------- planar_graph: Python ----------
__author__ = "Ellen De Sloovere"
__version__ = "2022.07.22"

import rhinoscriptsyntax as rs
import math
import scriptcontext
import Rhino.Geometry as rg
import ghpythonlib.components as gh
import System
import klasDefinities
reload(klasDefinities)

from klasDefinities import *

scriptcontext.doc = Rhino.RhinoDoc.ActiveDoc
klasDefinities.deleteLayer('Planar_layer')
klasDefinities.addRhinoLayer('Planar_layer')
scriptcontext.doc = ghdoc

n_ = [] 
l_ = []


for el in nodes:
    #planar nodes opstellen
    trans = rg.Point3d(n_ref_point[0] - o_ref_points[el.identifier[0]][0], n_ref_point[1] - o_ref_points[el.identifier[0]][1], sum(height_floors[0:el.identifier[0]+1])-height_floors[0])
    p1 = rg.Point3d(el.getGeo().CenterPoint()[0] + trans[0], el.getGeo().CenterPoint()[1] + trans[1], trans[2])
    el.plan_vis = p1, float(el.opp)/100 -0.2
    
    
    
    #3d edges
        
for el in nodes:
    buren = getNodes(el.getBuren(), nodes)
    n_.append(rs.AddSphere(el.plan_vis[0], el.plan_vis[1]))
    for el2 in buren:
        l_.append(rs.AddLine(el.plan_vis[0], el2.plan_vis[0]))

graph = [] + n_ + l_
# ---------- end planar_graph ----------

# ---- group: inkom & zitruimte
number_slider_46 = Slider(10, range=0..21)  # disabled
number_slider_47 = Slider(0, range=0..21)  # disabled
node_33 = ConstructNode2(Name="a room", Type=number_slider_46, Boundary=item_2)  # disabled
node_34 = ConstructNode2(Name="a room", Type=number_slider_47, Boundary=item_3)  # disabled

# ---- group: triburen
item_18 = CherryPicker(list_convert, ListIndex=0, TreePath_path="{0}")  # disabled
item_19 = CherryPicker(list_convert, ListIndex=1, TreePath_path="{0}")  # disabled
item_20 = CherryPicker(list_convert, ListIndex=2, TreePath_path="{0}")  # disabled
item_21 = CherryPicker(list_convert, ListIndex=4, TreePath_path="{0}")  # disabled
number_slider_48 = Slider(20, range=0..21)  # disabled
number_slider_49 = Slider(21, range=0..21)  # disabled
number_slider_50 = Slider(18, range=0..21)  # disabled
number_slider_51 = Slider(19, range=0..21)  # disabled
node_35 = ConstructNode2(Name="a room", Type=number_slider_50, Boundary=item_18)  # disabled
node_36 = ConstructNode2(Name="a room", Type=number_slider_51, Boundary=item_19)  # disabled
node_37 = ConstructNode2(Name="a room", Type=number_slider_48, Boundary=item_20)  # disabled
node_38 = ConstructNode2(Name="a room", Type=number_slider_49, Boundary=item_21)  # disabled

# ----
merge_28 = Merge(Data1=item_18, Data2=item_19, Data3=item_20, Data4=item_21)  # disabled

# ---- group: buurruimtes triage
swatch_9 = ColourSwatch(SwatchColor=RGBA(255, 0, 225, 103))  # disabled
srf_19 = Surface(merge_28)  # disabled
preview_15 = CustomPreview(Geometry=srf_19, Material=swatch_9)  # disabled

# ----
item_22 = CherryPicker(ListIndex=2, TreePath_path="{0}")  # disabled
item_23 = CherryPicker(ListIndex=0, TreePath_path="{0}")  # disabled
item_24 = CherryPicker(ListIndex=1, TreePath_path="{0}")  # disabled
number_slider_52 = Slider(17, range=0..21)  # disabled
number_slider_53 = Slider(13, range=0..21)  # disabled
item_25 = CherryPicker(ListIndex=3, TreePath_path="{0}")  # disabled
item_26 = CherryPicker(ListIndex=4, TreePath_path="{0}")  # disabled
item_27 = CherryPicker(ListIndex=5, TreePath_path="{0}")  # disabled
item_28 = CherryPicker(ListIndex=6, TreePath_path="{0}")  # disabled
number_slider_54 = Slider(14, range=0..21)  # disabled
number_slider_55 = Slider(16, range=0..21)  # disabled
number_slider_56 = Slider(10, range=0..21)  # disabled
number_slider_57 = Slider(12, range=0..21)  # disabled
node_39 = ConstructNode2(Name="a room", Type=number_slider_52, Boundary=item_22)  # disabled
node_40 = ConstructNode2(Name="a room", Type=number_slider_53, Boundary=item_23)  # disabled
node_41 = ConstructNode2(Name="a room", Type=number_slider_35, Boundary=item_24)  # disabled
node_42 = ConstructNode2(Name="a room", Type=number_slider_54, Boundary=item_25)  # disabled
node_43 = ConstructNode2(Name="a room", Type=number_slider_56, Boundary=item_27)  # disabled
node_44 = ConstructNode2(Name="a room", Type=number_slider_57, Boundary=item_28)  # disabled
node_45 = ConstructNode2(Name="a room", Type=number_slider_55, Boundary=item_26)  # disabled
number_slider_58 = Slider(0.4, range=0..3)  # disabled
number_slider_59 = Slider(2, range=0..3)  # disabled
edge_9 = ConstructEdge(Node1=node_40, Node2=node_41, Type=number_slider_59)  # disabled
edge_10 = ConstructEdge(Node1=node_40, Node2=node_42, Type=number_slider_59)  # disabled
edge_11 = ConstructEdge(Node1=node_42, Node2=node_45, Type=number_slider_59)  # disabled
edge_12 = ConstructEdge(Node1=node_41, Node2=node_45, Type=number_slider_59)  # disabled
edge_13 = ConstructEdge(Node1=node_40, Node2=node_43, Type=number_slider_59)  # disabled
edge_14 = ConstructEdge(Node1=node_40, Node2=node_44, Type=number_slider_59)  # disabled

# ---- group: inkom & zitruimte (continued)
edge_15 = ConstructEdge(Node1=node_39, Node2=node_33, Type=number_slider_59)  # disabled
edge_16 = ConstructEdge(Node1=node_33, Node2=node_34, Type=number_slider_59)  # disabled

# ---- group: triburen (continued)
edge_17 = ConstructEdge(Node1=node_39, Node2=node_35, Type=number_slider_59)  # disabled
edge_18 = ConstructEdge(Node1=node_39, Node2=node_36, Type=number_slider_59)  # disabled
edge_19 = ConstructEdge(Node1=node_39, Node2=node_37, Type=number_slider_59)  # disabled
edge_20 = ConstructEdge(Node1=node_39, Node2=node_38, Type=number_slider_59)  # disabled

# ---- group: unit
item_29 = CherryPicker(list_convert_2, ListIndex=0, TreePath_path="{0}")  # disabled
number_slider_60 = Slider(6, range=0..21)  # disabled
node_46 = ConstructNode2(Name="a room", Type=number_slider_60, Boundary=item_29)  # disabled
edge_21 = ConstructEdge(Node1=node_33, Node2=node_46, Type=number_slider_59)  # disabled
edge_22 = ConstructEdge(Node1=node_34, Node2=node_46, Type=number_slider_59)  # disabled

# ----
item_30 = CherryPicker(list_convert_2, ListIndex=1, TreePath_path="{0}")  # disabled
node_47 = ConstructNode2(Name="a room", Type=number_slider_60, Boundary=item_30)  # disabled
edge_23 = ConstructEdge(Node1=node_33, Node2=node_47, Type=number_slider_59)  # disabled
edge_24 = ConstructEdge(Node1=node_34, Node2=node_47, Type=number_slider_59)  # disabled

item_31 = CherryPicker(list_convert_2, ListIndex=3, TreePath_path="{0}")  # disabled
node_48 = ConstructNode2(Name="a room", Type=number_slider_60, Boundary=item_31)  # disabled
edge_25 = ConstructEdge(Node1=node_33, Node2=node_48, Type=number_slider_59)  # disabled
edge_26 = ConstructEdge(Node1=node_34, Node2=node_48, Type=number_slider_59)  # disabled

item_32 = CherryPicker(list_convert_2, ListIndex=2, TreePath_path="{0}")  # disabled
node_49 = ConstructNode2(Name="a room", Type=number_slider_60, Boundary=item_32)  # disabled
edge_27 = ConstructEdge(Node1=node_33, Node2=node_49, Type=number_slider_59)  # disabled
edge_28 = ConstructEdge(Node1=node_34, Node2=node_49, Type=number_slider_59)  # disabled

item_33 = CherryPicker(list_convert_2, ListIndex=4, TreePath_path="{0}")  # disabled
node_50 = ConstructNode2(Name="a room", Type=number_slider_60, Boundary=item_33)  # disabled
edge_29 = ConstructEdge(Node1=node_33, Node2=node_50, Type=number_slider_59)  # disabled
edge_30 = ConstructEdge(Node1=node_34, Node2=node_50, Type=number_slider_59)  # disabled

merge_29 = Merge(Data1=item_29, Data2=item_30, Data3=item_32, Data5=item_31, Data6=item_33)  # disabled

# ---- group: units
swatch_10 = ColourSwatch(SwatchColor=RGBA(255, 150, 59, 221))  # disabled
srf_20 = Surface(merge_29)  # disabled
preview_16 = CustomPreview(Geometry=srf_20, Material=swatch_10)  # disabled

# ----
edge_31 = ConstructEdge(Node1=node_39, Node2=node_41, Type=number_slider_59)  # disabled

merge_30 = Merge(
    Data1=node_40,
    Data2=node_41,
    Data3=node_39,
    Data4=node_42,
    Data5=node_45,
    Data6=node_45,
    Data7=node_43,
    Data8=node_44,
    Data9=node_33,
    Data10=node_34,
    Data15=node_46,
    Data16=node_47,
    Data17=node_47,
    Data18=node_49,
    Data19=node_48,
    Data20=node_49,
    Data21=node_48,
    Data22=node_50,
    Data23=node_38,
    Data24=node_36,
    Data25=node_37,
    Data26=node_35)  # disabled
merge_31 = Merge(
    Data1=edge_31,
    Data2=edge_9,
    Data3=edge_10,
    Data4=edge_12,
    Data5=edge_13,
    Data6=edge_14,
    Data7=edge_11,
    Data8=edge_16,
    Data9=edge_15,
    Data10=edge_17,
    Data11=edge_18,
    Data12=edge_19,
    Data13=edge_20,
    Data14=edge_21,
    Data15=edge_22,
    Data18=edge_21)  # disabled
graph_3 = ConstructGraph(
    Nodes=merge_30,
    Edges=merge_31,
    NodeTypes=["Living room", "Master room", "Kitchen", "Bathroom", "Dining room", "Child room", "Study room", "Second room", "Guest room", "Balcony/Garden", "Entrance", "Storage", "Wall-in", "External area", "Exterior wall", "Front door", "Interior wall", "Interior door", "Corridor", "other"],
    EdgeTypes=["Wall", "Door", "Air"],
    EdgetypeToShow=0)  # -> PlanGraph, GraphVisualisation; disabled
wrtype_4 = WriteRoomTypes(Graph=graph_3.PlanGraph, NodeTypes=panel_3, TextHeight=number_slider_58)  # disabled

# ---- group: Fase twee
mogelijk_aantal_alter_leefgroepen = Panel(dynamic_nodes.aantal_a_leefgroepen)
filter_5 = GhPythonScript(planN=nodes, v_leefgroep=dynamic_nodes.alter_leefgroepen)  # -> groepen, aantal_zit; inputs planN: list, v_leefgroep: list
# ---------- filter_5: Python ----------
__author__ = "Ellen De Sloovere"
__version__ = "2022.07.06"

import Rhino.Geometry as rg
import csv
from itertools import *
import klasDefinities
reload(klasDefinities)

from klasDefinities import *

import rhinoscriptsyntax as rs


if v_leefgroep:
    buiten = set()
    for el in v_leefgroep: buiten.add(el[0])
    aantal_zit = len(buiten)

    groepen = v_leefgroep

"""
leefgroepen = []
for element in v_leefgroep:
    tussen = [] 
    for el in element:
        if isinstance(el,list): 
            u_list = []
            for u in el: 
                if isinstance(u,set): 
                    u_set = set()
                    for u_el in u: 
                        u_set.add(u_el)
                        tracking.append(u_el)
                    u_list.append(u_set)
                else: 
                    u_list.append(u)
                    tracking.append(u)
            tussen.append(u_list)
        else: 
            tussen.append(el)
            tracking.append(el)
    leefgroepen.append(tussen)

"""






"""
lijst = []

for el in buiten:
    tussen = []
    for b in getNodes(el.getBuren(), planN):
        if b not in tracking: tussen.append((b.getNodeDegree(), b))
    lijst.append(tussen)

lijst2 = []
for el in lijst:
    lijst2.append(sorted(el, key = lambda x: x[0]))

zitruimtes = [el[-1][1] for el in lijst2]

for el in zitruimtes:
    el.roomType = 'zitruimte'
    tracking.append(el)

leefgroepen = []
for element in v_leefgroep:
    if element[1] not in zitruimtes:
        tussen = [] 
        for el in element:
            if isinstance(el,list): 
                u_list = []
                for u in el: 
                    if isinstance(u,set): 
                        u_set = set()
                        for u_el in u: 
                            if u_el not in zitruimtes: 
                                u_set.add(u_el)
                                tracking.append(u_el)
                        u_list.append(u_set)
                    else: 
                        if u not in zitruimtes: 
                            u_list.append(u)
                            tracking.append(u)
                tussen.append(u_list)
            else: 
                tussen.append(el)
                tracking.append(el)
        leefgroepen.append(tussen)



"""
# ---------- end filter_5 ----------
panel_127 = Panel(filter_5.groepen)
alternatief_1 = CherryPicker(filter_5.groepen, ListIndex=0, TreePath_path="{0;0;0}")
alternatief_2 = CherryPicker(filter_5.groepen, ListIndex=1, TreePath_path="{0;0;0}")

# ----
aantal_zit = Panel(filter_5.aantal_zit)
alternatief_2_2 = CherryPicker(filter_5.groepen, ListIndex=2, TreePath_path="{0;0;0}")
alternatief_2_3 = CherryPicker(filter_5.groepen, ListIndex=3, TreePath_path="{0;0;0}")
alternatief_2_4 = CherryPicker(filter_5.groepen, ListIndex=4, TreePath_path="{0;0;0}")
alternatief_2_5 = CherryPicker(filter_5.groepen, ListIndex=5, TreePath_path="{0;0;0}")
alternatief_2_6 = CherryPicker(filter_5.groepen, ListIndex=6, TreePath_path="{0;0;0}")
zit = Merge(Data1=alternatief_1, Data2=alternatief_2)  # -> flatten(Result)
filter_6 = GhPythonScript(zit=zit)  # -> zit; inputs zit: list
# ---------- filter_6: Python ----------
__author__ = "Ellen De Sloovere"
__version__ = "2022.08.10"

import rhinoscriptsyntax as rs

zit_ = [el[1] for el in zit]
# ---------- end filter_6 ----------

# ---- group: Fase twee (continued)
tussen_units = Merge(Data6=alternatief_2_5)  # -> flatten(Result)
pick_3 = GhPythonScript(
    planN=nodes,
    a_leefgroepen=tussen_units,
    zitruimtes=filter_6,
    tri=pick.n,
    data=dynamic_nodes.tracking,
    muurRel=muurrelatie)  # -> flatten(n), l, tracking; inputs planN: list, a_leefgroepen: list, zitruimtes: list, tri: list, data: list
# ---------- pick_3: Python ----------
import Rhino.Geometry as rg
import csv
from itertools import *
import klasDefinities
reload(klasDefinities)

from klasDefinities import *

import rhinoscriptsyntax as rs
delta = 0.01
n_ = []
l_ = []
score = []
tracking = data
#z_buur = {'wasruimte', 'sportruimte', 'keuken', 'zitruimte', 'time - out ruimte'

for el in zitruimtes:
    print el
    if el is not None:
        el.roomType = 'zitruimte'
        tracking.append(el)
        n_.append(el)
        for buur in getNodes(el.getBuren(muurRel),planN):
            if buur.roomType == 'buitenruimte':
                l_.append(Edge(el, buur, planN))
            
            
if len(a_leefgroepen) < 2: 
    a_leefgroepen = list(a_leefgroepen)

    
for element in a_leefgroepen:
    element[0].roomType = 'buitenruimte'
    element[1].roomType =  'tussenruimte'
    
    n_.append(element[0])
    n_.append(element[1])
    tracking.append(element[0])
    tracking.append(element[1])
    
    l_.append(Edge(element[0], element[1], planN))


    for el in element[2]: 
        if isinstance(el, set):
            l = el.copy()
            _list = []
            while l:
                a = l.pop()
                if a not in tracking: 
                    a.roomType = 'private unit'
                    n_.append(a)
                    _list.append(a)
                    tracking.append(a)
            for i in range(len(_list)-1): 
                l_.append(Edge(_list[i], _list[i+1], planN))

            af_tussenruimte = []
            for  i in _list:
                af_tussenruimte.append(afstand(i, element[1]))
                
            for i in range(len(af_tussenruimte)):
                if abs(af_tussenruimte[i] - min(af_tussenruimte)) <= delta: l_.append(Edge(_list[i], element[1], planN))

            
        else: 
            if el not in tracking: 
                el.roomType = 'private unit'
                tracking.append(el)
                n_.append(el)
                l_.append(Edge(el,element[1], planN))
# ---------- end pick_3 ----------

static_2 = GhPythonScript(
    outside=panel_120,
    planNodes=nodes,
    data=pick_3.tracking,
    data2=dynamic_nodes.tracking,
    beginNodes=pick.n,
    bool_muurRel=muurrelatie,
    index=Slider(13, range=0..120),
    auto=Toggle(True))  # -> i_tri_buren, message, possibilities, tracking; inputs planNodes: list, data: list, data2: list, beginNodes: list, index: Int32, auto: Boolean
# ---------- static_2: Python ----------
__author__ = "Ellen De Sloovere"
__version__ = "2022.07.06"
import Rhino
import rhinoscriptsyntax as rs
import math
import scriptcontext
import Rhino.Geometry as rg
import ghpythonlib.components as gh
import System
from itertools import *
import copy
import klasDefinities
reload(klasDefinities)

from klasDefinities import *

if not data:
    data = data2

s = set(getNodes(beginNodes[2].getBuren(bool_muurRel), planNodes))

tri_buren = []
Tburen = []
for el in s:
    if el not in data and el not in beginNodes and el.getRoomType() != outside and el.getRoomType() != 'Corridor':
        Tburen.append(el)



if len(Tburen)<= 4: 
    available_rooms = []
    for el in planNodes:
        if el not in data and el.getRoomType() != outside: available_rooms.append(el)
    
    if auto == True:
        paths = []
        for el in available_rooms:
            if el.getType() == False:
                n = Neighborhood(beginNodes[2], 3 , planNodes)
                p = find_shortest_path(n, beginNodes[2], el)
                if p and len(p) > 1:
                    paths.append((el, p))
            
        
        
        k = sorted(paths, key = lambda x: len(x[1]))
        for i in range(4-len(Tburen)):
            print k[i][1]
            Tburen.append(k[i][1])
            for f in k[i][1]:
                f.changeType(True)
                

    
    else:
        for i in range(4-len(Tburen)):
            poly = rs.GetCurveObject()
            """while poly not in available_rooms or poly in Tburen:
                message = 'Ruimte al gedefinieerd, kies restruimte'
                poly =  rs.GetObject()
                
            Tburen.append(poly)"""
            
        
    
perm = permutations(Tburen, 4)
for el in perm:
    tri_buren.append([element for element in el])


possibilities = len(tri_buren)

tracking = data 
print tracking
i_tri_buren = tri_buren[index]
for el in i_tri_buren:
    if isinstance(el, list):
        for x in el:
            tracking.append(x)
    else:
        tracking.append(el)
# ---------- end static_2 ----------
panel_128 = Panel(static_2.i_tri_buren)
possibilities = Panel(static_2.possibilities)
pick_4 = GhPythonScript(planN=nodes, tri_buren=static_2.i_tri_buren, tri=pick.n)  # -> flatten(n), l, score; inputs planN: list, tri_buren: list, tri: list
# ---------- pick_4: Python ----------
import Rhino.Geometry as rg
import csv
from itertools import *
import klasDefinities
reload(klasDefinities)

from klasDefinities import *

import rhinoscriptsyntax as rs
l_ = []
n_ = []
b = {1: 'buurtfunctie', 2: 'bezoekersruimte', 0:  'dokterskabinet', 3: 'personeelsruimte'}
score = []

for index in range(len(tri_buren)):
    if isinstance(tri_buren[index], list):
        tri_buren[index][-1].roomType = b[index]
        n_.append(tri_buren[index][-1])
        for i in range(len(tri_buren[index])-1):
            n_.append(tri_buren[index][i])
            l_.append(Edge(tri_buren[index][i], tri_buren[index][i+1], planN))
        l_.append(Edge(tri_buren[index][-1], tri[2], planN))
        score.append(1/len(tri_buren[index]))
    else:
        tri_buren[index].roomType = b[index]
        n_.append(tri_buren[index])
        l_.append(Edge(tri_buren[index], tri[2], planN))
        score.append(1)


print tri_buren
# ---------- end pick_4 ----------

merge_32 = Merge(Data1=pick_2.zit, Data2=flatten(filter_6))  # -> flatten(Result)
static_3 = GhPythonScript(outside=panel_120, zitruimtes=flatten(merge_32), data=static_2.tracking, planNodes=nodes)  # -> simplify(flatten(zit_buren)), scores; inputs zitruimtes: list, data: list, planNodes: list
# ---------- static_3: Python ----------
__author__ = "Ellen De Sloovere"
__version__ = "2022.05.10"

import rhinoscriptsyntax as rs
import math
import scriptcontext
import Rhino.Geometry as rg
import ghpythonlib.components as gh
import System
from itertools import *
import copy
import klasDefinities
reload(klasDefinities)
from klasDefinities import *

def TimeConsumingTask():    
    for i in range(30000):
        # Was escape key pressed?
        if (scriptcontext.escape_test(False)):
            print "TimeConsumingTask cancelled."
            break

TimeConsumingTask()

"""for el in beginNodes: el.changeType(True)
s = set(beginNodes)"""

nodes = []

print data


if zitruimtes[0] != None:
    for el in zitruimtes:
        print el
        n = []
        for i in getNodes(el.getBuren(True), planNodes):
            if i not in data and i.getRoomType() != outside and i.getRoomType() != 'Balcony':
                n.append(i)
            
        nodes.append(n)
    
    nodes_c = [int(4 -len(el)) for el in nodes]
    
    available_rooms = []
    for el in planNodes:
        if el not in data and el.getRoomType() != outside and el.getRoomType() != 'Balcony' and el.getRoomType() != 'Bathroom': available_rooms.append(el)
        
    
    ruimtes = []
    scores = []
    for index in range(len(zitruimtes)):
        if nodes_c[index] <= 0:
    
            scores += [1, 1, 1, 1]
            perm = permutations(nodes[index], 4)
            tussen = []
            for el in perm:
                tussen.append([element for element in el])
            ruimtes.append(tussen[0])
            
        else:
            ruimte = [el for el in nodes[index]]
            for o in range(len(nodes[index])): scores += [1]
            paths = []
            for el in available_rooms:
                if el.getType() == False:
                    n = Neighborhood(zitruimtes[index], 4 , planNodes)
                    p = find_shortest_path(n, zitruimtes[index], el)
                    if len(p) > 1:
                        paths.append(p)
                        
            k = sorted(paths, key = lambda x: len(x))
            for i in range(len(k)-1):
                if 4 - len(nodes[index]) -i - 1 >= 0:
                    scores += [1/len(k[i])]
                    ruimte.append(k[i])
                    for f in k[i]:
                        f.changeType(True)
                  
            if 4 - len(nodes[index]) > len(k):
                opties = []
                for z in getNodes(zitruimtes[index].getBuren(True), planNodes): opties.append(z)
                for s in range(len(nodes[index]) - len(k)):
                    #nog altijd ruimtes te kort soms
                    if not s > len(opties)-1:
                        ruimte.append(opties[s])
                        scores += [1]
                    else: scores += [0]
                    
    
            ruimtes.append(ruimte)
    
    zit_buren = ruimtes
# ---------- end static_3 ----------
panel_129 = Panel(static_3.zit_buren)
pick_5 = GhPythonScript(planN=nodes, zit_ruimtes=flatten(merge_32), zit_buren=static_3.zit_buren)  # -> flatten(n), flatten(l); inputs planN: list, zit_ruimtes: list, zit_buren: list
# ---------- pick_5: Python ----------
import Rhino.Geometry as rg
import csv
from itertools import *
import klasDefinities
reload(klasDefinities)

from klasDefinities import *
import rhinoscriptsyntax as rs

print zit_buren
n_ = []
l_ = []
b = {0: 'sportruimte', 1: 'keuken', 2: 'wasruimte', 3: 'time out - ruimte'}
if zit_ruimtes[0] is not None:
    for ind in range(len(zit_buren)):
        if isinstance(zit_buren[ind], tuple):
            zit_buren[ind][0].roomType = b[0]
            zit_buren[ind][1].roomType = b[1]
            zit_buren[ind][2].roomType = b[2]
            zit_buren[ind][3].roomType = b[3]
            
            l_.append(Edge(zit_ruimtes[ind], zit_buren[ind][0]))
            l_ .append(Edge(zit_ruimtes[ind], zit_buren[ind][1]))
            l_.append(Edge(zit_ruimtes[ind], zit_buren[ind][2]))
            l_.append(Edge(zit_ruimtes[ind], zit_buren[ind][3]))
            
            n_.append(zit_buren[ind][0])
            n_.append(zit_buren[ind][1])
            n_.append(zit_buren[ind][2])
            n_.append(zit_buren[ind][3])
            
        else:
            for ind2 in range(len(zit_buren[ind])):
                if isinstance(zit_buren[ind][ind2], list):
                    zit_buren[ind][ind2][-1].roomType = b[ind2]
                    n_.append(zit_buren[ind][ind2][-1])
                    l_.append(Edge(zit_buren[ind][ind2][0], zit_ruimtes[ind], planN))
                    for index in range(len(zit_buren[ind][ind2])-1):
                        l_.append(Edge(zit_buren[ind][ind2][index], zit_buren[ind][ind2][index +1], planN))
                        n_.append(zit_buren[ind][ind2][index])
                else:
                    zit_buren[ind][ind2].roomType = b[ind2]
                    n_.append(zit_buren[ind][ind2])
                    l_ .append(Edge(zit_buren[ind][ind2], zit_ruimtes[ind], planN))
# ---------- end pick_5 ----------

# ---- group: Fase drie / visuele voorstelling edges/nodes en tekst
text_height = Slider(0.579, range=0..1)
merge_33 = Merge(Data1=pick.l, Data2=pick_2.l, Data3=pick_4.l, Data5=pick_3.l, Data6=con_pick.l)  # -> flatten(Result)
merge_34 = Merge(Data1=pick.n, Data2=pick_2.n, Data3=pick_4.n, Data4=pick_3.n)  # -> flatten(Result)

# ---- group: Fase drie
cluster = Cluster(leefgroep=alternatief_2_5)
cluster_2 = Cluster()  # disabled
cluster_3 = Cluster()  # disabled
cluster_4 = Cluster()  # disabled
cluster_5 = Cluster()  # disabled

# ---- group: Fase drie / triage buren_statisch
visueel_9 = GhPythonScript(knopen=static_2.i_tri_buren)  # -> flatten(visueel); inputs planNodes: list, knopen: list
# ---------- visueel_9: Python ----------
__author__ = "Ellen De Sloovere"
__version__ = "2022.05.10"

import rhinoscriptsyntax as rs
import math
import scriptcontext
import Rhino.Geometry as rg
import ghpythonlib.components as gh
import System
import klasDefinities
reload(klasDefinities)

from klasDefinities import *
from decimal import *

visueel = []

for el in knopen:
    if isinstance(el, list): visueel.append(el[-1].getGeo())
    else: visueel.append(el.getGeo())
# ---------- end visueel_9 ----------
srf_21 = Surface(visueel_9)
preview_17 = CustomPreview(Geometry=srf_21, Material=ColourSwatch(SwatchColor=RGB(255, 0, 153)))

# ---- group: zitruimtes
filter_7 = GhPythonScript(leefgroep=filter_6)  # -> ruimtes; inputs leefgroep: list; same code as filter_3
srf_22 = Surface(filter_7)
preview_18 = CustomPreview(Geometry=srf_22, Material=ColourSwatch(SwatchColor=RGB(0, 68, 255)))

# ---- group: zitruimte buren_statisch
visueel_10 = GhPythonScript(knopen=static_3.zit_buren)  # -> flatten(visueel); inputs planNodes: list; same code as visueel_9
srf_23 = Surface(visueel_10)
preview_19 = CustomPreview(Geometry=srf_23, Material=ColourSwatch(SwatchColor=RGB(0, 212, 255)))

# ---- group: Fase drie / visuele voorstelling edges/nodes en tekst
graph_visual = GhPythonScript(nodes=merge_34, edges=merge_33, H=text_height)  # -> l, n, n_list; inputs nodes: list, edges: list
# ---------- graph_visual: Python ----------
__author__ = "Ellen De Sloovere"
__version__ = "2022.06.22"

import rhinoscriptsyntax as rs
import math
import scriptcontext
import Rhino.Geometry as rg
import ghpythonlib.components as gh
import System
import klasDefinities
reload(klasDefinities)
from klasDefinities import *

scriptcontext.doc = Rhino.RhinoDoc.ActiveDoc
klasDefinities.deleteLayer('Text')
klasDefinities.addRhinoLayer('Text')

scriptcontext.doc = ghdoc
n_ = []
n_list = set()
text = []


for el in nodes:
    if isinstance(el, list) or isinstance(el, tuple): 
        for i in el:
            if isinstance(i, list):
                for k in i: 
                    if isinstance(k, list):
                        for element in k:
                            if element not in n_list: n_list.add(element)
                            n_.append(rs.AddCircle(element.getGeo().CenterPoint(), float(element.opp)/100))
                            scriptcontext.doc = Rhino.RhinoDoc.ActiveDoc
                            text.append(rs.AddText(element.roomType, element.getGeo().CenterPoint(), H))
                            scriptcontext.doc = ghdoc
                    else:
                        if k not in n_list: n_list.add(k)
                        n_.append(rs.AddCircle(k.getGeo().CenterPoint(), float(k.opp)/100))
                        scriptcontext.doc = Rhino.RhinoDoc.ActiveDoc
                        text.append(rs.AddText(k.roomType, k.getGeo().CenterPoint(), H))
                        scriptcontext.doc = ghdoc
            else: 
                if i not in n_list: n_list.add(i)
                n_.append(rs.AddCircle(i.getGeo().CenterPoint(), float(i.opp)/100))
                scriptcontext.doc = Rhino.RhinoDoc.ActiveDoc
                text.append(rs.AddText(i.roomType, i.getGeo().CenterPoint(), H))
                scriptcontext.doc = ghdoc
    else: 
        if el not in n_list: n_list.add(el)
        geo = el.getGeo().ToNurbsCurve()
        test, f = geo.TryGetPolyline()
        n_.append(rs.AddCircle(f.CenterPoint(), float(el.opp)/100))
        scriptcontext.doc = Rhino.RhinoDoc.ActiveDoc
        text.append(rs.AddText(el.roomType, f.CenterPoint(), H))
        scriptcontext.doc = ghdoc
        


                
l_ = []
for el in edges:
    if el.prv() != el.nxt():
        l_.append(rs.AddLine(el.prv().getGeo().CenterPoint(), el.nxt().getGeo().CenterPoint()))
# ---------- end graph_visual ----------
swatch_11 = ColourSwatch(SwatchColor=RGB(74, 46, 255))
geo_47 = Geometry(graph_visual.n)
geo_48 = Geometry(graph_visual.l)
preview_20 = CustomPreview(Geometry=geo_48, Material=swatch_11)
preview_21 = CustomPreview(Geometry=geo_47, Material=swatch_11)

con_visual = GhPythonScript(nodes=pick_5.n, edges=pick_5.l, H=text_height)  # -> l, n, n_list; inputs nodes: list, edges: list
# ---------- con_visual: Python ----------
__author__ = "Ellen De Sloovere"
__version__ = "2022.08.05"

import rhinoscriptsyntax as rs
import math
import scriptcontext
import Rhino.Geometry as rg
import ghpythonlib.components as gh
import System
import klasDefinities
reload(klasDefinities)
from klasDefinities import *

n_ = []
n_list = []
text = []


for el in nodes:
        n_list.append(el)
        geo = el.getGeo().ToNurbsCurve()
        test, f = geo.TryGetPolyline()
        n_.append(rs.AddCircle(f.CenterPoint(), float(el.opp)/100))
        scriptcontext.doc = Rhino.RhinoDoc.ActiveDoc
        rs.AddText(el.roomType, f.CenterPoint(), H)
        scriptcontext.doc = ghdoc
        
l_ = []
for el in edges:
    if el.prv() != el.nxt():
        l_.append(rs.AddLine(el.prv().getGeo().CenterPoint(), el.nxt().getGeo().CenterPoint()))
# ---------- end con_visual ----------
swatch_12 = ColourSwatch(SwatchColor=RGB(255, 0, 0))
geo_49 = Geometry(con_visual.n)
preview_22 = CustomPreview(Geometry=geo_49, Material=swatch_12)
preview_23 = CustomPreview(Geometry=con_visual.l, Material=swatch_12)

# ---- group: omgevingsrelatie score
relatie_buiten_score = GhPythonScript(n=graph_visual.n_list)  # -> score, zonder_buiten; inputs n: list
# ---------- relatie_buiten_score: Python ----------
__author__ = "info"
__version__ = "2022.08.01"

import rhinoscriptsyntax as rs
import math
import scriptcontext
import Rhino.Geometry as rg
import ghpythonlib.components as gh
import System
import klasDefinities
reload(klasDefinities)
from klasDefinities import *
nn = ['controle - handscanner',
'toillet bezoekers','fouilleerruimte','inkom','keukenberging','wasruimte','keukenberging']

    
score = 0
niet = 0
zonder_buiten = []
for el in n_:
    if not el.getRoomType() in nn: 
        if el.heeftRaam(): score +=1
        else: 
            score += 0
            zonder_buiten.append((el.getID(), el.getRoomType()))
    else: niet += 1
    
    

 
score /= (len(n_)-niet)
# ---------- end relatie_buiten_score ----------
panel_130 = Panel(relatie_buiten_score.zonder_buiten)
relatie_met_buitenomgeving = Panel(relatie_buiten_score.score)

# ---- group: edge score
edge_score = GhPythonScript(planN=nodes, l=merge_33, path_triburen=pick_4.score, path_zitburen=static_3.scores, connect_subgraphs=con_pick.score)  # -> score; inputs planN: list, l: list, path_triburen: list, path_zitburen: list, connect_subgraphs: list
# ---------- edge_score: Python ----------
__author__ = "info"
__version__ = "2022.08.01"

import rhinoscriptsyntax as rs
import math
import scriptcontext
import Rhino.Geometry as rg
import ghpythonlib.components as gh
import System
import klasDefinities
reload(klasDefinities)
from klasDefinities import *

div = len(l_) + len(path_triburen) + len(path_zitburen) + len(connect_subgraphs)
rel = sum(el.getType() for el in l_) + sum(path_triburen) + sum(path_zitburen) + sum(connect_subgraphs)

score = rel/div
# ---------- end edge_score ----------
edge_score_2 = Panel(edge_score)

# ----
merge_35 = Merge(Data1=graph_visual.n_list, Data2=con_visual.n_list)  # -> flatten(Result)

# ---- group: Fase drie / scoreberekening
type = Slider(3, range=1..3)
detentietype = Panel("""1: open
2: half-open
3: gesloten""")
divrooms = GhPythonScript(detentieType=type)  # -> deviatie; inputs detentieType: Int32
# ---------- divrooms: Python ----------
__author__ = "Ellen De Sloovere"
__version__ = "2022.09.05"

import Rhino.Geometry as rg
import csv
import klasDefinities
reload(klasDefinities)

from klasDefinities import *


if detentieType == 1:
    deviatie = {'zitruimte' : (26, 5.91), 'eetruimte' : (26, 9.61), 'keuken' : (16, 3.34),  'keukenberging' : (8, 2.98),  'wasruimte' : (15, 4.44), 'sportruimte' : (22, 10.45), 'private unit' : (25, 0), 'private buitenruimte' : (5, 0), 'time out - ruimte' : (25, 0), 'buitenruimte' : (220, 0), 'inkom' : (45, 15.62), 'tocht- /veiligheidssas' :  (7, 0.84), 'toillet bezoekers' : (5, 0.7), 'wachtruimte' : (16, 4.13), 'administratieruimte' : (17, 7.11), 'controle - handscanner' : (7, 3.16), 'fouilleerruimte' : (5, 1.5), 'triagepunt' : (160, 102.31), 'personeelsruimte' : (100, 0), 'dokterskabinet' : (17, 3.23), 'bezoekersruimte' : (60, 0), 'buurtfunctie' : (900, 791.76)}


elif detentieType == 2:
    deviatie = {'zitruimte' : (26, 5.37), 'eetruimte' : (26, 5.87),  'keuken' : (17, 4.37), 'keukenberging' : (8, 0.68), 'wasruimte' : (15, 4.14), 'sportruimte' : (25, 15.08), 'private unit' : (30, 0), 'private buitenruimte' : (7, 0), 'time out - ruimte' : (30, 0), 'buitenruimte' : (600, 0), 'inkom' : (45, 15.62), 'tocht- /veiligheidssas' :  (7, 0.84), 'toillet bezoekers' : (5, 0.7), 'wachtruimte' : (16, 4.13), 'administratieruimte' : (17, 7.11), 'controle - handscanner' : (7, 3.16), 'fouilleerruimte' : (5, 1.5), 'triagepunt' : (160, 102.31), 'personeelsruimte' : (100, 0), 'dokterskabinet' : (17, 3.23), 'bezoekersruimte' : (60, 0), 'buurtfunctie' : (900, 791.76)}

else:  
    deviatie = {'zitruimte' : (30, 6.95),  'eetruimte' : (27, 7.23), 'keuken' : (18, 5.04), 'keukenberging' : (8, 0.87), 'wasruimte' : (15, 3.85), 'sportruimte' : (29, 13.98), 'private unit' : (34, 0), 'private buitenruimte' : (9, 0), 'time out - ruimte' : (34, 0), 'buitenruimte' : (930, 0), 'inkom' : (45, 15.62), 'tocht- /veiligheidssas' :  (7, 0.84), 'toillet bezoekers' : (5, 0.7), 'wachtruimte' : (16, 4.13), 'administratieruimte' : (17, 7.11), 'controle - handscanner' : (7, 3.16), 'fouilleerruimte' : (5, 1.5), 'triagepunt' : (160, 102.31), 'personeelsruimte' : (100, 0), 'dokterskabinet' : (17, 3.23), 'bezoekersruimte' : (60, 0), 'buurtfunctie' : (900, 791.76)}

deviatie = Dic(deviatie)
# ---------- end divrooms ----------
total_deviatie = GhPythonScript(planN=nodes, nodes=merge_35, dev_book=divrooms)  # -> total, tot2, c, multi, distri; inputs planN: list, nodes: list
# ---------- total_deviatie: Python ----------
__author__ = "Ellen De Sloovere"
__version__ = "2022.06.22"

import rhinoscriptsyntax as rs
import math
import scriptcontext
import Rhino.Geometry as rg
import ghpythonlib.components as gh
import System
import klasDefinities
reload(klasDefinities)

from klasDefinities import *

deviatie = dev_book.getDictionary()
afwijking = []
tussenUnits = []
for el in nodes:
    if el.roomType in deviatie: 
        if el.roomType == 'private unit' and el.difFloorRel:
            b = False
            for x in tussenUnits:
                if isinstance(x, set) and el in x:
                    b = True
            if b is False:
                stack_unit = set()
                stack_unit.add(el)
                for el2 in getNodes(el.difFloorRel, planN):
                    if el2 in nodes:stack_unit.add(el2)
                nodeOpp = sum(i.getOpp() for i in stack_unit)
            tussenUnits.append(stack_unit)
                    
        else: nodeOpp = el.getOpp()
            
        stand, afw = deviatie[el.roomType]
        ondergrens = stand*(1-afw)
        bovengrens = stand*(1+afw)
            
        if ondergrens <= nodeOpp <= bovengrens: afwijking.append((el.identifier, el.roomType, 1))
        elif bovengrens <= nodeOpp: 
            if 1-((nodeOpp-bovengrens)/(2*ondergrens)) < 0 or 1-((nodeOpp-bovengrens)/(2*ondergrens)) > 1:
                afwijking.append((el.identifier, el.roomType, 0))
                
            else:
                afwijking.append((el.identifier, el.roomType, (1-((nodeOpp-bovengrens)/(2*ondergrens)))))
        else:
            afwijking.append((el.identifier, el.roomType, nodeOpp/ondergrens))
    else:
        afwijking.append((el.identifier, el.roomType, 0))

tot2 =  tuple((el[0], el[1], '%.3f' % el[2]) for el in afwijking)
total = '%.3f' % (sum(el[2] for el in afwijking)/len(nodes))



c= []
distri = []
multi = []
for el in nodes:
    muur = []
    for i in getNodes(el.muurRel, planN):
        if i in nodes: muur.append(i.getID())
    el.muurRel = muur
    deur = []
    for i in getNodes(el.deurRel, planN):
        if i in nodes: deur.append(i.getID())
    el.deurRel = deur
    distri.append(len(deur) + len(muur))
    multi.append(el)
    c.append('{},{},{},{},{},{}'.format(el.identifier, el.getRoomType(), el.getOpp(), muur, deur, el.buitenRel))
# ---------- end total_deviatie ----------
afwijking_per_ruimte = Panel(total_deviatie.tot2)

nodes_2 = GhPythonScript(ruimtes=nodes, gemapped=merge_35)  # -> score; inputs ruimtes: list, gemapped: list
# ---------- nodes_2: Python ----------
__author__ = "info"
__version__ = "2022.08.11"

import rhinoscriptsyntax as rs

score =  len(gemapped)/ len(ruimtes)
# ---------- end nodes_2 ----------
toegewezen_nodes = Panel(nodes_2)

# ---- group: CSV
csv_values = Panel(total_deviatie.c)
csv_header = Panel("NodeId,NodeType,Area,WallRelation,DoorRelation,AirRelation")
merge_36 = Merge(Data1=csv_header, Data2=csv_values)
csv = Panel(merge_36)

# ---- group: Fase drie
totale_afwijking = Panel(total_deviatie.total)

# ----
node_distribution_mapping = BarGraph(total_deviatie.distri, BarColor=RGB(255, 0, 89))

# ---- group: genereren multi-plane graph
multi_plane_graph = GhPythonScript(planN=nodes, nodes=total_deviatie.multi, height_floors=hoogte_verdiepen, n_ref_point=item_17, o_ref_points=pt_7)  # -> l, groen, lichtgroen, geel, rood, roze, blauw, lichtblauw; inputs planN: list, nodes: list, height_floors: list, n_ref_point: Point3d, o_ref_points: list of Point3d
# ---------- multi_plane_graph: Python ----------
__author__ = "Ellen De Sloovere"
__version__ = "2022.07.22"

import rhinoscriptsyntax as rs
import math
import scriptcontext
import Rhino.Geometry as rg
import ghpythonlib.components as gh
import System
import klasDefinities
reload(klasDefinities)

from klasDefinities import *

scriptcontext.doc = Rhino.RhinoDoc.ActiveDoc
klasDefinities.deleteLayer('Planar_layer')
klasDefinities.addRhinoLayer('Planar_layer')
scriptcontext.doc = ghdoc


l_ = []

groen = []
lichtgroen = []
geel = []
rood = []
roze = []
blauw = []
lichtblauw = []


dgroen = {'private unit'}
dlichtgroen = {'private buitenruimte', 'buitenruimte', 'Garden', 'Balcony'}
dgeel = {'toillet bezoekers', 'wachtruimte', 'administratieruimte', 'controle - handscanner', 'fouilleerruimte', 'triagepunt'}
drood = {'tussenruimte', 'inkom' }
droze ={'personeelsruimte', 'dokterskabinet', 'bezoekersruimte', 'buurtfunctie'}
dblauw = {'zitruimte'}
dlichtblauw = {'keuken', 'wasruimte', 'sportruimte', 'time out - ruimte'}

for el in planN: 
    if el not in nodes and (el.roomType == 'Garden' or el.roomType == 'Balcony'): nodes.append(el)
    

for el in nodes:
    #planar nodes opstellen
    trans = rg.Point3d(n_ref_point[0] - o_ref_points[el.identifier[0]][0], n_ref_point[1] - o_ref_points[el.identifier[0]][1], sum(height_floors[0:el.identifier[0]+1])-height_floors[0])
    p1 = rg.Point3d(el.getGeo().CenterPoint()[0] + trans[0], el.getGeo().CenterPoint()[1] + trans[1], trans[2])
    el.plan_vis = p1, float(el.opp)/100
    
    
    
    #3d edges
        
for el in nodes:
    if el:
        if el.roomType in dgroen:
            groen.append(rs.AddSphere(el.plan_vis[0], el.plan_vis[1]))
        elif el.roomType in dlichtgroen:
            lichtgroen.append(rs.AddSphere(el.plan_vis[0], el.plan_vis[1]))
        elif el.roomType in dgeel:
            geel.append(rs.AddSphere(el.plan_vis[0], el.plan_vis[1]))
        elif el.roomType in drood:
            rood.append(rs.AddSphere(el.plan_vis[0], el.plan_vis[1]))
        elif el.roomType in dblauw:
            blauw.append(rs.AddSphere(el.plan_vis[0], el.plan_vis[1]))
        elif el.roomType in dlichtblauw:
            lichtblauw.append(rs.AddSphere(el.plan_vis[0], el.plan_vis[1]))
        else:
            roze.append(rs.AddSphere(el.plan_vis[0], el.plan_vis[1]))
         
        buren = getNodes(el.getBuren(), nodes)
        for el2 in buren:
            l_.append(rs.AddLine(el.plan_vis[0], el2.plan_vis[0]))
# ---------- end multi_plane_graph ----------
geo_50 = Geometry(multi_plane_graph.groen)
geo_51 = Geometry(multi_plane_graph.lichtgroen)
geo_52 = Geometry(multi_plane_graph.geel)
geo_53 = Geometry(multi_plane_graph.rood)
geo_54 = Geometry(multi_plane_graph.l)
preview_24 = CustomPreview(Geometry=geo_50, Material=ColourSwatch(SwatchColor=RGB(48, 143, 0)))
preview_25 = CustomPreview(Geometry=geo_51, Material=ColourSwatch(SwatchColor=RGB(124, 255, 59)))
preview_26 = CustomPreview(Geometry=geo_52, Material=ColourSwatch(SwatchColor=RGB(255, 225, 0)))
preview_27 = CustomPreview(Geometry=geo_53, Material=ColourSwatch(SwatchColor=RGB(181, 21, 0)))
preview_28 = CustomPreview(Geometry=geo_54, Material=ColourSwatch(SwatchColor=RGB(0, 0, 0)))
geo_55 = Geometry(multi_plane_graph.lichtblauw)
geo_56 = Geometry(multi_plane_graph.roze)
geo_57 = Geometry(planar_graph)
preview_29 = CustomPreview(Geometry=geo_55, Material=ColourSwatch(SwatchColor=RGB(0, 212, 255)))
preview_30 = CustomPreview(Geometry=geo_56, Material=ColourSwatch(SwatchColor=RGB(255, 0, 153)))
# Aangezien de graaf wordt geprojecteerd op het grondplan en geen stappen van de graph overlslaat is de 3 de parameter altijd 1(0 tussenstappen - geen kortste weg nodig). De gebruiker dient dan ook het plan naar behoren aan te passen. Misschien extra buffer inbouwen dat als het niet aanwezig is dat er een node verder gekeken wordt. Maar wel weer meer compute time
# 
# 
# Bij de componenten voor de veralgemenisering kan apart gezocht worden naar graphlets. De gebruiker kan zelfs schakels tussenvoegen.
# 
# 4de parameter van buitenlucht nog toevoegen
# kan met heeftraam
preview_31 = CustomPreview(Geometry=geo_57, Material=ColourSwatch(SwatchColor=RGB(176, 176, 176)))

# ----
merge_37 = Merge(Data1=multi_plane_graph.l, Data2=multi_plane_graph.blauw)

# ---- group: genereren multi-plane graph (continued)
geo_58 = Geometry(merge_37)
preview_32 = CustomPreview(Geometry=geo_58, Material=ColourSwatch(SwatchColor=RGB(0, 68, 255)))

# ==== cluster Cluster
leefgroep = ClusterInput()
filter = GhPythonScript(leefgroep=leefgroep)  # -> ruimtes
# ---------- filter: Python ----------
__author__ = "Ellen De Sloovere"
__version__ = "2022.07.06"

import rhinoscriptsyntax as rs

ruimtes = []
for el in leefgroep:
    tussen = []
    if isinstance(el, list):
        for x in el:
            if isinstance(x, set): 
                for k in x: 
                    if k.roomType != 'zitruimte': tussen.append(k.getGeo())
            else:
                if x.roomType != 'zitruimte':tussen.append(x.getGeo())
            
        ruimtes.append(tussen)
    else:
        if el.roomType != 'zitruimte': ruimtes.append(el.getGeo())
    
print ruimtes
# ---------- end filter ----------
item = CherryPicker(filter, ListIndex=0)
item_2 = CherryPicker(filter, ListIndex=1)

# ---- group: tussenruimte
srf = Surface(item_2)
preview = CustomPreview(Geometry=srf, Material=ColourSwatch(SwatchColor=RGB(255, 97, 97)))

# ---- group: units
visueel = GhPythonScript(knopen=filter)  # -> flatten(visueel); inputs knopen: list
# ---------- visueel: Python ----------
__author__ = "Ellen De Sloovere"
__version__ = "2022.05.10"

import rhinoscriptsyntax as rs
import math
import scriptcontext
import Rhino.Geometry as rg
import ghpythonlib.components as gh
import System
import klasDefinities
reload(klasDefinities)

from klasDefinities import *
from decimal import *


#afwijking = '%.3f' % (sum(el for el in afw)/len(knopen)),  tuple('%.3f' % el for el in afw)
idKnopen = knopen
print knopen

visueel = [el for el in knopen[2]]
# ---------- end visueel ----------
srf_2 = Surface(visueel)
preview_2 = CustomPreview(Geometry=srf_2, Material=ColourSwatch(SwatchColor=RGB(209, 0, 0)))

# ---- group: buitenruimte
srf_3 = Surface(item)
preview_3 = CustomPreview(Geometry=srf_3, Material=ColourSwatch(SwatchColor=RGB(63, 255, 20)))
