# Grasshopper definition Hanne Vandenhaute en Dorine Wullaert - Algemeen.gh (Grasshopper 1.0.7)
# plug-ins: Pufferfish, PlanGraph

geo = Geometry(<curve referenced from the Rhino model>)  # disabled
number_slider = Slider(0, range=0..19)  # disabled
number_slider_2 = Slider(0, range=0..19)  # disabled
number_slider_3 = Slider(0, range=0..19)  # disabled
number_slider_4 = Slider(0, range=0..19)  # disabled
number_slider_5 = Slider(0, range=0..19)  # disabled
number_slider_6 = Slider(0, range=0..19)  # disabled
number_slider_7 = Slider(0, range=0..19)  # disabled
number_slider_8 = Slider(0, range=0..19)  # disabled
number_slider_9 = Slider(0, range=0..19)  # disabled
number_slider_10 = Slider(0, range=0..19)  # disabled
number_slider_11 = Slider(0, range=0..19)  # disabled
number_slider_12 = Slider(3, range=0..19)  # disabled
number_slider_13 = Slider(3, range=0..19)  # disabled
number_slider_14 = Slider(0, range=0..19)  # disabled
number_slider_15 = Slider(0, range=0..19)  # disabled
number_slider_16 = Slider(0, range=0..19)  # disabled
number_slider_17 = Slider(0, range=0..19)  # disabled
number_slider_18 = Slider(3, range=0..19)  # disabled
number_slider_19 = Slider(3, range=0..19)  # disabled
number_slider_20 = Slider(3, range=0..19)  # disabled
number_slider_21 = Slider(0, range=0..19)  # disabled
number_slider_22 = Slider(3, range=0..19)  # disabled
number_slider_23 = Slider(0, range=0..19)  # disabled
number_slider_24 = Slider(3, range=0..19)  # disabled
number_slider_25 = Slider(0, range=0..19)  # disabled
number_slider_26 = Slider(3, range=0..19)  # disabled
number_slider_27 = Slider(0, range=0..19)  # disabled
number_slider_28 = Slider(3, range=0..19)  # disabled
number_slider_29 = Slider(3, range=0..19)  # disabled
number_slider_30 = Slider(3, range=0..19)  # disabled
geo_2 = Geometry(<curve referenced from the Rhino model>)  # disabled
geo_3 = Geometry(<curve referenced from the Rhino model>)  # disabled
geo_4 = Geometry(<curve referenced from the Rhino model>)  # disabled
geo_5 = Geometry(<curve referenced from the Rhino model>)  # disabled
geo_6 = Geometry(<curve referenced from the Rhino model>)  # disabled
geo_7 = Geometry(<curve referenced from the Rhino model>)  # disabled
geo_8 = Geometry(<curve referenced from the Rhino model>)  # disabled
geo_9 = Geometry(<curve referenced from the Rhino model>)  # disabled
geo_10 = Geometry(<curve referenced from the Rhino model>)  # disabled
geo_11 = Geometry(<curve referenced from the Rhino model>)  # disabled
geo_12 = Geometry(<curve referenced from the Rhino model>)  # disabled
geo_13 = Geometry(<curve referenced from the Rhino model>)  # disabled
geo_14 = Geometry(<curve referenced from the Rhino model>)  # disabled
geo_15 = Geometry(<curve referenced from the Rhino model>)  # disabled
geo_16 = Geometry(<curve referenced from the Rhino model>)  # disabled
geo_17 = Geometry(<curve referenced from the Rhino model>)  # disabled
geo_18 = Geometry(<curve referenced from the Rhino model>)  # disabled
geo_19 = Geometry(<curve referenced from the Rhino model>)  # disabled
geo_20 = Geometry(<curve referenced from the Rhino model>)  # disabled
geo_21 = Geometry(<curve referenced from the Rhino model>)  # disabled
geo_22 = Geometry(<curve referenced from the Rhino model>)  # disabled
geo_23 = Geometry(<curve referenced from the Rhino model>)  # disabled
geo_24 = Geometry(<curve referenced from the Rhino model>)  # disabled
geo_25 = Geometry(<curve referenced from the Rhino model>)  # disabled
geo_26 = Geometry(<curve referenced from the Rhino model>)  # disabled
geo_27 = Geometry(<curve referenced from the Rhino model>)  # disabled
geo_28 = Geometry(<curve referenced from the Rhino model>)  # disabled
geo_29 = Geometry(<curve referenced from the Rhino model>)  # disabled
geo_30 = Geometry(<curve referenced from the Rhino model>)  # disabled
node = ConstructNode2(Name="a room", Type=number_slider, Boundary=geo_2)  # disabled
node_2 = ConstructNode2(Name="a room", Type=number_slider_7, Boundary=geo_8)  # disabled
node_3 = ConstructNode2(Name="a room", Type=number_slider_3, Boundary=geo_4)  # disabled
node_4 = ConstructNode2(Name="a room", Type=number_slider_5, Boundary=geo_6)  # disabled
node_5 = ConstructNode2(Name="a room", Type=number_slider_6, Boundary=geo_7)  # disabled
node_6 = ConstructNode2(Name="a room", Type=number_slider_2, Boundary=geo_3)  # disabled
node_7 = ConstructNode2(Name="a room", Type=number_slider_4, Boundary=geo_5)  # disabled
extnode = ExternalNode()  # disabled
node_8 = ConstructNode2(Name="a room", Type=number_slider_13, Boundary=geo_12)  # disabled
node_9 = ConstructNode2(Name="a room", Type=number_slider_12, Boundary=geo_10)  # disabled
node_10 = ConstructNode2(Name="a room", Type=number_slider_10, Boundary=geo_13)  # disabled
node_11 = ConstructNode2(Name="a room", Type=number_slider_11, Boundary=geo_11)  # disabled
node_12 = ConstructNode2(Name="a room", Type=number_slider_9, Boundary=geo_9)  # disabled
node_13 = ConstructNode2(Name="a room", Type=number_slider_14, Boundary=geo_14)  # disabled
node_14 = ConstructNode2(Name="a room", Type=number_slider_18, Boundary=geo_16)  # disabled
node_15 = ConstructNode2(Name="a room", Type=number_slider_19, Boundary=geo_20)  # disabled
node_16 = ConstructNode2(Name="a room", Type=number_slider_20, Boundary=geo_21)  # disabled
node_17 = ConstructNode2(Name="a room", Type=number_slider_22, Boundary=geo_19)  # disabled
node_18 = ConstructNode2(Name="a room", Type=number_slider_24, Boundary=geo_24)  # disabled
node_19 = ConstructNode2(Name="a room", Type=number_slider_17, Boundary=geo)  # disabled
node_20 = ConstructNode2(Name="a room", Type=number_slider_23, Boundary=geo_23)  # disabled
node_21 = ConstructNode2(Name="a room", Type=number_slider_15, Boundary=geo_15)  # disabled
node_22 = ConstructNode2(Name="a room", Type=number_slider_16, Boundary=geo_17)  # disabled
node_23 = ConstructNode2(Name="a room", Type=number_slider_8, Boundary=geo_22)  # disabled
node_24 = ConstructNode2(Name="a room", Type=number_slider_26, Boundary=geo_26)  # disabled
node_25 = ConstructNode2(Name="a room", Type=number_slider_21, Boundary=geo_18)  # disabled
node_26 = ConstructNode2(Name="a room", Type=number_slider_25, Boundary=geo_25)  # disabled
node_27 = ConstructNode2(Name="a room", Type=number_slider_27, Boundary=geo_27)  # disabled
node_28 = ConstructNode2(Name="a room", Type=number_slider_28, Boundary=geo_28)  # disabled
node_29 = ConstructNode2(Name="a room", Type=number_slider_29, Boundary=geo_29)  # disabled
node_30 = ConstructNode2(Name="a room", Type=number_slider_30, Boundary=geo_30)  # disabled
number_slider_31 = Slider(2, range=1..3)  # disabled
edge = ConstructEdge(Node1=node_21, Node2=node_19, Type=number_slider_31)  # disabled
edge_2 = ConstructEdge(Node1=node_27, Node2=node_14, Type=number_slider_31)  # disabled
edge_3 = ConstructEdge(Node1=node_27, Node2=extnode, Type=number_slider_31)  # disabled
edge_4 = ConstructEdge(Node1=node_21, Node2=node_14, Type=number_slider_31)  # disabled
edge_5 = ConstructEdge(Node1=node_27, Node2=node_19, Type=number_slider_31)  # disabled
edge_6 = ConstructEdge(Node1=node_21, Node2=node_9, Type=number_slider_31)  # disabled
merge = Merge()  # disabled
merge_2 = Merge(
    Data1=node_27,
    Data2=node_21,
    Data3=node_22,
    Data4=node_19,
    Data5=node_26,
    Data6=node_25,
    Data7=node_6,
    Data8=node_7,
    Data9=node_4,
    Data10=node_12,
    Data11=node_5,
    Data12=node_3,
    Data13=node,
    Data14=node_10,
    Data15=node_23,
    Data16=node_13,
    Data17=node_11,
    Data18=node_2,
    Data19=node_17,
    Data20=node_15,
    Data21=node_20,
    Data22=extnode,
    Data23=node_9,
    Data24=node_14)  # disabled
geo_31 = Geometry([<curve referenced from the Rhino model> x36])  # disabled
graph = ConstructGraph(
    Nodes=merge_2,
    Edges=merge,
    NodeTypes=["Living room", "Master room", "Kitchen", "Bathroom", "Dining room", "Child room", "Study room", "Second room", "Guest room", "Balcony/Garden", "Entrance", "Storage", "Wall-in", "External area", "Exterior wall", "Front door", "Interior wall", "Interior door", "Corridor", "other"],
    EdgeTypes=["Wall", "Door", "Air"],
    EdgetypeToShow=0)  # -> PlanGraph, GraphVisualisation; disabled
gfeats = GraphFeatures(PlanGraph=graph.PlanGraph)  # -> NF, NF_t, Adj, Adj_t, ni; disabled
panel = Panel(gfeats.ni)  # disabled

item = CherryPicker(ListIndex=3, TreePath_path="{0}")  # disabled
list_convert = GhPythonScript(list=item)  # -> flatten(params); disabled
# ---------- list_convert: Python ----------
import rhinoscriptsyntax as rs

params = [el for el in list_]
# ---------- end list_convert ----------

geo_32 = Geometry(<curve referenced from the Rhino model>)  # disabled
geo_33 = Geometry(<curve referenced from the Rhino model>)  # disabled
number_slider_32 = Slider(9, range=1..19)  # disabled
# opp leefgroep?
# mssn als opp is opgesplitst en niet haalbaar voor 1 geheel --> meerdere triagepunten, max 3?
# 
# bij 3 mssn al indicatie geven van zoek een andere trekker
number_slider_33 = Slider(7, range=1..19)  # disabled
area = Area(Geometry=geo_32)  # -> Area, Centroid; disabled
area_2 = Area(Geometry=geo_33)  # -> Area, Centroid; disabled
extnode_2 = ExternalNode()  # disabled
number_slider_34 = Slider(1, range=0..3)  # disabled
node_31 = ConstructNode(Name="A room", Type=number_slider_32, Area=area_2.Area, Center=area_2.Centroid)  # disabled
node_32 = ConstructNode(Name="A room", Type=number_slider_33, Area=area.Area, Center=area.Centroid)  # disabled
edge_7 = ConstructEdge(Node1=node_32, Node2=node_31, Type=number_slider_34)  # disabled
edge_8 = ConstructEdge(Node1=extnode_2, Node2=node_31, Type=number_slider_34)  # disabled
merge_3 = Merge(Data1=node_32, Data2=node_31, Data3=extnode_2)  # disabled
merge_4 = Merge(Data1=edge_7, Data2=edge_8)  # disabled
graph_2 = ConstructGraph(
    Nodes=merge_3,
    Edges=merge_4,
    NodeTypes=["Living room", "Master room", "Kitchen", "Bathroom", "Dining room", "Child room", "Study room", "Second room", "Guest room", "Balcony/Garden", "Entrance", "Storage", "Wall-in", "External area", "Exterior wall", "Front door", "Interior wall", "Interior door", "Corridor", "other"],
    EdgeTypes=["Wall", "Door", "Air"],
    EdgetypeToShow=0)  # -> PlanGraph, GraphVisualisation; disabled
gfeats_2 = GraphFeatures(PlanGraph=graph_2.PlanGraph)  # -> NF, NF_t, Adj, Adj_t, ni; disabled
panel_2 = Panel(gfeats_2.ni)  # disabled

item_2 = CherryPicker(ListIndex=0, TreePath_path="{0}")  # disabled
item_3 = CherryPicker(ListIndex=1, TreePath_path="{0}")  # disabled
merge_5 = Merge(Data1=item_2, Data2=item_3)  # disabled

# ---- group: inkom & zitruimte
swatch = ColourSwatch(SwatchColor=RGB(255, 228, 20))  # disabled
srf = Surface(merge_5)  # disabled
preview = CustomPreview(Geometry=srf, Material=swatch)  # disabled

# ----
panel_3 = Panel("""Zitruimte
Eetruimte
Keuken
Keukenberging
wasruimte
sportruimte
private unit
private buitenruimte
time out - ruimte
buitenruimte
inkom
tocht- /veiligheidssas
toillet bezoekers
wachtruimte
administratieruimte
controle - handscanner
fouilleerruimte
triagepunt
personeelsruimte
dokterskabinet
bezoekersruimte
buurtfunctie""")  # disabled
panel_4 = Panel("verander inkom/ tocht nog")  # disabled
item_4 = CherryPicker(ListIndex=2, TreePath_path="{0}")  # disabled

supernodes = GhPythonScript()  # -> superNodeEindOpp, superNodeBeginOpp, superNodeEind, superNodeBegin, leefNodeOpp; inputs Nodes: list; disabled
# ---------- supernodes: Python ----------
__author__ = "Ellen De Sloovere"
__version__ = "2022.04.15"

import klasDefinities
reload(klasDefinities)

from klasDefinities import *

#superNode bevat alle nodes gekoppeld aan triagepunte + triagepunte zelf
superNodeEindOpp = 0.
superNodeEind = []

#superNode bevat alle nodes gekoppeld aan wachtruimte (incl cyclische) + wachtruimte zelf
superNodeBeginOpp = 0.
superNodeBegin = []

#leefgroep wordt als een Node gezien voor de topdown approach (gelezen in dynamic programming dif met divide en conquer)
leefNodeOpp = 0.
leefNode = []

#bevat cyclische verbinding aan wachtruimte + wachtruimte zelf
cyclischeNodeOpp = 0.
cyclischeNode =[]

# onbeduidend --> samennemen
toilletNodeOpp =0.
toilletNode =[]

inkomNodeOpp =0.
inkomNode =[]


for el in Nodes:
    if el.getRoomType() in ('inkom leefgroep', 'zit- en eetruimte', 'keuken', 'keukenberging', 'wasruimte', 'time out - ruimte', 'private unit', 'private buitenruimte'):
        leefNodeOpp += el.getOpp()
        leefNode.append(el)
    
    elif el.getRoomType() in ('controle - handscanner', 'fouille', 'administratieruimte', 'wachtruimte'):
        cyclischeNodeOpp += el.getOpp()
        cyclischeNode.append(el)
        
    elif el.getRoomType() in ('tocht-/veiligheidssas', 'inkom'):
        inkomNodeOpp += el.getOpp()
        inkomNode.append(el)
        
    elif el.getRoomType() in ('sas toilet', 'toilet bezoekers'):
        toilletNodeOpp += el.getOpp()
        toilletNode.append(el)

    else:
        superNodeEindOpp += el.getOpp()
        superNodeEind.append(el)

superNodeEindOpp += leefNodeOpp
superNodeEind.append(leefNode)

superNodeBeginOpp += (cyclischeNodeOpp + toilletNodeOpp + inkomNodeOpp)
superNodeBegin.append(cyclischeNode)
superNodeBegin.append(toilletNode)
superNodeBegin.append(inkomNode)
# ---------- end supernodes ----------
delta_opp = Slider(13, range=0..50)  # disabled
pt = Point(Point(-10126.93956, 4684.096111, 0))  # disabled

swatch_2 = ColourSwatch(SwatchColor=RGBA(255, 153, 153, 89))  # disabled
floor = Slider(0, range=0..3)  # disabled
filter = GhPythonScript(floor=floor)  # -> x_Floor_Nodes, visueel; inputs floor: Int32, nodes: list; disabled
# ---------- filter: Python ----------
__author__ = "Ellen De Sloovere"
__version__ = "2022.05.16"

import Rhino.Geometry as rg
import csv
import Rhino
import klasDefinities
import rhinoscriptsyntax as rs
reload(klasDefinities)

from klasDefinities import *

x_Floor_Nodes = []
for el in nodes:
    if el.getFloor() == floor:
        x_Floor_Nodes.append(el)
        
visueel = []
for el in x_Floor_Nodes:
    visueel.append(el.getGeo())
# ---------- end filter ----------
panel_5 = Panel(filter.visueel)  # disabled
srf_2 = Surface(filter.visueel)  # disabled
preview_2 = CustomPreview(Geometry=srf_2, Material=swatch_2)  # disabled

delta_opp_2 = Slider(14, range=0..50)  # disabled
list_convert_2 = GhPythonScript(list=item_4)  # -> flatten(params); disabled
# ---------- list_convert_2: Python ----------
import rhinoscriptsyntax as rs
print list_

params = []
#moet nog geautomatiseerd worden, nu maar 1 deel van een unit in graph
for el in list_:
    if isinstance(el, list): params.append(el[0])
        
    else:
        params.append(el)
print list_
# ---------- end list_convert_2 ----------
number_slider_35 = Slider(15, range=0..21)  # disabled

item_5 = CherryPicker(ListIndex=2, TreePath_path="{0}")  # disabled

endnodes = GhPythonScript(trekker=pt, eindOpp=supernodes.superNodeEindOpp, deltaOpp=delta_opp_2)  # -> afwijking, knopen, visueel; inputs trekker: Point3d, beginKnopen: list, planNodes: list; disabled
# ---------- endnodes: Python ----------
__author__ = "Ellen De Sloovere"
__version__ = "2022.04.17"

import klasDefinities
reload(klasDefinities)
from klasDefinities import *
import scriptcontext

def TimeConsumingTask():    
    for i in range(30000):
        # Was escape key pressed?
        if (scriptcontext.escape_test(False)):
            print "TimeConsumingTask cancelled."
            break

TimeConsumingTask()

visueel =[]

while len(planNodes) > len(visueel)  + len(beginKnopen):
    tussenopl = []
    
    for n in planNodes:
        if n.getFreeNodeDegree(planNodes) + 1 >= triage and n.getType() is False and overlap(n.getID(), beginKnopen, planNodes, True) is True:

            comp = [n]
            totOpp = n.getOpp()
            for ni in getNodes(n.getBuren(True),planNodes):
                if ni.getType() is False and totOpp + ni.getOpp() <= eindOpp + deltaOpp:
                    totOpp += ni.getOpp()
                    comp.append(ni)
            
            tussenopl.append(comp)

    
    if tussenopl:
        if not afwijking:
            afwijking = None
            knopen = None
            
            
            for el in tussenopl:
                
                if afwijking is None:
                    afwijking = abs(eindOpp - sum(i.getOpp() for i in el))
                    knopen = list(i.getID() for i in el)
                    
                elif abs(eindOpp - sum(i.getOpp() for i in el)) <= afwijking:
                    afwijking = abs(eindOpp - sum(i.getOpp() for i in el))
                    knopen = list(i.getID() for i in el)

            for k in getNodes(knopen,planNodes):
                visueel.append(k.getGeo())
                k.changeType()

        else:
            afwijk2 = None
            knopen2 = None
            
            for el in tussenopl:
                tussen = []
                for i in el:
                    if afwijking - sum(n.getOpp() for n in tussen) - i.getOpp() <= deltaOpp:
                        tussen.append(i)
                        
                if afwijk2 is None:
                    afwijk2 = afwijking - sum(n.getOpp() for n in tussen)
                    knopen2 = tussen
                    
                elif afwijking - sum(n.getOpp() for n in tussen) <= afwijk2 :
                    afwijk2 = afwijking - sum(n.getOpp() for n in tussen)
                    knopen2 = tussen
                    
            
            for k in knopen2:
                visueel.append(k.getGeo())
                knopen.append(k.getID())
                k.changeType()
                afwijking -= k.getOpp()
    else:
        id =[]
        deg = []
        for n in planNodes:
            if n.getType() is False:
                id.append(n)
                deg.append(n.getPosNodeDegree())
                
        if len(id) > 0:
            knoop = id[deg.index(max(deg))]
            visueel.append(knoop.getGeo())
            knoop.changeType()
            afwijking -= knoop.getOpp()
            knopen.append(knoop.getID())
        else:
            break
        
    geomKnopen = getNodes(knopen, planNodes)
    while len(geomKnopen) > 0:
        tussen =[]
        for el in geomKnopen:
            for i in getNodes(el.getBuren(True),planNodes):
                if not i.getType() :
                    i.changeType()
                    tussen.append(i)
                    afwijking -= i.getOpp()
                    visueel.append(i.getGeo())
                    knopen.append(i.getID())
        geomKnopen = tussen

    print 'runned'
    
    
    
    
    
    
    
    
    
    
    
    
    
    
    
    
    """if overlap(i.getID(), beginKnopen, planNodes, True) and i.getType() is False:
            i.changeType()
            knopen.append(i.getID())
            geomKnopen.append(i)
            afwijking -= i.getOpp() 
    
    for el in planNodes:
    
        if el.getID() not in knopen:
            if el.getType() == True:
                el.changeType()
            
        elif el.getID() in knopen:
            visueel.append(el.getGeo())"""
# ---------- end endnodes ----------
knopen = Panel(endnodes.knopen)  # disabled
afwijking = Panel(endnodes.afwijking)  # disabled
geom = Panel(endnodes.visueel)  # disabled

# ----
# om verder te verdelen
# Voor mezelf:
# 
# programma zelf
# kostenwaarden
# extra deuren of verwijderde deuren
number_slider_36 = Slider(1, range=0..20)  # disabled
vec2pt = Vector2Pt(PointA=Point(-10077.64948, 4671.345342, 0), PointB=Point(-10077.64948, 4674.705743, 0), Unitize=False)  # -> Vector, Length; disabled
vec2pt_2 = Vector2Pt(PointA=Point(-10077.64948, 4671.345342, 0), PointB=Point(-10075.56975, 4671.345342, 0), Unitize=False)  # -> Vector, Length; disabled
geo_34 = Geometry()  # disabled
geo_35 = Geometry(endnodes.visueel)  # disabled
angle = Angle(VectorA=vec2pt.Vector, VectorB=vec2pt_2.Vector)  # -> Angle, Reflex; disabled
geo_36 = Geometry(<curve referenced from the Rhino model>)  # disabled
number_slider_37 = Slider(2, range=0..20)  # disabled
number_slider_38 = Slider(50, range=0..50)  # disabled
srf_3 = Surface(geo_34)  # disabled
number_slider_39 = Slider(2, range=0..20)  # disabled
number_slider_40 = Slider(7, range=0..20)  # disabled
srf_4 = Surface(geo_35)  # disabled
area_3 = Area(Geometry=geo_34)  # -> Area, Centroid; disabled
area_4 = Area(Geometry=geo_35)  # -> Area, Centroid; disabled
item_6 = CherryPicker(srf_3, ListIndex=2, TreePath_path="{0;0;0;0}")  # disabled
item_7 = CherryPicker(srf_4, ListIndex=2, TreePath_path="{0;0;0;0;0}")  # disabled
substrate = Substrate(Border=geo_36, Count=number_slider_36, Angles=angle.Reflex, Deviation=0, Seed=5)  # disabled
sdivide = DivideSurface(Surface=item_6, UCount=number_slider_37, VCount=number_slider_38)  # -> Points, Normals, Parameters; disabled
sdivide_2 = DivideSurface(Surface=item_7, UCount=number_slider_39, VCount=number_slider_40)  # -> Points, Normals, Parameters; disabled
int = Integer(2)  # disabled
pline = PolyLine(Vertices=sdivide.Points, Closed=False)  # disabled
div = DivideDomain(Domain=pline, Count=number_slider_37)  # -> simplify(flatten(Segments)); disabled
pline_2 = PolyLine(Vertices=sdivide_2.Points, Closed=False)  # disabled
panel_6 = Panel(div)  # disabled
paramcrvdivsrf = ParameterCurveDivideSurface(Surface=item_6, ParametersU=div, ParametersV=div)  # -> CurvesU, CurvesV; disabled
geo_37 = Geometry(pline_2)  # disabled
geo_38 = Geometry(pline)  # disabled
geo_39 = Geometry(paramcrvdivsrf.CurvesU)  # disabled
geo_40 = Geometry(paramcrvdivsrf.CurvesV)  # disabled

srf_5 = Surface()  # disabled
srf_6 = Surface(endnodes.visueel)  # disabled
geo_41 = Geometry()  # disabled
geo_42 = Geometry(srf_5)  # disabled
geo_43 = Geometry(srf_6)  # disabled
explode = Explode(Curve=geo_41, Recursive=True)  # -> Segments, Vertices; disabled
area_5 = Area(Geometry=geo_43)  # -> Area, Centroid; disabled
area_6 = Area(Geometry=geo_42)  # -> Area, Centroid; disabled
pline_3 = PolyLine(Vertices=explode.Vertices, Closed=False)  # disabled
geo_44 = Geometry(area_6.Centroid)  # disabled
geo_45 = Geometry(area_5.Centroid)  # disabled
pt_2 = Point(explode.Vertices)  # disabled

# ---- group: test
visueel = GhPythonScript()  # -> flatten(visueel), idKnopen, afwijking; inputs planNodes: list, knopen: list; disabled
# ---------- visueel: Python ----------
__author__ = "Ellen De Sloovere"
__version__ = "2022.05.10"

import rhinoscriptsyntax as rs
import math
import scriptcontext
import Rhino.Geometry as rg
import ghpythonlib.components as gh
import System
import klasDefinities
reload(klasDefinities)

from klasDefinities import *
from decimal import *


#afwijking = '%.3f' % (sum(el for el in afw)/len(knopen)),  tuple('%.3f' % el for el in afw)
idKnopen = knopen
print knopen


visueel = [el.getGeo() for el in knopen[0]]
# ---------- end visueel ----------
swatch_3 = ColourSwatch(SwatchColor=RGB(255, 228, 20))  # disabled
srf_7 = Surface(visueel.visueel)  # disabled
preview_3 = CustomPreview(Geometry=srf_7, Material=swatch_3)  # disabled

# ----
srf_8 = Surface()  # disabled
swatch_4 = ColourSwatch(SwatchColor=RGB(84, 235, 84))  # disabled
preview_4 = CustomPreview(Geometry=srf_8, Material=swatch_4)  # disabled

# ---- group: triage
swatch_5 = ColourSwatch(SwatchColor=RGB(44, 108, 176))  # disabled
srf_9 = Surface(item_5)  # disabled
preview_5 = CustomPreview(Geometry=srf_9, Material=swatch_5)  # disabled

# ----
# inputparameters
aantal_gedetineerden_per_leefgroep = Slider(2, range=0..100)
# inputparameters
aantal_leefgroepen = Slider(2, range=0..100)

# ----
# programmaonderdelen detentiehuis
panel_7 = Panel("0")
panel_8 = Panel("1")
panel_9 = Panel("2")
panel_10 = Panel("3")
# programmaonderdelen detentiehuis
panel_11 = Panel("4")
panel_12 = Panel("5")
panel_13 = Panel("6")
panel_14 = Panel("7")
panel_15 = Panel("8")
panel_16 = Panel("9")
panel_17 = Panel("10")
panel_18 = Panel("11")
panel_19 = Panel("12")
panel_20 = Panel("13")

# ----
# oppervlakte
panel_21 = Panel("10")
# opstellen graaf
# relaties ruimtes
panel_22 = Panel("1,13")

# ----
# per leefgroep
panel_23 = Panel("inkom leefgroep")

extra_oppervlakte_keukenberging = Slider(0.53, range=0..100)
basisoppervlakte_keukenberging = Slider(2.67, range=0..100)
multiplication = Multiplication(A=aantal_gedetineerden_per_leefgroep, B=extra_oppervlakte_keukenberging)
addition = Addition(A=multiplication, B=basisoppervlakte_keukenberging)

extra_oppervlakte_wasruimte = Slider(1, range=0..100)
basisoppervlakte_wasruimte = Slider(5, range=0..100)
multiplication_2 = Multiplication(A=aantal_gedetineerden_per_leefgroep, B=extra_oppervlakte_wasruimte)
addition_2 = Addition(A=multiplication_2, B=basisoppervlakte_wasruimte)

# ----
# vast programma
panel_24 = Panel("inkom")
inkom = Slider(45, range=0..100)

buurtfunctie = Slider(900, range=0..1000)

extra_oppervlakte_keuken = Slider(1.07, range=0..100)
basisoppervlakte_keuken = Slider(5.33, range=0..100)
multiplication_3 = Multiplication(A=aantal_gedetineerden_per_leefgroep, B=extra_oppervlakte_keuken)
addition_3 = Addition(A=multiplication_3, B=basisoppervlakte_keuken)

extra_oppervlakte_sportruimte = Slider(1.47, range=0..100)
basisoppervlakte_sportruimte = Slider(7.33, range=0..100)
multiplication_4 = Multiplication(A=aantal_gedetineerden_per_leefgroep, B=extra_oppervlakte_sportruimte)
addition_4 = Addition(A=multiplication_4, B=basisoppervlakte_sportruimte)

extra_oppervlakte_buitenruimte = Slider(0, range=0..100)
basisoppervlakte_buitenruimte = Slider(0, range=0..100)
multiplication_5 = Multiplication(A=aantal_gedetineerden_per_leefgroep, B=extra_oppervlakte_buitenruimte)
addition_5 = Addition(A=multiplication_5, B=basisoppervlakte_buitenruimte)

tocht_veiligheidssas = Slider(7, range=0..100)

sas_toilet = Slider(3, range=0..100)

# ----
# vast programma
panel_25 = Panel("toilet bezoekers")
extra_oppervlakte_toilet_bezoekers = Slider(0.33, range=0..100)
# oppervlakte
basisoppervlakte_toilet_bezoekers = Slider(1.67, range=0..100)
multiplication_6 = Multiplication(A=aantal_gedetineerden_per_leefgroep, B=aantal_leefgroepen)
multiplication_7 = Multiplication(A=multiplication_6, B=extra_oppervlakte_toilet_bezoekers)
# opstellen graaf
addition_6 = Addition(A=multiplication_7, B=basisoppervlakte_toilet_bezoekers)

extra_oppervlakte_wachtruimte = Slider(1.07, range=0..100)
basisoppervlakte_wachtruimte = Slider(5.33, range=0..100)
multiplication_8 = Multiplication(A=aantal_gedetineerden_per_leefgroep, B=aantal_leefgroepen)
multiplication_9 = Multiplication(A=multiplication_8, B=extra_oppervlakte_wachtruimte)
# relaties ruimtes
addition_7 = Addition(A=multiplication_9, B=basisoppervlakte_wachtruimte)

controle_handscanner = Slider(7, range=0..100)

fouilleerruimte = Slider(5, range=0..100)

extra_oppervlakte_administratieruimte = Slider(1.13, range=0..100)
basisoppervlakte_administratieruimte = Slider(5.67, range=0..100)
multiplication_10 = Multiplication(A=aantal_gedetineerden_per_leefgroep, B=aantal_leefgroepen)
multiplication_11 = Multiplication(A=multiplication_10, B=extra_oppervlakte_administratieruimte)
addition_8 = Addition(A=multiplication_11, B=basisoppervlakte_administratieruimte)

dokterskabinet = Slider(17, range=0..100)

# ----
# per leefgroep
panel_26 = Panel("bezoekersruimte")
bezoekersruimte = Slider(60, range=0..100)

time_out_ruimte = Slider(25, range=0..100)

private_buitenruimte = Slider(0, range=0..100)
series = Series(Start="21", Step="1", Count=aantal_gedetineerden_per_leefgroep)

extra_oppervlakte_personeelsruimte = Slider(6.67, range=0..100)
basisoppervlakte_personeelsruimte = Slider(33.33, range=0..100)
multiplication_12 = Multiplication(A=aantal_gedetineerden_per_leefgroep, B=aantal_leefgroepen)
multiplication_13 = Multiplication(A=multiplication_12, B=extra_oppervlakte_personeelsruimte)
addition_9 = Addition(A=multiplication_13, B=basisoppervlakte_personeelsruimte)

number_slider_41 = Slider(0.2, range=0..10)

panel_27 = Panel("""Room
Bathroom
Garden
Corridor
Shared space
Private
Balcony""")
crv = Curve([<curve referenced from the Rhino model> x78])
id = Guid(crv)
rhinotopls = RhinoToPls(RhinoCurvesAsGuid=id, NodeTypes=panel_27)  # -> Roomtypes, Rooms, InteriorDoors, ExteriorDoors, ExteriorWall
pls_to_graph = PolylinesToGraph(
    Roomtypes=rhinotopls.Roomtypes,
    NodeTypes=panel_27,
    Rooms=rhinotopls.Rooms,
    InteriorDoors=rhinotopls.InteriorDoors,
    ExteriorDoors=rhinotopls.ExteriorDoors,
    ExteriorWall=rhinotopls.ExteriorWall,
    ShowWholeGraph=Toggle(False),
    IncludeExterior=Toggle(False),
    Tolerance=number_slider_41)  # -> PlanGraph, GraphVisualisation
gfeats_3 = GraphFeatures(PlanGraph=pls_to_graph.PlanGraph)  # -> NF, NF_t, Adj, Adj_t, ni
panel_28 = Panel(gfeats_3.ni)
wrtype = WriteRoomTypes(Graph=pls_to_graph.PlanGraph, NodeTypes=panel_27, TextHeight=Slider(0.373, range=0..1))

panel_29 = Panel("""Room
Bathroom
Garden
Corridor
Shared space
Private
Balcony""")
crv_2 = Curve([<curve referenced from the Rhino model> x30])
id_2 = Guid(crv_2)
rhinotopls_2 = RhinoToPls(RhinoCurvesAsGuid=id_2, NodeTypes=panel_29)  # -> Roomtypes, Rooms, InteriorDoors, ExteriorDoors, ExteriorWall
pls_to_graph_2 = PolylinesToGraph(
    Roomtypes=rhinotopls_2.Roomtypes,
    NodeTypes=panel_29,
    Rooms=rhinotopls_2.Rooms,
    InteriorDoors=rhinotopls_2.InteriorDoors,
    ExteriorDoors=rhinotopls_2.ExteriorDoors,
    ExteriorWall=rhinotopls_2.ExteriorWall,
    ShowWholeGraph=Toggle(False),
    IncludeExterior=Toggle(False),
    Tolerance=number_slider_41)  # -> PlanGraph, GraphVisualisation
gfeats_4 = GraphFeatures(PlanGraph=pls_to_graph_2.PlanGraph)  # -> NF, NF_t, Adj, Adj_t, ni
panel_30 = Panel(gfeats_4.ni)
wrtype_2 = WriteRoomTypes(Graph=pls_to_graph_2.PlanGraph, NodeTypes=panel_29, TextHeight=Slider(0.373, range=0..1))

panel_31 = Panel("""Room
Bathroom
Garden
Corridor
Shared space
Private
Balcony""")
crv_3 = Curve([<curve referenced from the Rhino model> x135])
id_3 = Guid(crv_3)
rhinotopls_3 = RhinoToPls(RhinoCurvesAsGuid=id_3, NodeTypes=panel_31)  # -> Roomtypes, Rooms, InteriorDoors, ExteriorDoors, ExteriorWall
pls_to_graph_3 = PolylinesToGraph(
    Roomtypes=rhinotopls_3.Roomtypes,
    NodeTypes=panel_31,
    Rooms=rhinotopls_3.Rooms,
    InteriorDoors=rhinotopls_3.InteriorDoors,
    ExteriorDoors=rhinotopls_3.ExteriorDoors,
    ExteriorWall=rhinotopls_3.ExteriorWall,
    ShowWholeGraph=Toggle(False),
    IncludeExterior=Toggle(False),
    Tolerance=number_slider_41)  # -> PlanGraph, GraphVisualisation
gfeats_5 = GraphFeatures(PlanGraph=pls_to_graph_3.PlanGraph)  # -> NF, NF_t, Adj, Adj_t, ni
panel_32 = Panel(gfeats_5.ni)
wrtype_3 = WriteRoomTypes(Graph=pls_to_graph_3.PlanGraph, NodeTypes=panel_31, TextHeight=Slider(0.373, range=0..1))

panel_33 = Panel("""Room
Bathroom
Garden
Corridor
Shared space
Private
Balcony""")
crv_4 = Curve([<curve referenced from the Rhino model> x81])
id_4 = Guid(crv_4)
rhinotopls_4 = RhinoToPls(RhinoCurvesAsGuid=id_4, NodeTypes=panel_33)  # -> Roomtypes, Rooms, InteriorDoors, ExteriorDoors, ExteriorWall
pls_to_graph_4 = PolylinesToGraph(
    Roomtypes=rhinotopls_4.Roomtypes,
    NodeTypes=panel_33,
    Rooms=rhinotopls_4.Rooms,
    InteriorDoors=rhinotopls_4.InteriorDoors,
    ExteriorDoors=rhinotopls_4.ExteriorDoors,
    ExteriorWall=rhinotopls_4.ExteriorWall,
    ShowWholeGraph=Toggle(False),
    IncludeExterior=Toggle(False),
    Tolerance=number_slider_41)  # -> PlanGraph, GraphVisualisation
gfeats_6 = GraphFeatures(PlanGraph=pls_to_graph_4.PlanGraph)  # -> NF, NF_t, Adj, Adj_t, ni
panel_34 = Panel(gfeats_6.ni)
wrtype_4 = WriteRoomTypes(Graph=pls_to_graph_4.PlanGraph, NodeTypes=panel_33, TextHeight=Slider(0.373, range=0..1))

panel_35 = Panel("""Room
Bathroom
Garden
Corridor
Shared space
Private
Balcony""")
crv_5 = Curve([<curve referenced from the Rhino model> x42])
id_5 = Guid(crv_5)
rhinotopls_5 = RhinoToPls(RhinoCurvesAsGuid=id_5, NodeTypes=panel_35)  # -> Roomtypes, Rooms, InteriorDoors, ExteriorDoors, ExteriorWall
pls_to_graph_5 = PolylinesToGraph(
    Roomtypes=rhinotopls_5.Roomtypes,
    NodeTypes=panel_35,
    Rooms=rhinotopls_5.Rooms,
    InteriorDoors=rhinotopls_5.InteriorDoors,
    ExteriorDoors=rhinotopls_5.ExteriorDoors,
    ExteriorWall=rhinotopls_5.ExteriorWall,
    ShowWholeGraph=Toggle(False),
    IncludeExterior=Toggle(False),
    Tolerance=number_slider_41)  # -> PlanGraph, GraphVisualisation
gfeats_7 = GraphFeatures(PlanGraph=pls_to_graph_5.PlanGraph)  # -> NF, NF_t, Adj, Adj_t, ni
panel_36 = Panel(gfeats_7.ni)
wrtype_5 = WriteRoomTypes(Graph=pls_to_graph_5.PlanGraph, NodeTypes=panel_35, TextHeight=Slider(0.387, range=0..1))

extra_oppervlakte_zit_en_eetruimte = Slider(3.46, range=0..100)
basisoppervlakte_zit_en_eetruimte = Slider(17.34, range=0..100)
multiplication_14 = Multiplication(A=aantal_gedetineerden_per_leefgroep, B=extra_oppervlakte_zit_en_eetruimte)
addition_10 = Addition(A=multiplication_14, B=basisoppervlakte_zit_en_eetruimte)
multiplication_15 = Multiplication(A="2", B=aantal_gedetineerden_per_leefgroep)
panel_37 = Panel("""14
16
18
19
20""")
addition_11 = Addition(A=multiplication_15, B="21")
series_2 = Series(Start="21", Step="1", Count=aantal_gedetineerden_per_leefgroep)
merge_6 = Merge(Data1=panel_37, Data2=series_2)
flatten = FlattenTree(Tree=merge_6, Path="{0}")
merge_7 = Merge(Data1=flatten, Data2=addition_11)
flatten_2 = FlattenTree(Tree=merge_7, Path="{0}")
join = TextJoin(Text=flatten_2, Join=",")

extra_oppervlakte_triagepunt = Slider(10.67, range=0..100)
basisoppervlakte_triagepunt = Slider(53.33, range=0..100)
# relatie triagepunt tot zitruimtes
multiplication_16 = Multiplication(A=aantal_gedetineerden_per_leefgroep, B=aantal_leefgroepen)
multiplication_17 = Multiplication(A=multiplication_16, B=extra_oppervlakte_triagepunt)
addition_12 = Addition(A=multiplication_17, B=basisoppervlakte_triagepunt)
multiplication_18 = Multiplication(A=aantal_gedetineerden_per_leefgroep, B=Slider(2, range=0..10))
addition_13 = Addition(A=Slider(8, range=0..10), B=multiplication_18)
series_3 = Series(Start=Slider(14, range=0..100), Step=addition_13, Count=aantal_leefgroepen)
join_2 = TextJoin(Text=series_3, Join=",")
merge_8 = Merge(Data1="6,10,11,12,13", Data2=join_2)
flatten_3 = FlattenTree(Tree=merge_8, Path="{0}")
join_3 = TextJoin(Text=flatten_3, Join=",")
panel_38 = Panel(join_3)

inkom_leefgroep = Slider(3, range=0..100)
series_4 = Series(Start="21", Step="1", Count=aantal_gedetineerden_per_leefgroep)
merge_9 = Merge(Data1="15", Data2=series_4)
flatten_4 = FlattenTree(Tree=merge_9, Path="{0}")
join_4 = TextJoin(Text=flatten_4, Join=",")

private_unit = Slider(25, range=0..100)
repeat = RepeatData(Data="14", Length=aantal_gedetineerden_per_leefgroep)
addition_14 = Addition(A="21", B=aantal_gedetineerden_per_leefgroep)
series_5 = Series(Start=addition_14, Step="1", Count=aantal_gedetineerden_per_leefgroep)
weave = Weave(Pattern=[0, 1], Stream0=repeat, Stream1=series_5, NullGaps=False)

floor_2 = Slider(0, range=0..3)
floor_3 = Slider(1, range=0..3)
floor_4 = Slider(-1, range=-1..3)

floor_5 = Slider(2, range=0..3)
floor_6 = Slider(3, range=0..3)

pipeline = GeometryPipeline(
    GroupByLayer=False,
    GroupByType=False,
    IncludeHidden=True,
    IncludeLocked=True,
    LayerFilter="Trap1",
    NameFilter="*",
    SublayerFiltering=True,
    TypeFilter=4)
pipeline_2 = GeometryPipeline(
    GroupByLayer=False,
    GroupByType=False,
    IncludeHidden=True,
    IncludeLocked=True,
    LayerFilter="Windows",
    NameFilter="*",
    SublayerFiltering=True,
    TypeFilter=4)
pipeline_3 = GeometryPipeline(
    GroupByLayer=False,
    GroupByType=False,
    IncludeHidden=True,
    IncludeLocked=True,
    LayerFilter="Trap-1",
    NameFilter="*",
    SublayerFiltering=True,
    TypeFilter=4)
pipeline_4 = GeometryPipeline(
    GroupByLayer=False,
    GroupByType=False,
    IncludeHidden=True,
    IncludeLocked=True,
    LayerFilter="Trap0",
    NameFilter="*",
    SublayerFiltering=True,
    TypeFilter=4)
pt_3 = Point([<point referenced from the Rhino model> x3])
pt_4 = Point([<point referenced from the Rhino model> x3])
pt_5 = Point([<point referenced from the Rhino model> x3])
pipeline_5 = GeometryPipeline(
    GroupByLayer=False,
    GroupByType=False,
    IncludeHidden=True,
    IncludeLocked=True,
    LayerFilter="Trap3",
    NameFilter="*",
    SublayerFiltering=True,
    TypeFilter=4)
pt_6 = Point([<point referenced from the Rhino model> x3])
nodes2 = GhPythonScript(ni=panel_30, geom=rhinotopls_2.Rooms, windows=pipeline_2, floor=floor_6, trap=pipeline_5, points=pt_6)  # -> ruimtesArea, ruimteNodes, connectionNodes; inputs ni: list, geom: list of Polyline, windows: list of Curve, floor: Int32, trap: list, points: list of Point3d
# ---------- nodes2: Python ----------
__author__ = "Ellen De Sloovere"
__version__ = "2022.03.10"

import Rhino.Geometry as rg
import ghpythonlib.components as gh
import csv
import math
import klasDefinities
reload(klasDefinities)


from klasDefinities import *

nodes = csv.reader(ni)
header = next(nodes)
ruimtesArea = float(0.0)


ruimteNodes = []
connectionNodes = []
x1, y1, z1,  = gh.Deconstruct(points_[0])
x2, y2, z2 = gh.Deconstruct(points_[1])
x3, y3, z3 = gh.Deconstruct(points_[2])


for ruimte, geometrie in zip(nodes, geom):

    nId, nType, nArea, wallRel, doorRel, airRel = ruimte

    ramen =[]
    lijstTrappen = []
    for el in windows:
        #raamgeometrie linken aan aangrenzende ruimtes als eigenschap
        if rg.Intersect.Intersection.CurveCurve(geometrie.ToNurbsCurve(), el.ToNurbsCurve(),0.05, 0.05):
            ramen.append(el)
    
    for tr in trap:
        if rg.Intersect.Intersection.CurveCurve(geometrie.ToNurbsCurve(), tr.ToNurbsCurve(),0.05, 0.05) and nType != 'Bathroom':
            test,pl = tr.TryGetPolyline()
            if test:
                lijstTrappen.append(pl.CenterPoint())


            
    #print lijstTrappen
    if lijstTrappen != [] : 
        ijking =[]
        for el in lijstTrappen:
            xp, yp, zp = el
            ijking.append((math.sqrt((x1 - xp)**2 + (y1 -yp)**2 + (z1 - zp)**2), math.sqrt((x2 - xp)**2 + (y2 -yp)**2 + (z2 - zp)**2), math.sqrt((x3 - xp)**2 + (y3 -yp)**2 + (z3 - zp)**2)))
        connectionNodes.append(Node(tuple((floor, int(nId) )), nType, nArea, omzetten(wallRel, floor), omzetten(doorRel, floor), omzetten(airRel, floor), geometrie, ramen, ijking ))
    else: 
        ruimteNodes.append(Node(tuple((floor, int(nId))), nType, nArea, omzetten(wallRel, floor), omzetten(doorRel, floor), omzetten(airRel, floor), geometrie, ramen))
    
    ruimtesArea += float(nArea)
    

    
for el in connectionNodes:
    print el.getFloor()
# ---------- end nodes2 ----------

pipeline_6 = GeometryPipeline(
    GroupByLayer=False,
    GroupByType=False,
    IncludeHidden=True,
    IncludeLocked=True,
    LayerFilter="Trap2",
    NameFilter="*",
    SublayerFiltering=True,
    TypeFilter=4)

pt_7 = Point([<point referenced from the Rhino model> x3])

nodes2_2 = GhPythonScript(ni=panel_32, geom=rhinotopls_3.Rooms, windows=pipeline_2, floor=floor_2, trap=pipeline_4, points=pt_5)  # -> ruimtesArea, ruimteNodes, connectionNodes; inputs ni: list, geom: list of Polyline, windows: list of Curve, floor: Int32, trap: list, points: list of Point3d
# ---------- nodes2_2: Python ----------
__author__ = "Ellen De Sloovere"
__version__ = "2022.03.10"

import Rhino.Geometry as rg
import ghpythonlib.components as gh
import csv
import math
import klasDefinities
reload(klasDefinities)


from klasDefinities import *

nodes = csv.reader(ni)
header = next(nodes)
ruimtesArea = float(0.0)


ruimteNodes = []
connectionNodes = []
x1, y1, z1,  = gh.Deconstruct(points_[0])
x2, y2, z2 = gh.Deconstruct(points_[1])
x3, y3, z3 = gh.Deconstruct(points_[2])


for ruimte, geometrie in zip(nodes, geom):
    print ruimte
    nId, nType, nArea, wallRel, doorRel, airRel = ruimte

    ramen =[]
    lijstTrappen = []
    for el in windows:
        #raamgeometrie linken aan aangrenzende ruimtes als eigenschap
        if rg.Intersect.Intersection.CurveCurve(geometrie.ToNurbsCurve(), el.ToNurbsCurve(),0.05, 0.05):
            ramen.append(el)
    
    for tr in trap:
        if rg.Intersect.Intersection.CurveCurve(geometrie.ToNurbsCurve(), tr.ToNurbsCurve(),0.05, 0.05) and nType != 'Bathroom':
            test,pl = tr.TryGetPolyline()
            if test:
                lijstTrappen.append(pl.CenterPoint())


            
    #print lijstTrappen
    if lijstTrappen != [] : 
        ijking =[]
        for el in lijstTrappen:
            xp, yp, zp = el
            ijking.append((math.sqrt((x1 - xp)**2 + (y1 -yp)**2 + (z1 - zp)**2), math.sqrt((x2 - xp)**2 + (y2 -yp)**2 + (z2 - zp)**2), math.sqrt((x3 - xp)**2 + (y3 -yp)**2 + (z3 - zp)**2)))
        connectionNodes.append(Node(tuple((floor, int(nId) )), nType, nArea, omzetten(wallRel, floor), omzetten(doorRel, floor), omzetten(airRel, floor), geometrie, ramen, ijking ))
    else: 
        ruimteNodes.append(Node(tuple((floor, int(nId))), nType, nArea, omzetten(wallRel, floor), omzetten(doorRel, floor), omzetten(airRel, floor), geometrie, ramen))
    
    ruimtesArea += float(nArea)
# ---------- end nodes2_2 ----------
nodes2_3 = GhPythonScript(ni=panel_34, geom=rhinotopls_4.Rooms, windows=pipeline_2, floor=floor_3, trap=pipeline, points=pt_4)  # -> ruimtesArea, ruimteNodes, connectionNodes; inputs ni: list, geom: list of Polyline, windows: list of Curve, floor: Int32, trap: list, points: list of Point3d; same code as nodes2
# csv file wordt automatisch opgeslaan in juiste map.
# Verander het ... deeltje na       Files\....csv      in de juiste bestandsnaam
nodes2_4 = GhPythonScript(ni=panel_36, geom=rhinotopls_5.Rooms, windows=pipeline_2, floor=floor_4, trap=pipeline_3, points=pt_3)  # -> ruimtesArea, ruimteNodes, connectionNodes; inputs ni: list, geom: list of Polyline, windows: list of Curve, floor: Int32, trap: list, points: list of Point3d; same code as nodes2_2
nodes2_5 = GhPythonScript(ni=panel_28, geom=rhinotopls.Rooms, windows=pipeline_2, floor=floor_5, trap=pipeline_6, points=pt_7)  # -> ruimtesArea, ruimteNodes, connectionNodes; inputs ni: list, geom: list of Polyline, windows: list of Curve, floor: Int32, trap: list, points: list of Point3d; same code as nodes2

cluster = Cluster(
    d1_2=nodes2_4.ruimtesArea,
    d2_2=nodes2_2.ruimtesArea,
    d3_2=nodes2_3.ruimtesArea,
    d4_2=nodes2_5.ruimtesArea,
    d5_2=nodes2.ruimtesArea,
    d1=nodes2_4.connectionNodes,
    d1_3=nodes2_4.ruimteNodes,
    d2=nodes2_2.connectionNodes,
    d2_3=nodes2_2.ruimteNodes,
    d3=nodes2_3.connectionNodes,
    d3_3=nodes2_3.ruimteNodes,
    d4=nodes2_5.connectionNodes,
    d4_3=nodes2_5.ruimteNodes,
    d5=nodes2.connectionNodes,
    d5_3=nodes2.ruimteNodes)

# ----
# lijst oppervlaktes
repeat_2 = RepeatData(Data=private_unit, Length=aantal_gedetineerden_per_leefgroep)
repeat_3 = RepeatData(Data=private_buitenruimte, Length=aantal_gedetineerden_per_leefgroep)
merge_10 = Merge(
    Data1=panel_21,
    Data2=inkom,
    Data3=tocht_veiligheidssas,
    Data4=sas_toilet,
    Data5=addition_6,
    Data6=addition_7,
    Data7=controle_handscanner,
    Data8=fouilleerruimte,
    Data9=addition_8,
    Data10=addition_12,
    Data11=addition_9,
    Data12=dokterskabinet,
    Data13=bezoekersruimte,
    Data14=buurtfunctie)
merge_11 = Merge(
    Data1=inkom_leefgroep,
    Data2=addition_10,
    Data3=addition_3,
    Data4=addition,
    Data5=addition_2,
    Data6=addition_4,
    Data7=time_out_ruimte,
    Data8=repeat_2,
    Data9=repeat_3)
flatten_5 = FlattenTree(Tree=merge_11, Path="{0}")
merge_12 = Merge(Data1=flatten_5, Data2=addition_5)
multiplication_19 = Multiplication(A="2", B=aantal_gedetineerden_per_leefgroep)
addition_15 = Addition(A=multiplication_19, B="8")
multiplication_20 = Multiplication(A=aantal_leefgroepen, B=addition_15)
repeat_4 = RepeatData(Data=merge_12, Length=multiplication_20)
panel_40 = Panel(repeat_4)
# lijst oppervlaktes
merge_13 = Merge(Data1=merge_10, Data2=panel_40)
flatten_6 = FlattenTree(Tree=merge_13, Path="{0}")
panel_41 = Panel(flatten_6)

# ----
# lijst programmaonderdelen
repeat_5 = RepeatData(Data="private unit", Length=aantal_gedetineerden_per_leefgroep)
repeat_6 = RepeatData(Data="private buitenruimte", Length=aantal_gedetineerden_per_leefgroep)
merge_14 = Merge(
    Data1="openbare weg",
    Data2=panel_24,
    Data3="tocht-/veiligheidssas",
    Data4="sas toilet",
    Data5=panel_25,
    Data6="wachtruimte",
    Data7="controle - handscanner",
    Data8="fouilleerruimte",
    Data9="admnistratieruimte",
    Data10="triagepunt",
    Data11="personeelsruimte",
    Data12="dokterskabinet",
    Data13=panel_26,
    Data14="buurtfunctie")
merge_15 = Merge(
    Data1=panel_23,
    Data2="zit- en eetruimte",
    Data3="keuken",
    Data4="keukenberging",
    Data5="wasruimte",
    Data6="sportruimte",
    Data7="time out - ruimte",
    Data8=repeat_5,
    Data9=repeat_6)
panel_42 = Panel(merge_14)
flatten_7 = FlattenTree(Tree=merge_15, Path="{0}")
merge_16 = Merge(Data1=flatten_7, Data2="buitenruimte")
panel_43 = Panel(merge_16)
multiplication_21 = Multiplication(A="2", B=aantal_gedetineerden_per_leefgroep)
addition_16 = Addition(A=multiplication_21, B="8")
multiplication_22 = Multiplication(A=aantal_leefgroepen, B=addition_16)
repeat_7 = RepeatData(Data=merge_16, Length=multiplication_22)
# lijst programmaonderdelen
panel_44 = Panel(repeat_7)
merge_17 = Merge(Data1=merge_14, Data2=panel_44)
flatten_8 = FlattenTree(Tree=merge_17, Path="{0}")
panel_45 = Panel(flatten_8)

# ----
# lijst relaties
merge_18 = Merge(Data1=weave, Data2=series)
merge_19 = Merge(
    Data1=panel_22,
    Data2="0,2",
    Data3="1,5",
    Data4="4,5",
    Data5="3",
    Data6="2,3,6,8",
    Data7="5,7,9",
    Data8="6,8",
    Data9="5,7",
    Data10=panel_38,
    Data11="9",
    Data12="9",
    Data13="9",
    Data14="0,9")
merge_20 = Merge(Data1=flatten_4, Data2=flatten_2, Data3="14", Data4="16", Data5="14", Data6="14", Data7="14", Data8=merge_18)
flatten_9 = FlattenTree(Tree=merge_20, Path="{0}")
merge_21 = Merge(Data1=flatten_9, Data2="14")
panel_46 = Panel(merge_21)
lng = ListLength(List=panel_46)
multiplication_23 = Multiplication(A=lng, B=aantal_leefgroepen)
repeat_8 = RepeatData(Data=panel_46, Length=multiplication_23)
panel_47 = Panel(repeat_8)
multiplication_24 = Multiplication(A="2", B=aantal_gedetineerden_per_leefgroep)
lng_2 = ListLength(List=flatten_4)
series_6 = Series(Start="0", Step="1", Count=aantal_leefgroepen)
addition_17 = Addition(A="8", B=multiplication_24)
repeat_9 = RepeatData(Data="2", Length=aantal_gedetineerden_per_leefgroep)
addition_18 = Addition(A=lng_2, B="1")
lng_3 = ListLength(List=flatten_2)
lng_4 = ListLength(List="14")
lng_5 = ListLength(List="16")
lng_6 = ListLength(List="14")
lng_7 = ListLength(List="14")
lng_8 = ListLength(List="14")
multiplication_25 = Multiplication(A=series_6, B=addition_17)
multiplication_26 = Multiplication(A=lng, B=aantal_leefgroepen)
merge_22 = Merge(Data1=addition_18, Data2=lng_3, Data3=lng_4, Data4=lng_5, Data5=lng_6, Data6=lng_7, Data7=lng_8, Data8=repeat_9)
repeat_10 = RepeatData(Data=multiplication_25, Length=multiplication_26)
flatten_10 = FlattenTree(Tree=merge_22, Path="{0}")
series_7 = Series(Start="1", Step="0", Count=aantal_gedetineerden_per_leefgroep)
sort = SortList(Keys=repeat_10)  # -> Keys, ValuesA
panel_48 = Panel(sort.Keys)
merge_23 = Merge(Data1=flatten_10, Data2=series_7, Data3="1")
flatten_11 = FlattenTree(Tree=merge_23, Path="{0}")
addition_19 = Addition(A=panel_47, B=panel_48)
panel_49 = Panel(addition_19)
series_8 = Series(Start="0", Step=lng, Count=aantal_leefgroepen)
ins = InsertItems(List=panel_49, Item=Slider(9, range=0..20), Indices=series_8, Wrap=Toggle(False))
panel_50 = Panel(ins)
partition = PartitionList(List=panel_50, Size=flatten_11)
path_mapper = PathMapper(partition, source="{a;b;c;d;e}", target="{path_index}")
panel_51 = Panel(path_mapper)
join_5 = TextJoin(Text=panel_51, Join=",")
panel_52 = Panel(join_5)
flatten_12 = FlattenTree(Tree=panel_52, Path="{0}")
merge_24 = Merge(Data1=merge_19, Data2=flatten_12)
# lijst relaties
panel_53 = Panel(merge_24)

# ----
# Note: Compute tijd voor een pad met lengte hoger dan 2 vereist minstens 1 connectionnode om compute time te minimaliseren
number_slider_42 = Slider(1, range=0..20)
# bespreek path component via trees en adjacency matrix
# Note: meerder overlap in start moet mogelijk zijn
number_slider_43 = Slider(3, range=0..20)
# Note: nummer de sequentie van nodes voor verdere aantakking, nr 1 is de aangetakte node van de start
path_node = GhPythonScript(path_lenght=number_slider_43, i=number_slider_42)  # -> graphlets, i_graphlet, i_connect, possibilities, graphlets_t; inputs planN: list, connect: list
# ---------- path_node: Python ----------
__author__ = "Ellen De Sloovere"
__version__ = "2022.07.29"

import Rhino.Geometry as rg
import ghpythonlib.components as gh
from klasDefinities import *
import scriptcontext
import klasDefinities
reload(klasDefinities)

import rhinoscriptsyntax as rs

graphlets = []

if isinstance(connect, list):
    
    gr = Neighborhood(connect[0], path_lenght, planN)
    graphlets_t = []
    for el in gr.lastgen:
        for i in find_all_paths(gr, gr.seed, el):
            graphlets_t.append(i)
        
for el in graphlets_t:
    count = []
    for i in el:
        if i in connect[2]:
            count.append(i)
    
    if len(count) == int(connect[1]) and len(set(el)) == int(path_lenght +1): 
        print len(set(el)), set(el), path_lenght +1
        graphlets.append(el)
    

for el in graphlets:
    if len(el) != int(path_lenght):
        graphlets.remove(el)
    
"""else:
    gr = Neighborhood(connect, path_lenght, planN)"""
    
possibilities = len(graphlets)
"""
head = [el.getID() for el in planN]

m = Graph(len(planN))
    
for el in planN:
    f = el.getBuren()
    for i in f:
        m.add_edge(head.index(el.getID()), head.index(i))
        

"""
# ---------- end path_node ----------
panel_54 = Panel(path_node.graphlets)

panel_55 = Panel(path_node.possibilities)
item_8 = CherryPicker(path_node.graphlets_t, ListIndex=71, TreePath_path="{0;0;0}")  # disabled
python = GhPythonScript()  # -> out, a; inputs x: list; same code as python
python_2 = GhPythonScript(x=item_8)  # -> a; disabled
# ---------- python_2: Python ----------
__author__ = "info"
__version__ = "2022.07.29"

import rhinoscriptsyntax as rs
a = []
for el in x:
    a.append(el.getGeo())
    
print x
# ---------- end python_2 ----------
srf_10 = Surface(python.a)
panel_56 = Panel(python.a)
panel_57 = Panel(python_2)  # disabled
lng_9 = ListLength(List=panel_45)
series_9 = Series(Start=Slider(0, range=0..100), Step=1, Count=lng_9)

format = Format(Format="{0},{1},{2},\"\",\"{3}\",\"\"", Culture=127, Data0=series_9, Data1=panel_45, Data2=panel_41, Data3=panel_53)
merge_25 = Merge(Data1="NodeId,NodeType,Area,WallRelation,DoorRelation,AirRelation", Data2=format)

# ----
# csv-file
# rechtermuisknop > stream contents
# opgeslaan als .txt bestand
# .txt bestand openen in kladblok op pc
# opslaan als csv file (.csv achter naam file schrijven)
panel_58 = Panel(merge_25)

# ---- group: inkom & zitruimte
number_slider_44 = Slider(10, range=0..21)  # disabled
number_slider_45 = Slider(0, range=0..21)  # disabled
node_33 = ConstructNode2(Name="a room", Type=number_slider_44, Boundary=item_2)  # disabled
node_34 = ConstructNode2(Name="a room", Type=number_slider_45, Boundary=item_3)  # disabled

# ---- group: triburen
item_9 = CherryPicker(list_convert, ListIndex=0, TreePath_path="{0}")  # disabled
item_10 = CherryPicker(list_convert, ListIndex=1, TreePath_path="{0}")  # disabled
item_11 = CherryPicker(list_convert, ListIndex=2, TreePath_path="{0}")  # disabled
item_12 = CherryPicker(list_convert, ListIndex=4, TreePath_path="{0}")  # disabled
number_slider_46 = Slider(20, range=0..21)  # disabled
number_slider_47 = Slider(21, range=0..21)  # disabled
number_slider_48 = Slider(18, range=0..21)  # disabled
number_slider_49 = Slider(19, range=0..21)  # disabled
node_35 = ConstructNode2(Name="a room", Type=number_slider_48, Boundary=item_9)  # disabled
node_36 = ConstructNode2(Name="a room", Type=number_slider_49, Boundary=item_10)  # disabled
node_37 = ConstructNode2(Name="a room", Type=number_slider_46, Boundary=item_11)  # disabled
node_38 = ConstructNode2(Name="a room", Type=number_slider_47, Boundary=item_12)  # disabled

# ----
merge_26 = Merge(Data1=item_9, Data2=item_10, Data3=item_11, Data4=item_12)  # disabled

# ---- group: buurruimtes triage
swatch_6 = ColourSwatch(SwatchColor=RGBA(255, 0, 225, 103))  # disabled
srf_11 = Surface(merge_26)  # disabled
preview_6 = CustomPreview(Geometry=srf_11, Material=swatch_6)  # disabled

# ----
item_13 = CherryPicker(ListIndex=2, TreePath_path="{0}")  # disabled
item_14 = CherryPicker(ListIndex=0, TreePath_path="{0}")  # disabled
item_15 = CherryPicker(ListIndex=1, TreePath_path="{0}")  # disabled
number_slider_50 = Slider(17, range=0..21)  # disabled
number_slider_51 = Slider(13, range=0..21)  # disabled
item_16 = CherryPicker(ListIndex=3, TreePath_path="{0}")  # disabled
item_17 = CherryPicker(ListIndex=4, TreePath_path="{0}")  # disabled
item_18 = CherryPicker(ListIndex=5, TreePath_path="{0}")  # disabled
item_19 = CherryPicker(ListIndex=6, TreePath_path="{0}")  # disabled
number_slider_52 = Slider(14, range=0..21)  # disabled
number_slider_53 = Slider(16, range=0..21)  # disabled
number_slider_54 = Slider(10, range=0..21)  # disabled
number_slider_55 = Slider(12, range=0..21)  # disabled
node_39 = ConstructNode2(Name="a room", Type=number_slider_50, Boundary=item_13)  # disabled
node_40 = ConstructNode2(Name="a room", Type=number_slider_51, Boundary=item_14)  # disabled
node_41 = ConstructNode2(Name="a room", Type=number_slider_35, Boundary=item_15)  # disabled
node_42 = ConstructNode2(Name="a room", Type=number_slider_52, Boundary=item_16)  # disabled
node_43 = ConstructNode2(Name="a room", Type=number_slider_54, Boundary=item_18)  # disabled
node_44 = ConstructNode2(Name="a room", Type=number_slider_55, Boundary=item_19)  # disabled
node_45 = ConstructNode2(Name="a room", Type=number_slider_53, Boundary=item_17)  # disabled
number_slider_56 = Slider(0.4, range=0..3)  # disabled
number_slider_57 = Slider(2, range=0..3)  # disabled
edge_9 = ConstructEdge(Node1=node_40, Node2=node_41, Type=number_slider_57)  # disabled
edge_10 = ConstructEdge(Node1=node_40, Node2=node_42, Type=number_slider_57)  # disabled
edge_11 = ConstructEdge(Node1=node_42, Node2=node_45, Type=number_slider_57)  # disabled
edge_12 = ConstructEdge(Node1=node_41, Node2=node_45, Type=number_slider_57)  # disabled
edge_13 = ConstructEdge(Node1=node_40, Node2=node_43, Type=number_slider_57)  # disabled
edge_14 = ConstructEdge(Node1=node_40, Node2=node_44, Type=number_slider_57)  # disabled

# ---- group: inkom & zitruimte (continued)
edge_15 = ConstructEdge(Node1=node_39, Node2=node_33, Type=number_slider_57)  # disabled
edge_16 = ConstructEdge(Node1=node_33, Node2=node_34, Type=number_slider_57)  # disabled

# ---- group: triburen (continued)
edge_17 = ConstructEdge(Node1=node_39, Node2=node_35, Type=number_slider_57)  # disabled
edge_18 = ConstructEdge(Node1=node_39, Node2=node_36, Type=number_slider_57)  # disabled
edge_19 = ConstructEdge(Node1=node_39, Node2=node_37, Type=number_slider_57)  # disabled
edge_20 = ConstructEdge(Node1=node_39, Node2=node_38, Type=number_slider_57)  # disabled

# ---- group: unit
item_20 = CherryPicker(list_convert_2, ListIndex=0, TreePath_path="{0}")  # disabled
number_slider_58 = Slider(6, range=0..21)  # disabled
node_46 = ConstructNode2(Name="a room", Type=number_slider_58, Boundary=item_20)  # disabled
edge_21 = ConstructEdge(Node1=node_33, Node2=node_46, Type=number_slider_57)  # disabled
edge_22 = ConstructEdge(Node1=node_34, Node2=node_46, Type=number_slider_57)  # disabled

# ----
item_21 = CherryPicker(list_convert_2, ListIndex=1, TreePath_path="{0}")  # disabled
node_47 = ConstructNode2(Name="a room", Type=number_slider_58, Boundary=item_21)  # disabled
edge_23 = ConstructEdge(Node1=node_33, Node2=node_47, Type=number_slider_57)  # disabled
edge_24 = ConstructEdge(Node1=node_34, Node2=node_47, Type=number_slider_57)  # disabled

item_22 = CherryPicker(list_convert_2, ListIndex=3, TreePath_path="{0}")  # disabled
node_48 = ConstructNode2(Name="a room", Type=number_slider_58, Boundary=item_22)  # disabled
edge_25 = ConstructEdge(Node1=node_33, Node2=node_48, Type=number_slider_57)  # disabled
edge_26 = ConstructEdge(Node1=node_34, Node2=node_48, Type=number_slider_57)  # disabled

item_23 = CherryPicker(list_convert_2, ListIndex=2, TreePath_path="{0}")  # disabled
node_49 = ConstructNode2(Name="a room", Type=number_slider_58, Boundary=item_23)  # disabled
edge_27 = ConstructEdge(Node1=node_33, Node2=node_49, Type=number_slider_57)  # disabled
edge_28 = ConstructEdge(Node1=node_34, Node2=node_49, Type=number_slider_57)  # disabled

item_24 = CherryPicker(list_convert_2, ListIndex=4, TreePath_path="{0}")  # disabled
node_50 = ConstructNode2(Name="a room", Type=number_slider_58, Boundary=item_24)  # disabled
edge_29 = ConstructEdge(Node1=node_33, Node2=node_50, Type=number_slider_57)  # disabled
edge_30 = ConstructEdge(Node1=node_34, Node2=node_50, Type=number_slider_57)  # disabled

merge_27 = Merge(Data1=item_20, Data2=item_21, Data3=item_23, Data5=item_22, Data6=item_24)  # disabled

# ---- group: units
swatch_7 = ColourSwatch(SwatchColor=RGBA(255, 150, 59, 221))  # disabled
srf_12 = Surface(merge_27)  # disabled
preview_7 = CustomPreview(Geometry=srf_12, Material=swatch_7)  # disabled

# ----
edge_31 = ConstructEdge(Node1=node_39, Node2=node_41, Type=number_slider_57)  # disabled

merge_28 = Merge(
    Data1=node_40,
    Data2=node_41,
    Data3=node_39,
    Data4=node_42,
    Data5=node_45,
    Data6=node_45,
    Data7=node_43,
    Data8=node_44,
    Data9=node_33,
    Data10=node_34,
    Data15=node_46,
    Data16=node_47,
    Data17=node_47,
    Data18=node_49,
    Data19=node_48,
    Data20=node_49,
    Data21=node_48,
    Data22=node_50,
    Data23=node_38,
    Data24=node_36,
    Data25=node_37,
    Data26=node_35)  # disabled
merge_29 = Merge(
    Data1=edge_31,
    Data2=edge_9,
    Data3=edge_10,
    Data4=edge_12,
    Data5=edge_13,
    Data6=edge_14,
    Data7=edge_11,
    Data8=edge_16,
    Data9=edge_15,
    Data10=edge_17,
    Data11=edge_18,
    Data12=edge_19,
    Data13=edge_20,
    Data14=edge_21,
    Data15=edge_22,
    Data18=edge_21)  # disabled
graph_3 = ConstructGraph(
    Nodes=merge_28,
    Edges=merge_29,
    NodeTypes=["Living room", "Master room", "Kitchen", "Bathroom", "Dining room", "Child room", "Study room", "Second room", "Guest room", "Balcony/Garden", "Entrance", "Storage", "Wall-in", "External area", "Exterior wall", "Front door", "Interior wall", "Interior door", "Corridor", "other"],
    EdgeTypes=["Wall", "Door", "Air"],
    EdgetypeToShow=0)  # -> PlanGraph, GraphVisualisation; disabled
wrtype_6 = WriteRoomTypes(Graph=graph_3.PlanGraph, NodeTypes=panel_3, TextHeight=number_slider_56)  # disabled

# ---- group: triage
muurrel = BooleanToggle(False)
verdeel_structuur = GhPythonScript(planN=cluster, n_nodes=Slider(5, range=0..20), i=Slider(3, range=0..27), n_connect=Slider(1, range=0..20), pos=muurrel)  # -> graphlets, i_graphlet_seed, i_connect, possibilities, visual, l, data_tracker; inputs planN: list, data_nodes: list, connect: list, i: Int32
# ---------- verdeel_structuur: Python ----------
__author__ = "Ellen De Sloovere"
__version__ = "2022.07.29"

import Rhino.Geometry as rg
import ghpythonlib.components as gh
from klasDefinities import *
import scriptcontext
import klasDefinities
reload(klasDefinities)

import rhinoscriptsyntax as rs
data_tracker = []
graphlets = []

for el in planN:
    if el.getNodeDegree(pos) >= n_nodes:
        if connect:
            over = []
            for n in connect[1]:
                if n in set(getNodes(el.getBuren(pos),planN)) and n.status == False:
                    over.append(n)
            if len(over) >= connect[0]: graphlets.append(el)
        else: graphlets.append(el)
            

possibilities = len(graphlets)
i_graphlet_seed = graphlets[i]
i_graphlet_seed.status == True
l = [el for el in getNodes(i_graphlet_seed.getBuren(pos), planN)]

i_connect = ((n_connect, l, i_graphlet_seed))

visual = rg.Polyline(i_graphlet_seed.getGeo(),)

data_tracker = [] + data_nodes
data_tracker.append(i_graphlet_seed)


edges = []
l = [rs.AddCircle(i_graphlet_seed.getGeo().CenterPoint(), float(i_graphlet_seed.opp)/100)]

"""for el in getNodes(i_graphlet_seed.getBuren(True), planN):
    if connect:
        edges.append(Edge(el, i_graphlet_seed, planN))
    l.append(rs.AddCircle(el.getGeo().CenterPoint(), float(el.opp)/100))
    
for el in edges:
    if el.prv() != el.nxt():
        l.append(rs.AddLine(el.prv().getGeo().CenterPoint(), el.nxt().getGeo().CenterPoint()))"""
# ---------- end verdeel_structuur ----------
possibilites = Panel(verdeel_structuur.possibilities)
pline_4 = PolyLine(Vertices=verdeel_structuur.visual, Closed=False)
srf_13 = Surface(pline_4)
panel_59 = Panel(verdeel_structuur.i_connect)
panel_60 = Panel(verdeel_structuur.i_graphlet_seed)
panel_61 = Panel(verdeel_structuur.graphlets)

# ----
merge_30 = Merge(Data1=srf_13, Data2=verdeel_structuur.l)  # -> flatten(Result)

# ---- group: triage (continued)
preview_8 = CustomPreview(Geometry=merge_30, Material=ColourSwatch(SwatchColor=RGB(63, 171, 160)))

# ---- group: inkom/buitenruimte leefgroep
muurrel_2 = BooleanToggle(False)

# ---- group: wachtruimte - fouille - controle - administratie -
# WARNING! start deze component niet zonder connect nodes.
number_slider_59 = Slider(4, range=0..20)
muurrel_3 = BooleanToggle(False)

cycle_structuur = GhPythonScript(
    planN=cluster,
    data_nodes=verdeel_structuur.data_tracker,
    n_nodes=number_slider_59,
    connect=verdeel_structuur.i_connect,
    i=Slider(2, range=0..20),
    n_connect=Slider(2, range=0..20),
    pos=muurrel_3)  # -> flatten(graphlets), i_graphlet, i_connect, possibilities, visual, l, data_tracker; inputs planN: list, data_nodes: list, n_nodes: Int32, connect: list, i: Int32, n_connect: Int32
# ---------- cycle_structuur: Python ----------
__author__ = "Ellen De Sloovere"
__version__ = "2022.08.07"

import rhinoscriptsyntax as rs
import Rhino.Geometry as rg
import ghpythonlib.components as gh
from klasDefinities import *
import scriptcontext
import klasDefinities
reload(klasDefinities)
# nog veranderen naar het aantal geconnecteerde nodes met vorige structuur


data_tracker = []
tgraphlets = []

for el in connect[1]:
    for kopln in getNodes(el.getBuren(pos), planN):
        n = Neighborhood(el, 3, planN)
        tgraphlets += find_all_paths(n, el, kopln)

graphlets = []
for el in tgraphlets:
    if len(set(el)) == n_nodes:
        cond = False
        for n in el:
            if n in data_nodes: cond = True
        if cond == False: graphlets.append(el)


    
possibilities = len(graphlets)

i_graphlet = graphlets[i]
i_connect = ((n_connect, i_graphlet))

visual = []
visual = [element.getGeo() for element in i_graphlet]

data_tracker = [] + data_nodes
data_tracker += i_graphlet





edges = []
l = []

for index in range(n_nodes-1):
    l.append(rs.AddCircle(i_graphlet[index].getGeo().CenterPoint(), float(i_graphlet[index].opp)/100))
    edges.append(Edge(i_graphlet[0], i_graphlet[-1], planN))
    for buur in getNodes(connect[2].getBuren(),planN):
        if buur == i_graphlet[index]:
            edges.append(Edge(connect[2], i_graphlet[index], planN))
    edges.append(Edge(i_graphlet[index], i_graphlet[index +1], planN))

    
for el in edges:
    if el.prv() != el.nxt():
        l.append(rs.AddLine(el.prv().getGeo().CenterPoint(), el.nxt().getGeo().CenterPoint()))
# ---------- end cycle_structuur ----------

panel_62 = Panel(cycle_structuur.possibilities)
panel_63 = Panel(cycle_structuur.graphlets)
panel_64 = Panel(cycle_structuur.i_graphlet)

# ---- group: inkom & toillet
muurrel_4 = BooleanToggle(False)
end_nodes = GhPythonScript(
    planN=cluster,
    data_nodes=cycle_structuur.data_tracker,
    connect=cycle_structuur.i_connect,
    i=Slider(0, range=0..20),
    pos=muurrel_4)  # -> graphlets, endnodes, possibilities, visual, l, data_tracker; inputs planN: list, data_nodes: list, connect: list, i: Int32
# ---------- end_nodes: Python ----------
__author__ = "Ellen De Sloovere"
__version__ = "2022.07.29"

import Rhino.Geometry as rg
import ghpythonlib.components as gh
from klasDefinities import *
import scriptcontext
import klasDefinities
reload(klasDefinities)

import rhinoscriptsyntax as rs
data_tracker = []
graphlets = []
connect[1][0].status == True

for el in connect[1]:
    if el.status == False:
        endn = []
        for buur in getNodes(el.getBuren(pos),planN):
            if buur not in data_nodes: endn.append(buur)
            
        if len(endn) >= connect[0]:
            graphlets.append((el, endn))


possibilities = len(graphlets)
endnodes = graphlets[i]

data_tracker = [] + data_nodes

data_tracker += endnodes[1]
visual = [el.getGeo() for el in endnodes[1]]



edges = []
l = []

for index in range(connect[0]):
    l.append(rs.AddCircle(endnodes[1][index].getGeo().CenterPoint(), float(endnodes[1][index].opp)/100))
    edges.append(Edge(endnodes[0], endnodes[1][index], planN))

    
for el in edges:
    if el.prv() != el.nxt():
        l.append(rs.AddLine(el.prv().getGeo().CenterPoint(), el.nxt().getGeo().CenterPoint()))
# ---------- end end_nodes ----------
possibilities = Panel(end_nodes.possibilities)
panel_65 = Panel(end_nodes.graphlets)
panel_66 = Panel(end_nodes.endnodes)
panel_67 = Panel(end_nodes.visual)

# ---- group: endnodes triage
muurrel_5 = BooleanToggle(False)

# ---- group: inkom/buitenruimte leefgroep (continued)
verdeel_structuur_2 = GhPythonScript(
    planN=cluster,
    data_nodes=end_nodes.data_tracker,
    n_nodes=Slider(5, range=0..20),
    connect=verdeel_structuur.i_connect,
    i=Slider(0, range=0..27),
    n_connect=Slider(1, range=0..20),
    pos=muurrel_2)  # -> graphlets, i_graphlet_seed, i_connect, possibilities, visual, l, data_tracker; inputs planN: list, data_nodes: list, connect: list, i: Int32
# ---------- verdeel_structuur_2: Python ----------
__author__ = "Ellen De Sloovere"
__version__ = "2022.07.29"

import Rhino.Geometry as rg
import ghpythonlib.components as gh
from klasDefinities import *
import scriptcontext
import klasDefinities
reload(klasDefinities)

import rhinoscriptsyntax as rs
data_tracker = []
data_tracker += data_nodes
graphlets = []

for el in planN:
    if el.getNodeDegree(pos) >= n_nodes and el not in data_tracker:
        if connect:
            over = []
            for n in connect[1]:
                if n in set(getNodes(el.getBuren(pos),planN)) and n.status == False:
                    over.append(n)
            if len(over) >= connect[0]: graphlets.append(el)
        else: graphlets.append(el)
            

possibilities = len(graphlets)
i_graphlet_seed = graphlets[i]
i_graphlet_seed.status == True
l = [el for el in getNodes(i_graphlet_seed.getBuren(pos), planN)]

i_connect = ((n_connect, l))

visual = rg.Polyline(i_graphlet_seed.getGeo(),)

data_tracker = [] + data_nodes
data_tracker.append(i_graphlet_seed)


edges = []
l = [rs.AddCircle(i_graphlet_seed.getGeo().CenterPoint(), float(i_graphlet_seed.opp)/100)]

for el in getNodes(i_graphlet_seed.getBuren(True), planN):
    edges.append(Edge(el, i_graphlet_seed, planN))
    l.append(rs.AddCircle(el.getGeo().CenterPoint(), float(el.opp)/100))
    
for el in edges:
    if el.prv() != el.nxt():
        l.append(rs.AddLine(el.prv().getGeo().CenterPoint(), el.nxt().getGeo().CenterPoint()))
# ---------- end verdeel_structuur_2 ----------
possibilites_2 = Panel(verdeel_structuur_2.possibilities)
pline_5 = PolyLine(Vertices=verdeel_structuur_2.visual, Closed=False)
srf_14 = Surface(pline_5)
panel_68 = Panel(verdeel_structuur_2.i_connect)
panel_69 = Panel(verdeel_structuur_2.i_graphlet_seed)
panel_70 = Panel(verdeel_structuur_2.graphlets)

# ---- group: endnodes triage (continued)
end_nodes_2 = GhPythonScript(
    planN=cluster,
    data_nodes=verdeel_structuur_2.data_tracker,
    connect=verdeel_structuur.i_graphlet_seed,
    n_connect=Slider(4, range=0..20),
    i=Slider(0, range=0..20),
    pos=muurrel_5)  # -> endnodes, possibilities, visual, l, data_tracker; inputs planN: list, data_nodes: list, n_connect: Int32, i: Int32
# ---------- end_nodes_2: Python ----------
__author__ = "Ellen De Sloovere"
__version__ = "2022.07.29"

import Rhino.Geometry as rg
import ghpythonlib.components as gh
from klasDefinities import *
import scriptcontext
import klasDefinities
reload(klasDefinities)
from itertools import combinations
import rhinoscriptsyntax as rs
data_tracker = []
graphlets = []
connect.status == True


endn = []
for buur in getNodes(connect.getBuren(pos),planN):
    if buur not in data_nodes: endn.append(buur)


lijst = combinations(endn, n_connect)

pos = []
for el in lijst:
    pos.append([x for x in el])

possibilities = len(pos)
endnodes = pos[i]

data_tracker = [] + data_nodes

data_tracker += endnodes
visual = []



edges = []
l = []

for index in range(n_connect):
    visual.append(endnodes[index].getGeo())
    l.append(rs.AddCircle(endnodes[index].getGeo().CenterPoint(), float(endnodes[index].opp)/100))
    edges.append(Edge(connect, endnodes[index], planN))

    
for el in edges:
    if el.prv() != el.nxt():
        l.append(rs.AddLine(el.prv().getGeo().CenterPoint(), el.nxt().getGeo().CenterPoint()))
# ---------- end end_nodes_2 ----------
possibilities_2 = Panel(end_nodes_2.possibilities)
panel_71 = Panel(end_nodes_2.endnodes)
panel_72 = Panel(end_nodes_2.visual)

# ----
merge_31 = Merge(Data1=srf_14, Data2=verdeel_structuur_2.l)  # -> flatten(Result)

# ---- group: inkom/buitenruimte leefgroep (continued)
preview_9 = CustomPreview(Geometry=merge_31, Material=ColourSwatch(SwatchColor=RGB(0, 111, 255)))

# ---- group: endnodes triage
srf_15 = Surface(end_nodes_2.visual)

# ----
merge_32 = Merge(Data1=srf_15, Data2=end_nodes_2.l)

# ---- group: endnodes triage (continued)
preview_10 = CustomPreview(Geometry=merge_32, Material=ColourSwatch(SwatchColor=RGB(255, 0, 0)))

# ---- group: wachtruimte - fouille - controle - administratie -
srf_16 = Surface(cycle_structuur.visual)

# ----
merge_33 = Merge(Data1=srf_16, Data2=cycle_structuur.l)

# ---- group: wachtruimte - fouille - controle - administratie - (continued)
preview_11 = CustomPreview(Geometry=merge_33, Material=ColourSwatch(SwatchColor=RGB(83, 73, 196)))

# ----
# WARNING! start deze component niet zonder connect nodes.
number_slider_60 = Slider(4, range=0..20)  # disabled
muurrel_6 = BooleanToggle(False)  # disabled

number_slider_61 = Slider(8, range=0..20)  # disabled
number_slider_62 = Slider(2, range=0..20)  # disabled
cycle_structuur_2 = GhPythonScript(
    planN=cluster,
    data_nodes=verdeel_structuur_2.data_tracker,
    n_nodes=number_slider_60,
    connect=verdeel_structuur_2.i_connect,
    i=number_slider_61,
    n_connect=number_slider_62,
    pos=muurrel_6)  # -> flatten(graphlets), i_graphlet, i_connect, possibilities, visual, l, data_tracker; inputs planN: list, data_nodes: list, n_nodes: Int32, connect: list, i: Int32, n_connect: Int32; disabled
# ---------- cycle_structuur_2: Python ----------
__author__ = "Ellen De Sloovere"
__version__ = "2022.08.07"

import rhinoscriptsyntax as rs
import Rhino.Geometry as rg
import ghpythonlib.components as gh
from klasDefinities import *
import scriptcontext
import klasDefinities
reload(klasDefinities)
# nog veranderen naar het aantal geconnecteerde nodes met vorige structuur


data_tracker = []
tgraphlets = []

for el in connect[1]:
    for kopln in getNodes(el.getBuren(pos), planN):
        n = Neighborhood(el, 3, planN)
        tgraphlets += find_all_paths(n, el, kopln)

graphlets = []
for el in tgraphlets:
    if len(set(el)) == n_nodes:
        cond = False
        for n in el:
            if n in data_nodes: cond = True
                 
        if cond == False: graphlets.append(el)


    
possibilities = len(graphlets)

i_graphlet = graphlets[i]
i_connect = ((n_connect, i_graphlet))

visual = []
visual = [element.getGeo() for element in i_graphlet]

data_tracker = [] + data_nodes
data_tracker += i_graphlet





edges = []
l = []

for index in range(n_nodes-1):
    l.append(rs.AddCircle(i_graphlet[index].getGeo().CenterPoint(), float(i_graphlet[index].opp)/100))
    edges.append(Edge(i_graphlet[0], i_graphlet[-1], planN))
    edges.append(Edge(i_graphlet[index], i_graphlet[index +1], planN))

    
for el in edges:
    if el.prv() != el.nxt():
        l.append(rs.AddLine(el.prv().getGeo().CenterPoint(), el.nxt().getGeo().CenterPoint()))
# ---------- end cycle_structuur_2 ----------

panel_73 = Panel(cycle_structuur_2.possibilities)  # disabled
panel_74 = Panel(cycle_structuur_2.graphlets)  # disabled
panel_75 = Panel(cycle_structuur_2.i_graphlet)  # disabled

srf_17 = Surface(cycle_structuur_2.visual)  # disabled
swatch_8 = ColourSwatch(SwatchColor=RGB(83, 73, 196))  # disabled
merge_34 = Merge(Data1=srf_17, Data2=cycle_structuur_2.l)  # disabled
preview_12 = CustomPreview(Geometry=merge_34, Material=swatch_8)  # disabled

muurrel_7 = BooleanToggle(False)  # disabled
number_slider_63 = Slider(0, range=0..20)  # disabled
end_nodes_3 = GhPythonScript(
    planN=cluster,
    data_nodes=cycle_structuur_2.data_tracker,
    connect=cycle_structuur_2.i_connect,
    i=number_slider_63,
    pos=muurrel_7)  # -> graphlets, endnodes, possibilities, visual, l, data_tracker; inputs planN: list, data_nodes: list, connect: list, i: Int32; disabled; same code as end_nodes
possibilities_3 = Panel(end_nodes_3.possibilities)  # disabled
panel_76 = Panel(end_nodes_3.graphlets)  # disabled
panel_77 = Panel(end_nodes_3.endnodes)  # disabled
panel_78 = Panel(end_nodes_3.visual)  # disabled

srf_18 = Surface(end_nodes_3.visual)  # disabled
swatch_9 = ColourSwatch(SwatchColor=RGB(110, 178, 0))  # disabled
merge_35 = Merge(Data1=srf_18, Data2=end_nodes_3.l)  # disabled
preview_13 = CustomPreview(Geometry=merge_35, Material=swatch_9)  # disabled

# ---- group: inkom & toillet
srf_19 = Surface(end_nodes.visual)

# ----
merge_36 = Merge(Data1=srf_19, Data2=end_nodes.l)

# ---- group: inkom & toillet (continued)
preview_14 = CustomPreview(Geometry=merge_36, Material=ColourSwatch(SwatchColor=RGB(110, 178, 0)))

# ==== cluster Cluster
d1 = ClusterInput()
d2 = ClusterInput()
d3 = ClusterInput()
d4 = ClusterInput()
d5 = ClusterInput()
d1_2 = ClusterInput()
d2_2 = ClusterInput()
d3_2 = ClusterInput()
d4_2 = ClusterInput()
d5_2 = ClusterInput()

# ---- group: Fase twee
panel = Panel("C:\Users\info\OneDrive\Documenten\Thesis\Ellen\Files\2 gedetineerden 1 leefgroep zonder buitenruimte.csv")
merge = Merge(Data1=d1_2, Data2=d2_2, Data3=d3_2, Data4=d4_2, Data5=d5_2)
idealcsv = GhPythonScript(bestand=panel, floor=0)  # -> verdeelruimteNodes, verdeelruimtesArea, triagepunt, aantalLeefgroepen, aantalUnits_leefgroep; inputs floor: Int32
# ---------- idealcsv: Python ----------
__author__ = "Ellen De Sloovere"
__version__ = "2022.03.10"

import Rhino.Geometry as rg
import csv
import klasDefinities
reload(klasDefinities)

from klasDefinities import *




# uit ideale graaf van Margo
bestand = open(bestand, 'r')
inodes = csv.reader(bestand)
iheader = next(inodes)

verdeelruimteNodes = []
verdeelruimtesArea = float(0.0)
aantalLeefgroepen = 0
for ruimte in inodes:
    inId, inType, inArea, iwallRel, idoorRel, iairRel = ruimte
    
    if inType == 'buurtfunctie':
        inArea = 0.22 * float(inArea)

    verdeelruimteNodes.append(Node(id = int(inId), roomType = inType, opp = inArea, muurRel = omzetten(iwallRel, floor), deurRel = omzetten(idoorRel, floor), buitenRel = omzetten(iairRel, floor))) 
    verdeelruimtesArea += float(inArea)

    if inType == 'inkom leefgroep':
        aantalLeefgroepen += 1
        
bestand.close()

    
#assert genoeg_opp is True, 'niet genoeg oppervlakte voor gekozen programma'
triagepunt = 0
aantalUnits_leefgroep = 0
for n in verdeelruimteNodes:
    if n.getRoomType() == 'triagepunt':
        triagepunt = n.getNodeDegree()
    if n.getRoomType() == 'private unit':
        aantalUnits_leefgroep += 1
        
aantalUnits_leefgroep = aantalUnits_leefgroep / aantalLeefgroepen
# ---------- end idealcsv ----------
totalopp = GhPythonScript(nodigOpp=idealcsv.verdeelruimtesArea, projectOpp=flatten(merge))  # -> genoeg_opp; inputs projectOpp: list
# ---------- totalopp: Python ----------
projectOpp = sum(el for el in projectOpp)
print projectOpp
if projectOpp < nodigOpp:
    genoeg_opp = 'Niet genoeg oppervlakte voor programma'
else:
    genoeg_opp = 'Genoeg oppervlakte voor programma'
# ---------- end totalopp ----------
genoeg_oppervlakte = Panel(totalopp)
panel_2 = Panel(idealcsv.verdeelruimteNodes)

# ----
d1_3 = ClusterInput()
d2_3 = ClusterInput()
d3_3 = ClusterInput()
d4_3 = ClusterInput()
d5_3 = ClusterInput()

# ---- group: Fase twee
delta = Slider(0.028, range=0..2)
merge_2 = Merge(Data1=d1, Data2=d2, Data3=d3, Data4=d4, Data5=d5)  # -> flatten(Result)
verticallink = GhPythonScript(nodes=merge_2, delta=delta)  # -> nodes; inputs nodes: list
# ---------- verticallink: Python ----------
__author__ = "Ellen De Sloovere"
__version__ = "2022.05.16"

import Rhino.Geometry as rg
import csv
import Rhino
import klasDefinities
import rhinoscriptsyntax as rs
reload(klasDefinities)

from klasDefinities import *


for el1 in nodes:
    for el2 in nodes: 
        for tr1 in el1.getDistanceTP():
            for tr2 in el2.getDistanceTP():
                if el1.getFloor() != el2.getFloor() and abs(tr1[0] - tr2[0]) <= delta and abs(tr1[1] - tr2[1]) <= delta and abs(tr1[2] - tr2[2]): el1.changeVConnection(el2.getID()[0], el2.getID()[1])
# ---------- end verticallink ----------
merge_3 = Merge(Data1=d1_3, Data2=d2_3, Data3=d3_3, Data4=d4_3, Data5=d5_3, Data6=verticallink)  # -> flatten(Result)
panel_3 = Panel(merge_3)

# ----
R = ClusterOutput(merge_3)
muurrelatie = BooleanToggle(True)  # disabled

# ---- group: Fase twee / mapping static nodes
# Op welk verdiep wil je starten?
panel_4 = Panel("Garden")  # disabled
floor = Slider(0, range=-1..3)  # disabled
static_nodes = GhPythonScript(outside=panel_4, planNodes=merge_3, triage=idealcsv.triagepunt, niveau_toekomen=floor, bool_muurRel=muurrelatie)  # -> flatten(idKnopen), designPossibilities; inputs planNodes: list; disabled
# ---------- static_nodes: Python ----------
__author__ = "Ellen De Sloovere"
__version__ = "2022.04.17"


import scriptcontext
import klasDefinities
reload(klasDefinities)

from klasDefinities import *
from itertools import *

def TimeConsumingTask():    
    for i in range(30000):
        # Was escape key pressed?
        if (scriptcontext.escape_test(False)):
            print "TimeConsumingTask cancelled."
            break

TimeConsumingTask()

punt1 = []
test = []
        
#for el in beginGroepen

pi = []
for n in planNodes:
    #wachtruimte
    if n.getNodeDegree(bool_muurRel) >= 4:
        toegang = []
        hub = []
        wc =[]
        #buren van wachtruimte: administratie, controle, toillet en inkom
        for i in getNodes(n.getBuren(bool_muurRel), planNodes):
            
            #toegang
            if i.getRoomType() != outside:
                #i.heeftRaam() != [] and
                if i.getID()!= n.getID() and i.identifier[0] == niveau_toekomen and i.heeftRaam(): 
                    toegang.append(i.getID())
                
                #wc
                if i.getNodeDegree(bool_muurRel): 
                    
                    wc.append(i.getID())

            
            #hub (controle - handscanner - i) naar triage (el)
            for el in getNodes(i.getBuren(bool_muurRel),planNodes):
                #ergens moet er nog een niet gelijk aan outside tussen
                
                if el.getNodeDegree(bool_muurRel) >= triage and el.getID() != n.getID() : 
                    hub.append((i, el))
                    test.append((i.getGeo(), el.getGeo()))
                    
        #controlekamer en triage
        for hu, tri in hub:
            #fouille
            tussen =[]
            for ni in hu.getBuren(bool_muurRel):
                #print ni
                #n.getBuren is administratie
                if ni != tri.getID() and overlap(ni, n.getBuren(bool_muurRel), planNodes) is not None and (ni not in toegang or len(toegang) > 1):
                    
                    #(fouille, administratie)
                    for el in overlap(ni, n.getBuren(bool_muurRel), planNodes):
                        #print el
                        if len(getNodes(el, planNodes)) >= 2:
                            k = getNodes(el, planNodes)
                            if hu.getRoomType() != outside and k[0].getRoomType() != outside and k[1].getRoomType() != outside and len(set((el[0], el[1], ni, tri.getID(), n.getID(), hu.getID()))) == 5:
                                tussen.append(el)


            #wachtkamer, controle, triage naar volgend deel, 'aan hub en wachtkamer' (nu nog maar 1 kamer), inkom, wc)
            punt1.append([n.getGeo(), hu.getGeo(), tri.getGeo()])
            print n.getID(), hu.getID(), tri.getID(), tussen, toegang, wc
            if tussen != [] and wc != [] and toegang != [] and hu.getRoomType != outside: pi.append((n.getID(), hu.getID(), tri.getID(), tussen, toegang, wc))
            


idKnopen = []
buren =[]
print pi
for i in pi:
    
    idKnopenT = [] 

    for el in i[3]:

        if el[0] not in i[0:3] and el[1] not in i[0:3]:
            reeks = [k for k in i[0:3]]
            reeks.append(el[0])
            reeks.append(el[1])
            idKnopenT.append(reeks)
            
    for combo in idKnopenT:
        reeksT = []
        for inkom in i[4]:
            combo = reeks + [inkom]
            opties = set(i[5])
            if len(i[4]) > 1:
                for element in i[4]: 
                    if element != inkom: 
                        opties.add(element)
                        
            combo.append(list(opties))
            idKnopen.append(combo)

idKnopen2 = []

for el in idKnopen:
    for i in el[6]:
        if isinstance (i,list): 
            for k in i:
                reeks = el[0:6] + [k]
                idKnopen2.append(reeks)
        else:
            reeks = el[0:6] + [i]
            idKnopen2.append(reeks)
            
            
idKnopen_ = []
for el in idKnopen2:
    if len(set(el)) == 7:
        idKnopen_.append(el)
    

designPossibilities = len(idKnopen_)

print len(test)
# ---------- end static_nodes ----------

number_slider = Slider(0, range=0..85)  # disabled
item = ListItem(List=static_nodes.idKnopen, Index=number_slider, Wrap=True)  # disabled
pick = GhPythonScript(planNodes=merge_3, knopen=item)  # -> flatten(n), l, idKnopen; inputs planNodes: list; disabled
# ---------- pick: Python ----------
__author__ = "Ellen De Sloovere"
__version__ = "2022.05.10"

import rhinoscriptsyntax as rs
import math
import scriptcontext
import Rhino.Geometry as rg
import ghpythonlib.components as gh
import System
import klasDefinities
reload(klasDefinities)

from klasDefinities import *
from decimal import *

#afwijking = '%.3f' % (sum(el for el in afw)/len(knopen)),  tuple('%.3f' % el for el in afw)
idKnopen = knopen
n_ = [el for el in getNodes(knopen, planNodes)]
knopen = getNodes(knopen, planNodes)
print knopen

knopen[0].roomType = 'wachtruimte'
knopen[1].roomType = 'controle - handscanner'
knopen[2].roomType = 'triagepunt'
knopen[3].roomType = 'administratieruimte'
knopen[4].roomType = 'fouilleerruimte'
knopen[5].roomType = 'inkom'
knopen[6].roomType = 'toillet bezoekers'
    
l_ = []
l_.append(Edge(knopen[0], knopen[6], planNodes))
l_.append(Edge(knopen[0], knopen[5], planNodes))
l_.append(Edge(knopen[0], knopen[1], planNodes))
l_.append(Edge(knopen[0], knopen[3], planNodes))
l_.append(Edge(knopen[1], knopen[4], planNodes))
l_.append(Edge(knopen[3], knopen[4], planNodes))
l_.append(Edge(knopen[1], knopen[2], planNodes))
# ---------- end pick ----------
knopen = Panel(pick.idKnopen)  # disabled

# ---- group: Fase twee
# ruimtes: wachtruimte
# controle - handscanner
# triagepunt
# administratie
# fouilleerruimte
# inkom & tocht-/veiligheidssas
# toillet bezoekers
aantal_mogelijke_configuraties_van_stati = Panel(static_nodes.designPossibilities)  # "aantal mogelijke configuraties van statisch deel"; disabled

# ---- group: Fase twee / static part color
visueel = GhPythonScript(planNodes=merge_3, knopen=pick.n)  # -> flatten(visueel); inputs planNodes: list, knopen: list; disabled
# ---------- visueel: Python ----------
__author__ = "Ellen De Sloovere"
__version__ = "2022.05.10"

import rhinoscriptsyntax as rs
import math
import scriptcontext
import Rhino.Geometry as rg
import ghpythonlib.components as gh
import System
import klasDefinities
reload(klasDefinities)

from klasDefinities import *
from decimal import *


#afwijking = '%.3f' % (sum(el for el in afw)/len(knopen)),  tuple('%.3f' % el for el in afw)
idKnopen = knopen
print knopen


visueel = [el.getGeo() for el in knopen]
# ---------- end visueel ----------
swatch = ColourSwatch(SwatchColor=RGBA(255, 228, 20, 135))  # disabled
srf = Surface(visueel)  # disabled
preview = CustomPreview(Geometry=srf, Material=swatch)  # disabled

# ---- group: Fase twee
dynamic_nodes = GhPythonScript(
    outside=panel_4,
    planNodes=merge_3,
    beginNodes=pick.idKnopen,
    aantalGroepen=idealcsv.aantalLeefgroepen,
    aantalUnits=idealcsv.aantalUnits_leefgroep,
    bool_muurRel=muurrelatie)  # -> aantal_leefgroepen, leefgroepen, alter_leefgroepen, aantal_a_leefgroepen; inputs planNodes: list, beginNodes: list, aantalGroepen: Int32, aantalUnits: Int32; disabled
# ---------- dynamic_nodes: Python ----------
__author__ = "Ellen De Sloovere"
__version__ = "2022.05.10"

import rhinoscriptsyntax as rs
import math
import scriptcontext
import Rhino.Geometry as rg
import ghpythonlib.components as gh
import System
from itertools import *
import copy
import klasDefinities
reload(klasDefinities)

from klasDefinities import *


beginKnopen = getNodes(beginNodes,planNodes)
sbeginKnopen = set(beginNodes)

dyn_nodes =[]
alter_leefgroepen = []

# buren van triage zijn inkom en buitenruimte
for el in  getNodes(beginKnopen[2].getBuren(bool_muurRel), planNodes):
    tussen_ = []
    #check of het buitenruimte is
    if el.getRoomType() == outside and el not in beginKnopen:
        #tussen = []
        #aantal_a_leefgroepen += 1
        # buren van buitenruimte is zitruimte en landing voor units
        for landing in getNodes(el.getBuren(bool_muurRel), planNodes):
            if landing not in beginKnopen:
                zitruimte_ = getNodes(el.getBuren(bool_muurRel), planNodes)
                zitruimte_.remove(landing)
                for used in beginKnopen: 
                    if used in zitruimte_: zitruimte_.remove(used)
                    
                tussenUnits = []
                for un in getNodes(landing.getBuren(bool_muurRel), planNodes):
                    if un != el and un not in beginKnopen:
                        if un.difFloorRel:
                            b = False
                            for x in tussenUnits:
                                if isinstance(x, set) and un in x:
                                    b = True
                            if b is False:
                                stack_unit = set()
                                stack_unit.add(un)
                                for el2 in getNodes(un.difFloorRel, planNodes):
                                    if el2.getRoomType() != outside and len(set((el2 , el , landing))) == 3 and el2 not in beginKnopen: stack_unit.add(el2)
                                tussenUnits.append(stack_unit)
                                
                        else:
                            tussenUnits.append(un)
                if tussenUnits != []:
                    #buitenruimte, tussenruimte, zitruimte, units
                    alter_leefgroepen.append([el, landing, zitruimte_, tussenUnits])
            #alter_leefgroepen.append(tussen)
    
    
    
    #buren van inkom is zitruimte
    for ni in getNodes(el.getBuren(bool_muurRel), planNodes):
        #text met el!= outside want eigenlijk al eruit gehaald
        valid = []
        if el.getRoomType() != outside and ni.getRoomType() != outside and el not in beginKnopen and ni not in beginKnopen and el.getNodeDegree(bool_muurRel) >= aantalUnits + 2 and ni.getNodeDegree(bool_muurRel) >= aantalUnits + 5:
            #buren van zitruimte en inkom --> 3de graad pad, kijk voor overlap voor units
            tussenUnits = []
            for un in getNodes(ni.getBuren(bool_muurRel), planNodes): 
                if un.getRoomType() != outside:
                    if un.difFloorRel:
                        b = False
                        for x in tussenUnits:
                            if isinstance(x, set) and un in x:
                                b = True
                        if b is False:
                            stack_unit = set()
                            stack_unit.add(un)
                            for el2 in getNodes(un.difFloorRel, planNodes):
                                if el2.getRoomType() != outside and len(set((el2 , el , ni))) == 3: stack_unit.add(el2)
                            tussenUnits.append(stack_unit)
                                
                        else:
                            tussenUnits.append(un)
            
            for o in tussenUnits:
                if isinstance(o, set):
                    con = False
                    used = False
                    for x in o:
                        if ni in getNodes(x.getBuren(),planNodes): con = True
                        if x == ni or x == el: used = True
                    if con == True and used == False: valid.append(o)
                else:
                    if ni in getNodes(o.getBuren(), planNodes) and o.getRoomType() != outside and ni != o: valid.append(o)
                        
                    
            

                        
        if el!= None and ni != None and valid != []:
            dyn_nodes.append([el, ni, valid])
            
        


aantal_a_leefgroepen = len(alter_leefgroepen)
print alter_leefgroepen

#check hoeveel leefgroepen er mogelijk zijn door verschillende zitruimtes en inkoms te bekijken + dubbele/gelijke oplossingen eruit halen
aantal_leefgroepen = []
leefgroepen = []
for el in dyn_nodes:
    out_s = set()
    out_s.add(el[0].identifier) 
    out_s.add(el[1].identifier)
    tussen_l = [el]
    for i in dyn_nodes:
        if (i[0].identifier and i[1].identifier) not in out_s: 
            out_s.add(i[0].identifier) 
            out_s.add(i[1].identifier)
            tussen_l.append(i)
    out = len(tussen_l)
    condition = False
    
    # werkte niet vanaf 3 leefgroepen
    for i in leefgroepen:
        if i[::-1] == tussen_l: condition = True
    if condition == False: 
        leefgroepen.append(tussen_l)
        aantal_leefgroepen.append(out)
        
        
        
        

"""
                conn = getNodes(un.getBuren(bool_muurRel), planNodes)
                #voorwaarden uit de ideale graaf
                if (el and ni) in conn and un not in beginKnopen  and el.getNodeDegree(bool_muurRel) >= aantalUnits + 2 and ni.getNodeDegree(bool_muurRel) >= aantalUnits + 5 and len(set((el ,ni ,un))) == 3 and un.getRoomType() != outside:
                    if un.difFloorRel:
                        b = False
                        for x in tussenUnits:
                            if isinstance(x, set) and un in x:
                                b = True
                        if b is False:
                            stack_unit = set()
                            stack_unit.add(un)
                            for el2 in getNodes(un.difFloorRel, planNodes):
                                if el2.getRoomType() != outside and len(set((el2 , el , ni))) == 3: stack_unit.add(el2)
                            tussenUnits.append(stack_unit)
                            
                    else:
                        tussenUnits.append(un)"""
# ---------- end dynamic_nodes ----------
mogelijk_aantal_leefgroepen = Panel(dynamic_nodes.aantal_leefgroepen)  # disabled
number_slider_2 = Slider(0, range=0..50)  # disabled
panel_5 = Panel(dynamic_nodes.leefgroepen)  # disabled
item_2 = ListItem(List=dynamic_nodes.leefgroepen, Index=number_slider_2, Wrap=True)  # disabled
pick_2 = GhPythonScript(planN=merge_3, leefgroepen=item_2, tri=pick.n)  # -> flatten(n), l, zit; inputs planN: list, tri: list; disabled
# ---------- pick_2: Python ----------
import Rhino.Geometry as rg
import csv
from itertools import *
import klasDefinities
reload(klasDefinities)

from klasDefinities import *

import rhinoscriptsyntax as rs
delta = 0.01

n_ = []
l_ = []
zit = []
for element in leefgroepen:
    tussen_ = []
    
    tussen_.append(element[0])
    tussen_.append(element[1])
    
    element[0].roomType = 'inkom'
    element[1].roomType =  'zitruimte'
    
    zit.append(element[1])
    
    l_.append(Edge(element[0], element[1], planN))
    l_.append(Edge(element[0], tri[2], planN))
    
    tussen = []
    for el in element[2]: 
        if isinstance(el, set):
            l = el.copy()
            _list = []
            while l:
                _list.append(l.pop())
            for i in range(len(_list)-1): 
                l_.append(Edge(_list[i], _list[i+1], planN))
                
            af_inkom = []
            af_zitruimte = []
            for  i in _list:
                af_inkom.append(afstand(i, element[0]))
                af_zitruimte.append(afstand(i, element[1]))
                
            for i in range(len(af_inkom)):
                if abs(af_inkom[i] - min(af_inkom)) <= delta: l_.append(Edge(_list[i], element[0], planN))
              

            for i in range(len(af_zitruimte)):
                if abs(af_zitruimte[i] - min(af_zitruimte)) <= delta: l_.append(Edge(_list[i], element[1], planN))
           
                    
            tussen.append(_list)
            
        else: 
            tussen.append(el)
            l_.append(Edge(el,element[0], planN))
            l_.append(Edge(el,element[1], planN))


    tussen_.append(tussen)
    for el in tussen:
        if isinstance(el, list):
            for i in el:
                i.roomType = 'private unit'
                
        else:
            el.roomType = 'private unit'
    n_.append(tussen_)
# ---------- end pick_2 ----------

# ----
number_slider_3 = Slider(1, range=0..50)  # disabled

mogelijk_aantal_alter_leefgroepen = Panel(dynamic_nodes.aantal_a_leefgroepen)  # disabled
number_slider_4 = Slider(5, range=0..50)  # disabled
item_3 = ListItem(List=dynamic_nodes.alter_leefgroepen, Index=number_slider_4, Wrap=True)  # disabled
filter = GhPythonScript(v_leefgroep=item_3)  # -> leefgroepen; inputs v_leefgroep: list; disabled
# ---------- filter: Python ----------
__author__ = "Ellen De Sloovere"
__version__ = "2022.07.06"

import rhinoscriptsyntax as rs
leefgroepen = [el for el in v_leefgroep]
# ---------- end filter ----------
panel_6 = Panel(filter)  # disabled
alternatief_1 = CherryPicker(filter, ListIndex=0, TreePath_path="{0;0;0}")  # disabled
alternatief_2 = CherryPicker(filter, ListIndex=1, TreePath_path="{0;0;0}")  # disabled
filter_2 = GhPythonScript(pos=alternatief_1, zitruimte=number_slider_3)  # -> leefgroep, aantal_zitruimtes; inputs zitruimte: Int32; disabled
# ---------- filter_2: Python ----------
__author__ = "Ellen De Sloovere"
__version__ = "2022.07.06"

import rhinoscriptsyntax as rs


leefgroep = [[pos[0], pos[1], pos[2][zitruimte], pos[3]]]

aantal_zitruimtes = len(pos[2])


for index in range(len(pos[3])):
    if isinstance (pos[3][index], set) and  pos[2][zitruimte] in pos[3][index]:
        pos[3][index].remove(pos[2][zitruimte])
    else:
        if pos[3][index] == pos[2][zitruimte]:
            pos[3].pop(index)
# ---------- end filter_2 ----------
mogelijkheden_zitruimte = Panel(filter_2.aantal_zitruimtes)  # disabled
number_slider_5 = Slider(0, range=0..50)  # disabled
filter_3 = GhPythonScript(pos=alternatief_2, zitruimte=number_slider_5)  # -> leefgroep, aantal_zitruimtes; inputs zitruimte: Int32; disabled
# ---------- filter_3: Python ----------
__author__ = "Ellen De Sloovere"
__version__ = "2022.07.06"

import rhinoscriptsyntax as rs

leefgroep = [[pos[0], pos[1], pos[2][zitruimte], pos[3]]]

aantal_zitruimtes = len(pos[2])


print pos[2]
# ---------- end filter_3 ----------
mogelijkheden_zitruimte_2 = Panel(filter_3.aantal_zitruimtes)  # disabled
merge_4 = Merge(Data1=filter_2.leefgroep, Data2=filter_3.leefgroep)  # disabled
pick_3 = GhPythonScript(planN=merge_3, a_leefgroepen=merge_4, tri=pick.n)  # -> flatten(n), l, zit; inputs planN: list, a_leefgroepen: list, tri: list; disabled
# ---------- pick_3: Python ----------
import Rhino.Geometry as rg
import csv
from itertools import *
import klasDefinities
reload(klasDefinities)

from klasDefinities import *

import rhinoscriptsyntax as rs
delta = 0.01
n_ = []
l_ = []
zit = []

for element in a_leefgroepen:
    print element
    tussen_ = []
    
    tussen_.append(element[0])
    tussen_.append(element[1])
    tussen_.append(element[2])
    
    element[0].roomType = 'buitenruimte'
    element[1].roomType =  'tussenruimte'
    element[2].roomType =  'zitruimte'
    
    zit.append(element[2])
    
    l_.append(Edge(element[0], element[1], planN))
    l_.append(Edge(element[0], element[2], planN))
    l_.append(Edge(element[0], tri[2], planN))
    l_.append(Edge(element[0], tri[2], planN))
    
    tussen = []
    for el in element[3]: 
        if isinstance(el, set):
            l = el.copy()
            _list = []
            while l:
                _list.append(l.pop())
            for i in range(len(_list)-1): 
                l_.append(Edge(_list[i], _list[i+1], planN))
                
            af_tussenruimte = []
            af_zitruimte = []
            for  i in _list:
                af_tussenruimte.append(afstand(i, element[0]))
                af_zitruimte.append(afstand(i, element[1]))
                
            for i in range(len(af_tussenruimte)):
                if abs(af_tussenruimte[i] - min(af_tussenruimte)) <= delta: l_.append(Edge(_list[i], element[0], planN))
              

            for i in range(len(af_zitruimte)):
                if abs(af_zitruimte[i] - min(af_zitruimte)) <= delta: l_.append(Edge(_list[i], element[1], planN))
                    
            tussen.append(_list)
            
        else: 
            tussen.append(el)
            l_.append(Edge(el,element[1], planN))


    tussen_.append(tussen)
    for el in tussen:
        if isinstance(el, list):
            for i in el:
                i.roomType = 'private unit'
                
        else:
            el.roomType = 'private unit'
    n_.append(tussen_)
# ---------- end pick_3 ----------

# ---- group: Fase twee
static_2 = GhPythonScript(outside=panel_4, leefgroepen=item_2, beginNodes=pick.n, planNodes=merge_3, bool_muurRel=muurrelatie)  # -> tri_buren, possibilities; inputs beginNodes: list, planNodes: list; disabled
# ---------- static_2: Python ----------
__author__ = "Ellen De Sloovere"
__version__ = "2022.07.06"

import rhinoscriptsyntax as rs
import math
import scriptcontext
import Rhino.Geometry as rg
import ghpythonlib.components as gh
import System
from itertools import *
import copy
import klasDefinities
reload(klasDefinities)

from klasDefinities import *

s = set(getNodes(beginNodes[2].getBuren(bool_muurRel), planNodes))
n_ = set()

if leefgroepen:
    for el in leefgroepen:
        for i in el: 
            if isinstance(i, list): 
                for element in i:
                    if isinstance(element, set):
                        t = element
                        for _ in range(len(element)): 
                            l = t.pop()
                            n_.add(l)
                    else: n_.add(element)
            else: n_.add(i)


if alter_leefgroepen:
    for i in alter_leefgroepen:
        if isinstance(i, list): 
            for element in i:
                if isinstance(element, set):
                    t = element
                    for _ in range(len(element)): 
                        l = t.pop()
                        n_.add(l)
                else: n_.add(element)
        else: n_.add(i)

    
    
tri_buren = []
Tburen = []
for el in s:
    if el not in n_ and el not in beginNodes and el.getRoomType() != outside:
        Tburen.append(el)

print Tburen

if len(Tburen)>= 4: 
    perm = permutations(Tburen, 4)

for el in perm:
    tri_buren.append([element for element in el])

possibilities = len(tri_buren)
# ---------- end static_2 ----------
number_slider_6 = Slider(8, range=0..120)  # disabled
panel_7 = Panel(static_2.tri_buren)  # disabled
item_4 = ListItem(List=static_2.tri_buren, Index=number_slider_6, Wrap=True)  # disabled
possibilities = Panel(static_2.possibilities)  # disabled
pick_4 = GhPythonScript(planN=merge_3, tri_buren=item_4, tri=pick.n)  # -> flatten(n), l; inputs planN: list, tri: list; disabled
# ---------- pick_4: Python ----------
import Rhino.Geometry as rg
import csv
from itertools import *
import klasDefinities
reload(klasDefinities)

from klasDefinities import *

import rhinoscriptsyntax as rs


tri_buren[0].roomType = 'buurtfunctie'
tri_buren[1].roomType = 'bezoekersruimte'
tri_buren[2].roomType = 'dokterskabinet'
tri_buren[3].roomType = 'personeelsruimte'
n_=[tri_buren[0], tri_buren[1],tri_buren[2],tri_buren[3]]
l_ = []
l_.append(Edge(tri_buren[0], tri[2], planN))
l_.append(Edge(tri_buren[1], tri[2], planN))
l_.append(Edge(tri_buren[2], tri[2], planN))
l_.append(Edge(tri_buren[3], tri[2], planN))
# ---------- end pick_4 ----------

# ---- group: Wachtruimte
muurrel = BooleanToggle(True)
star_node = GhPythonScript(planN=merge_3, n_nodes=Slider(4, range=0..20), i=Slider(13, range=0..27), n_connect=Slider(1, range=0..20), pos=muurrel)  # -> graphlets, i_graphlet_seed, i_connect, possibilities, visual, data_tracker; inputs planN: list, data_nodes: list, connect: list, i: Int32; disabled
# ---------- star_node: Python ----------
__author__ = "Ellen De Sloovere"
__version__ = "2022.07.29"

import Rhino.Geometry as rg
import ghpythonlib.components as gh
from klasDefinities import *
import scriptcontext
import klasDefinities
reload(klasDefinities)

import rhinoscriptsyntax as rs
data_tracker = []
graphlets = []

for el in planN:
    if el.getNodeDegree(pos) >= n_nodes:
        if connect:
            over = []
            for n in connect[2]:
                if n in set(getNodes(el.getBuren(pos),planN)) and n.status == False:
                    over.append(n)
            if len(over) >= connect[1]: graphlets.append(el)
        else: graphlets.append(el)

possibilities = len(graphlets)
i_graphlet_seed = graphlets[i]
i_graphlet_seed.status == True
l = [el for el in getNodes(i_graphlet_seed.getBuren(pos), planN)]
i_connect = ((i_graphlet_seed, n_connect, l))
visual = rg.Polyline(i_graphlet_seed.getGeo(),)

data_tracker = [] +  data_nodes
data_tracker.append(i_graphlet_seed)
data_tracker += l


"""

l = [el for el in getNodes(i_graphlet_seed.getBuren(), planN)]
i_connect = ((i_graphlet_seed, n_connect, l))

visual = i_graphlet_seed.refgeo

data_tracker += l + [i_graphlet_seed]
"""
# ---------- end star_node ----------
possibilites = Panel(star_node.possibilities)
python = GhPythonScript(x=star_node.i_graphlet_seed)  # -> out, a; inputs x: list; disabled
# ---------- python: Python ----------
__author__ = "info"
__version__ = "2022.08.07"

import Rhino.Geometry as rg
import ghpythonlib.components as gh
from klasDefinities import *
import scriptcontext
import klasDefinities
reload(klasDefinities)

a = []
for el in x: a.append(el.getGeo())
# ---------- end python ----------
pline = PolyLine(Vertices=star_node.visual, Closed=False)  # disabled
swatch_2 = ColourSwatch(SwatchColor=RGB(171, 63, 63))  # disabled
panel_8 = Panel(star_node.graphlets)  # disabled
panel_9 = Panel(star_node.i_graphlet_seed)  # disabled
srf_2 = Surface(pline)  # disabled
srf_3 = Surface(python.a)  # disabled
preview_2 = CustomPreview(Geometry=srf_2, Material=swatch_2)  # disabled
panel_10 = Panel(python.a)  # disabled

# ---- group: Fase drie / visuele voorstelling edges/nodes en tekst
merge_5 = Merge(Data1=pick.n, Data2=pick_2.n, Data3=pick_4.n, Data4=pick_3.n)  # -> flatten(Result); disabled
merge_6 = Merge(Data1=pick.l, Data2=pick_2.l, Data3=pick_4.l, Data5=pick_3.l)  # -> flatten(Result); disabled
text_height = Slider(0.579, range=0..1)  # disabled

# ---- group: Fase drie / leefgroep 2
item_5 = CherryPicker(filter, ListIndex=0, TreePath_path="{0;0;0}")  # disabled
filter_4 = GhPythonScript(leefgroep=item_5)  # -> ruimtes; disabled
# ---------- filter_4: Python ----------
__author__ = "Ellen De Sloovere"
__version__ = "2022.07.06"

import rhinoscriptsyntax as rs
print leefgroep
ruimtes = [el for el in leefgroep]
print ruimtes
# ---------- end filter_4 ----------
item_6 = CherryPicker(filter_4, ListIndex=0, TreePath_path="{0;0}")  # disabled
item_7 = CherryPicker(filter_4, ListIndex=1, TreePath_path="{0;0}")  # disabled
item_8 = CherryPicker(filter_4, ListIndex=2, TreePath_path="{0;0}")  # disabled
item_9 = CherryPicker(filter_4, ListIndex=3, TreePath_path="{0;0}")  # disabled

# ---- group: Fase drie / leefgroep 1
item_10 = CherryPicker(pick_2.n, ListIndex=0, TreePath_path="{0}")  # disabled
filter_5 = GhPythonScript(leefgroep=item_10)  # -> ruimtes; disabled; same code as filter_4
item_11 = CherryPicker(filter_5, ListIndex=0, TreePath_path="{0;0}")  # disabled
item_12 = CherryPicker(filter_5, ListIndex=1, TreePath_path="{0;0}")  # disabled
item_13 = CherryPicker(filter_5, ListIndex=2, TreePath_path="{0;0}")  # disabled

# ---- group: Fase drie / triage buren_statisch
visueel_2 = GhPythonScript(planNodes=merge_3, knopen=pick_4.n)  # -> flatten(visueel); inputs planNodes: list, knopen: list; disabled
# ---------- visueel_2: Python ----------
__author__ = "Ellen De Sloovere"
__version__ = "2022.05.10"

import rhinoscriptsyntax as rs
import math
import scriptcontext
import Rhino.Geometry as rg
import ghpythonlib.components as gh
import System
import klasDefinities
reload(klasDefinities)

from klasDefinities import *
from decimal import *


#afwijking = '%.3f' % (sum(el for el in afw)/len(knopen)),  tuple('%.3f' % el for el in afw)
idKnopen = knopen
print knopen

visueel = []
for el in knopen:
    if isinstance(el, list) or isinstance(el, tuple):
        for i in el:
            if isinstance(i, list) or isinstance(i, tuple):
                for k in i:
                    visueel.append(k.getGeo())
            else:
                visueel.append(i.getGeo())
    else:
         visueel.append(el.getGeo())
# ---------- end visueel_2 ----------
swatch_3 = ColourSwatch(SwatchColor=RGBA(156, 0, 93, 135))  # disabled
srf_4 = Surface(visueel_2)  # disabled
preview_3 = CustomPreview(Geometry=srf_4, Material=swatch_3)  # disabled

# ---- group: Fase drie / visuele voorstelling edges/nodes en tekst
graph = GhPythonScript(nodes=merge_5, edges=merge_6, H=text_height)  # -> l, n, n_list; inputs nodes: list, edges: list; disabled
# ---------- graph: Python ----------
__author__ = "Ellen De Sloovere"
__version__ = "2022.06.22"

import rhinoscriptsyntax as rs
import math
import scriptcontext
import Rhino.Geometry as rg
import ghpythonlib.components as gh
import System
import klasDefinities
reload(klasDefinities)
from klasDefinities import *

scriptcontext.doc = Rhino.RhinoDoc.ActiveDoc
klasDefinities.deleteLayer('Text')
klasDefinities.addRhinoLayer('Text')

scriptcontext.doc = ghdoc
n_ = []
n_list = []
text = []


for el in nodes:
    if isinstance(el, list) or isinstance(el, tuple): 
        for i in el:
            if isinstance(i, list):
                for k in i: 
                    if isinstance(k, list):
                        for element in k:
                            n_list.append(element)
                            n_.append(rs.AddCircle(element.getGeo().CenterPoint(), float(element.opp)/100))
                            scriptcontext.doc = Rhino.RhinoDoc.ActiveDoc
                            rs.AddText(element.roomType, element.getGeo().CenterPoint(), H)
                            scriptcontext.doc = ghdoc
                    else:
                        n_list.append(k)
                        n_.append(rs.AddCircle(k.getGeo().CenterPoint(), float(k.opp)/100))
                        scriptcontext.doc = Rhino.RhinoDoc.ActiveDoc
                        rs.AddText(k.roomType, k.getGeo().CenterPoint(), H)
                        scriptcontext.doc = ghdoc
            else: 
                n_list.append(i)
                n_.append(rs.AddCircle(i.getGeo().CenterPoint(), float(i.opp)/100))
                scriptcontext.doc = Rhino.RhinoDoc.ActiveDoc
                rs.AddText(i.roomType, i.getGeo().CenterPoint(), H)
                scriptcontext.doc = ghdoc
    else: 

        n_list.append(el)
        geo = el.getGeo().ToNurbsCurve()
        test, f = geo.TryGetPolyline()
        n_.append(rs.AddCircle(f.CenterPoint(), float(el.opp)/100))
        scriptcontext.doc = Rhino.RhinoDoc.ActiveDoc
        rs.AddText(el.roomType, f.CenterPoint(), H)
        scriptcontext.doc = ghdoc
        


                
l_ = []
for el in edges:
    if el.prv() != el.nxt():
        l_.append(rs.AddLine(el.prv().getGeo().CenterPoint(), el.nxt().getGeo().CenterPoint()))
    
    
    """if not isinstance(el.edge[0], polyline):
        geo1 = el.prv().getGeo()
        test1,pl1 = geo.TryGetPolyline()
    else:
        pl1 = el.edge[0].getGeo()
        
    if not isinstance(el.edge[1], polyline):
        geo2 = el.nxt().getGeo()
        test2,pl2 = geo.TryGetPolyline()
    else:
        pl2 = el.edge[1].getGeo()
        
    geo1 = el.edge[0].getGeo().ToNurbsCurve().ToPolyline()
    geo2 = el.edge[1].getGeo().ToNurbsCurve().ToPolyline()"""
# ---------- end graph ----------
swatch_4 = ColourSwatch(SwatchColor=RGB(161, 3, 3))  # disabled
geo = Geometry(graph.n)  # disabled
geo_2 = Geometry(graph.l)  # disabled
preview_4 = CustomPreview(Geometry=geo_2, Material=swatch_4)  # disabled
preview_5 = CustomPreview(Geometry=geo, Material=swatch_4)  # disabled

# ---- group: Fase twee
merge_7 = Merge(Data1=pick_2.zit, Data2=flatten(pick_3.zit))  # disabled
static_3 = GhPythonScript(outside=panel_4, zitruimtes=flatten(merge_7), beginNodes=graph.n_list, planNodes=merge_3)  # -> zit_buren, zit; inputs zitruimtes: list, beginNodes: list, planNodes: list; disabled
# ---------- static_3: Python ----------
__author__ = "Ellen De Sloovere"
__version__ = "2022.05.10"

import rhinoscriptsyntax as rs
import math
import scriptcontext
import Rhino.Geometry as rg
import ghpythonlib.components as gh
import System
from itertools import *
import copy
import klasDefinities
reload(klasDefinities)
from klasDefinities import *

def TimeConsumingTask():    
    for i in range(30000):
        # Was escape key pressed?
        if (scriptcontext.escape_test(False)):
            print "TimeConsumingTask cancelled."
            break

TimeConsumingTask()

for el in beginNodes: el.changeType(True)
s = set(beginNodes)

nodes = []
for el in zitruimtes:
    n = []
    for i in getNodes(el.getBuren(True), planNodes):
        if i not in s and i.getRoomType() != outside:
            n.append(i)
            
    nodes.append(n)
    
nodes_c = [int(4 -len(el)) for el in nodes]

available_rooms = []
for el in planNodes:
    if el.getType() == False and i.getRoomType() != outside: available_rooms.append(el)
    

ruimtes = []
scores = []
for index in range(len(zitruimtes)):
    if nodes_c[index] <= 0:
        print nodes_c
        print nodes
        scores.append(1)
        ruimte = []
        perm = permutations(nodes[index], 4)
        for el in perm:
            ruimte.append([element for element in el])
        ruimtes.append(ruimte)
        
    else:
        ruimte = [el for el in nodes[index]]
        paths = []
        for el in available_rooms:
            if el.getType() == False:
                n = Neighborhood(zitruimtes[index], 3 , planNodes)
                p = find_shortest_path(n, zitruimtes[index], el)
                if p:
                    paths.append((el, p))
            
        
        
        k = sorted(paths, key = lambda x: len(x[1]))
        for i in range(nodes_c[index]):
            ruimte.append(k[i][1])
            for f in k[i][1]:
                f.changeType(True)
                
        ruimtes.append(ruimte)


zit_buren = ruimtes
print zit_buren


#zit_buren = [el.getGeo() for el in ruimtes[0]]
"""zit_buren = []
for element in ruimtes:
    zit_buren += [el.getGeo() for el in element]"""
    
    
"""

pos = []
for path in paths:
    cond = False
    for no in path[1]:
        if no.getType() == True: cond = True
        
    if cond == False: pos.append(path)
    
print pos
"""
# ---------- end static_3 ----------
panel_11 = Panel(static_3.zit_buren)  # disabled
pick_5 = GhPythonScript(planN=merge_3, zit_ruimtes=flatten(merge_7), zit_buren=static_3.zit_buren)  # -> flatten(n), flatten(l); inputs planN: list, zit_ruimtes: list, zit_buren: list; disabled
# ---------- pick_5: Python ----------
import Rhino.Geometry as rg
import csv
from itertools import *
import klasDefinities
reload(klasDefinities)

from klasDefinities import *
import rhinoscriptsyntax as rs

print zit_ruimtes
n_ = []
l_ = []

for ind in range(len(zit_buren)):
    if isinstance(zit_buren[ind], tuple):
        zit_buren[ind][0].roomType = 'sportruimte'
        zit_buren[ind][1].roomType = 'keuken'
        zit_buren[ind][2].roomType = 'wasruimte'
        zit_buren[ind][3].roomType = 'time out - ruimte'
        
        l_ += Edge(zit_ruimtes[ind], zit_buren[ind][0])
        l_ += Edge(zit_ruimtes[ind], zit_buren[ind][1])
        l_ += Edge(zit_ruimtes[ind], zit_buren[ind][2])
        l_ += Edge(zit_ruimtes[ind], zit_buren[ind][3])
        
    else:
        for el in zit_buren[ind]:
            if isinstance(el, list):
                n_.append(el[-1])
                l_.append(Edge(el[0], zit_ruimtes[ind], planN))
                for index in range(len(el)-1):
                    l_.append(Edge(el[index], el[index +1], planN))
                    n_.append(el[index])
            else:
                n_.append(el)
                l_ .append(Edge(el, zit_ruimtes[ind], planN))
# ---------- end pick_5 ----------

# ---- group: Fase drie / visuele voorstelling edges/nodes en tekst
visual = GhPythonScript(nodes=pick_5.n, edges=pick_5.l, H=text_height)  # -> l, n, n_list; inputs nodes: list, edges: list; disabled
# ---------- visual: Python ----------
__author__ = "Ellen De Sloovere"
__version__ = "2022.08.05"

import rhinoscriptsyntax as rs
import math
import scriptcontext
import Rhino.Geometry as rg
import ghpythonlib.components as gh
import System
import klasDefinities
reload(klasDefinities)
from klasDefinities import *

n_ = []
n_list = []
text = []


for el in nodes:
        n_list.append(el)
        geo = el.getGeo().ToNurbsCurve()
        test, f = geo.TryGetPolyline()
        n_.append(rs.AddCircle(f.CenterPoint(), float(el.opp)/100))
        scriptcontext.doc = Rhino.RhinoDoc.ActiveDoc
        rs.AddText(el.roomType, f.CenterPoint(), H)
        scriptcontext.doc = ghdoc
        
l_ = []
for el in edges:
    if el.prv() != el.nxt():
        l_.append(rs.AddLine(el.prv().getGeo().CenterPoint(), el.nxt().getGeo().CenterPoint()))
# ---------- end visual ----------
swatch_5 = ColourSwatch(SwatchColor=RGB(3, 71, 161))  # disabled
geo_3 = Geometry(visual.n)  # disabled
geo_4 = Geometry(visual.l)  # disabled
preview_6 = CustomPreview(Geometry=geo_3, Material=swatch_5)  # disabled
preview_7 = CustomPreview(Geometry=geo_4, Material=swatch_5)  # disabled

# ----
merge_8 = Merge(Data1=graph.n_list, Data2=visual.n_list)  # -> flatten(Result); disabled

# ---- group: Fase drie / score afwijking
type = Slider(3, range=1..3)  # disabled
detentietype = Panel("""1: open
2: half-open
3: gesloten""")  # disabled
divrooms = GhPythonScript(detentieType=type)  # -> deviatie; inputs detentieType: Int32; disabled
# ---------- divrooms: Python ----------
__author__ = "Ellen De Sloovere"
__version__ = "2022.09.05"

import Rhino.Geometry as rg
import csv
import klasDefinities
reload(klasDefinities)

from klasDefinities import *


if detentieType == 1:
    deviatie = {'zitruimte' : (26, 5.91), 'eetruimte' : (26, 9.61), 'keuken' : (16, 3.34),  'keukenberging' : (8, 2.98),  'wasruimte' : (15, 4.44), 'sportruimte' : (22, 10.45), 'private unit' : (25, 0), 'private buitenruimte' : (5, 0), 'time out - ruimte' : (25, 0), 'buitenruimte' : (220, 0), 'inkom' : (45, 15.62), 'tocht- /veiligheidssas' :  (7, 0.84), 'toillet bezoekers' : (5, 0.7), 'wachtruimte' : (16, 4.13), 'administratieruimte' : (17, 7.11), 'controle - handscanner' : (7, 3.16), 'fouilleerruimte' : (5, 1.5), 'triagepunt' : (160, 102.31), 'personeelsruimte' : (100, 0), 'dokterskabinet' : (17, 3.23), 'bezoekersruimte' : (60, 0), 'buurtfunctie' : (900, 791.76)}


elif detentieType == 2:
    deviatie = {'zitruimte' : (26, 5.37), 'eetruimte' : (26, 5.87),  'keuken' : (17, 4.37), 'keukenberging' : (8, 0.68), 'wasruimte' : (15, 4.14), 'sportruimte' : (25, 15.08), 'private unit' : (30, 0), 'private buitenruimte' : (7, 0), 'time out - ruimte' : (30, 0), 'buitenruimte' : (600, 0), 'inkom' : (45, 15.62), 'tocht- /veiligheidssas' :  (7, 0.84), 'toillet bezoekers' : (5, 0.7), 'wachtruimte' : (16, 4.13), 'administratieruimte' : (17, 7.11), 'controle - handscanner' : (7, 3.16), 'fouilleerruimte' : (5, 1.5), 'triagepunt' : (160, 102.31), 'personeelsruimte' : (100, 0), 'dokterskabinet' : (17, 3.23), 'bezoekersruimte' : (60, 0), 'buurtfunctie' : (900, 791.76)}

else:  
    deviatie = {'zitruimte' : (30, 6.95),  'eetruimte' : (27, 7.23), 'keuken' : (18, 5.04), 'keukenberging' : (8, 0.87), 'wasruimte' : (15, 3.85), 'sportruimte' : (29, 13.98), 'private unit' : (34, 0), 'private buitenruimte' : (9, 0), 'time out - ruimte' : (34, 0), 'buitenruimte' : (930, 0), 'inkom' : (45, 15.62), 'tocht- /veiligheidssas' :  (7, 0.84), 'toillet bezoekers' : (5, 0.7), 'wachtruimte' : (16, 4.13), 'administratieruimte' : (17, 7.11), 'controle - handscanner' : (7, 3.16), 'fouilleerruimte' : (5, 1.5), 'triagepunt' : (160, 102.31), 'personeelsruimte' : (100, 0), 'dokterskabinet' : (17, 3.23), 'bezoekersruimte' : (60, 0), 'buurtfunctie' : (900, 791.76)}

deviatie = Dic(deviatie)
# ---------- end divrooms ----------
total_deviatie = GhPythonScript(planN=merge_3, nodes=merge_8, dev_book=divrooms)  # -> total, tot2, c, distri; inputs planN: list, nodes: list; disabled
# ---------- total_deviatie: Python ----------
__author__ = "Ellen De Sloovere"
__version__ = "2022.06.22"

import rhinoscriptsyntax as rs
import math
import scriptcontext
import Rhino.Geometry as rg
import ghpythonlib.components as gh
import System
import klasDefinities
reload(klasDefinities)

from klasDefinities import *

deviatie = dev_book.getDictionary()
afwijking = []

for el in nodes:
    if el.roomType in deviatie: 
        stand, afw = deviatie[el.roomType]
        nodeOpp = el.getOpp()
        ondergrens = stand*(1-afw)
        bovengrens = stand*(1+afw)
            
        if ondergrens <= nodeOpp <= bovengrens: afwijking.append((el.identifier, el.roomType, 1))
        elif bovengrens <= nodeOpp: 
            if 1-((nodeOpp-bovengrens)/(2*ondergrens)) < 0 or 1-((nodeOpp-bovengrens)/(2*ondergrens)) > 1:
                afwijking.append((el.identifier, el.roomType, 0))
                
            else:
                afwijking.append((el.identifier, el.roomType, (1-((nodeOpp-bovengrens)/(2*ondergrens)))))
        else:
            afwijking.append((el.identifier, el.roomType, nodeOpp/ondergrens))
    else:
        afwijking.append((el.identifier, el.roomType, 0))

tot2 =  tuple((el[0], el[1], '%.3f' % el[2]) for el in afwijking)
total = '%.3f' % (sum(el[2] for el in afwijking)/len(nodes))



c= []
distri = []
for el in nodes:
    muur = []
    for i in getNodes(el.muurRel, planN):
        if i in nodes: muur.append(i.getID())
        
    deur = []
    for i in getNodes(el.deurRel, planN):
        if i in nodes: deur.append(i.getID())
        
    distri.append(len(muur) +len(deur))
    c.append('{},{},{},{},{},{}'.format(el.identifier, el.getRoomType(), el.getOpp(), muur, deur, el.buitenRel))
# ---------- end total_deviatie ----------
afwijking_per_ruimte = Panel(total_deviatie.tot2)  # disabled
nodes = Panel(merge_5)  # disabled

# ----
number_slider_7 = Slider(0, range=0..20)  # disabled
number_slider_8 = Slider(2, range=0..20)  # disabled
number_slider_9 = Slider(9, range=0..20)  # disabled
star_node_2 = GhPythonScript(n_nodes=number_slider_9, connect=star_node.i_graphlet_seed, i=number_slider_7, n_connect=number_slider_8)  # -> st, graphlets, i_graphlet_seed, i_connect, possibilities, visual, data_tracker; inputs planN: list, data_nodes: list, connect: list, i: Int32; disabled
# ---------- star_node_2: Python ----------
__author__ = "Ellen De Sloovere"
__version__ = "2022.07.29"

import Rhino.Geometry as rg
import ghpythonlib.components as gh




from klasDefinities import *
import scriptcontext
import klasDefinities
reload(klasDefinities)

import rhinoscriptsyntax as rs
data_tracker = []
graphlets = []

for el in planN:
    if el.getNodeDegree() >= n_nodes:
        
        condition = True
        for n in connect:
            if n not in set(getNodes(el.getBuren(),planN)):
                condition = False
        if condition == True: graphlets.append(el)

possibilities = len(graphlets)

i_graphlet_seed = graphlets[i]
l = [el for el in getNodes(i_graphlet_seed.getBuren(), planN)]
i_connect = ((i_graphlet_seed, n_connect, l))

visual = i_graphlet_seed.refgeo

data_tracker += l + [i_graphlet_seed]
# ---------- end star_node_2 ----------
possibilites_2 = Panel(star_node_2.possibilities)  # disabled
panel_12 = Panel(star_node_2.i_connect)  # disabled
panel_13 = Panel(star_node_2.graphlets)  # disabled
panel_14 = Panel(star_node_2.i_graphlet_seed)  # disabled

number_slider_10 = Slider(0, range=0..20)  # disabled
number_slider_11 = Slider(2, range=0..20)  # disabled
number_slider_12 = Slider(5, range=0..20)  # disabled
star_node_3 = GhPythonScript(n_nodes=number_slider_12, connect=star_node.i_graphlet_seed, i=number_slider_10, n_connect=number_slider_11)  # -> st, graphlets, i_graphlet_seed, i_connect, possibilities, visual, data_tracker; inputs planN: list, data_nodes: list, connect: list, i: Int32; disabled; same code as star_node_2
possibilites_3 = Panel(star_node_3.possibilities)  # disabled
panel_15 = Panel(star_node_3.i_connect)  # disabled
panel_16 = Panel(star_node_3.graphlets)  # disabled
panel_17 = Panel(star_node_3.i_graphlet_seed)  # disabled

# ---- group: Fase drie
totale_afwijking = Panel(total_deviatie.total)  # disabled

# ---- group: Fase drie / leefgroep 1
visueel_3 = GhPythonScript(planNodes=merge_3, knopen=item_13)  # -> flatten(visueel); inputs planNodes: list, knopen: list; disabled
# ---------- visueel_3: Python ----------
__author__ = "Ellen De Sloovere"
__version__ = "2022.05.10"

import rhinoscriptsyntax as rs
import math
import scriptcontext
import Rhino.Geometry as rg
import ghpythonlib.components as gh
import System
import klasDefinities
reload(klasDefinities)

from klasDefinities import *
from decimal import *


#afwijking = '%.3f' % (sum(el for el in afw)/len(knopen)),  tuple('%.3f' % el for el in afw)
idKnopen = knopen
print knopen

visueel = []
for el in knopen:
    if isinstance(el, list):
        for i in el:
            if isinstance(i, list):
                for k in i:
                    visueel.append(k.getGeo())
            else:
                visueel.append(i.getGeo())
    else:
         visueel.append(el.getGeo())
# ---------- end visueel_3 ----------
swatch_6 = ColourSwatch(SwatchColor=RGBA(0, 156, 86, 135))  # disabled
srf_5 = Surface(visueel_3)  # disabled
preview_8 = CustomPreview(Geometry=srf_5, Material=swatch_6)  # disabled

visueel_4 = GhPythonScript(planNodes=merge_3, knopen=item_12)  # -> flatten(visueel), idKnopen, afwijking; inputs planNodes: list, knopen: list; disabled; same code as visueel
swatch_7 = ColourSwatch(SwatchColor=RGBA(133, 15, 0, 135))  # disabled
srf_6 = Surface(visueel_4.visueel)  # disabled
preview_9 = CustomPreview(Geometry=srf_6, Material=swatch_7)  # disabled

visueel_5 = GhPythonScript(planNodes=merge_3, knopen=item_11)  # -> flatten(visueel); inputs planNodes: list, knopen: list; disabled; same code as visueel
swatch_8 = ColourSwatch(SwatchColor=RGBA(0, 41, 156, 135))  # disabled
srf_7 = Surface(visueel_5)  # disabled
preview_10 = CustomPreview(Geometry=srf_7, Material=swatch_8)  # disabled

# ---- group: Fase drie / leefgroep 2 / units
swatch_9 = ColourSwatch(SwatchColor=RGBA(52, 156, 0, 173))  # disabled
visueel_6 = GhPythonScript(planNodes=merge_3, knopen=item_9)  # -> flatten(visueel), pos; inputs planNodes: list, knopen: list; disabled
# ---------- visueel_6: Python ----------
__author__ = "Ellen De Sloovere"
__version__ = "2022.05.10"

import rhinoscriptsyntax as rs
import math
import scriptcontext
import Rhino.Geometry as rg
import ghpythonlib.components as gh
import System
import klasDefinities
reload(klasDefinities)

from klasDefinities import *
from decimal import *


#afwijking = '%.3f' % (sum(el for el in afw)/len(knopen)),  tuple('%.3f' % el for el in afw)
idKnopen = knopen
print knopen

visueel = []
for el in knopen:
    if isinstance(el, list):
        for i in el:
            if isinstance(i, list):
                for k in i:
                    visueel.append(k.getGeo())
            elif isinstance(i, set):
                for k in i: visueel.append(k.getGeo())
                
            else:
                visueel.append(i.getGeo())
    else:
         visueel.append(el.getGeo())
# ---------- end visueel_6 ----------
srf_8 = Surface(visueel_6.visueel)  # disabled
preview_11 = CustomPreview(Geometry=srf_8, Material=swatch_9)  # disabled

# ---- group: Fase drie / leefgroep 2 / tussenruimte
visueel_7 = GhPythonScript(planNodes=merge_3, knopen=item_7)  # -> flatten(visueel), idKnopen, afwijking; inputs planNodes: list, knopen: list; disabled; same code as visueel
swatch_10 = ColourSwatch(SwatchColor=RGBA(133, 15, 0, 135))  # disabled
srf_9 = Surface(visueel_7.visueel)  # disabled
preview_12 = CustomPreview(Geometry=srf_9, Material=swatch_10)  # disabled

# ---- group: Fase drie / leefgroep 2 / buitenruimte
visueel_8 = GhPythonScript(planNodes=merge_3, knopen=item_6)  # -> flatten(visueel); inputs planNodes: list, knopen: list; disabled; same code as visueel
swatch_11 = ColourSwatch(SwatchColor=RGB(26, 143, 0))  # disabled
srf_10 = Surface(visueel_8)  # disabled
preview_13 = CustomPreview(Geometry=srf_10, Material=swatch_11)  # disabled

# ---- group: Fase drie / leefgroep 2
item_14 = CherryPicker(pick_2.n, ListIndex=1, TreePath_path="{0}")  # disabled
filter_6 = GhPythonScript(leefgroep=item_14)  # -> ruimtes; disabled; same code as filter_4
item_15 = CherryPicker(filter_6, ListIndex=0, TreePath_path="{0;0}")  # disabled
item_16 = CherryPicker(filter_6, ListIndex=1, TreePath_path="{0;0}")  # disabled
item_17 = CherryPicker(filter_6, ListIndex=2, TreePath_path="{0;0}")  # disabled

visueel_9 = GhPythonScript(planNodes=merge_3, knopen=item_16)  # -> flatten(visueel), idKnopen, afwijking; inputs planNodes: list, knopen: list; disabled; same code as visueel
swatch_12 = ColourSwatch(SwatchColor=RGBA(133, 15, 0, 135))  # disabled
srf_11 = Surface(visueel_9.visueel)  # disabled
preview_14 = CustomPreview(Geometry=srf_11, Material=swatch_12)  # disabled

visueel_10 = GhPythonScript(planNodes=merge_3, knopen=item_15)  # -> flatten(visueel); inputs planNodes: list, knopen: list; disabled; same code as visueel
swatch_13 = ColourSwatch(SwatchColor=RGBA(0, 41, 156, 135))  # disabled
srf_12 = Surface(visueel_10)  # disabled
preview_15 = CustomPreview(Geometry=srf_12, Material=swatch_13)  # disabled

visueel_11 = GhPythonScript(planNodes=merge_3, knopen=item_17)  # -> flatten(visueel); inputs planNodes: list, knopen: list; disabled; same code as visueel_3
swatch_14 = ColourSwatch(SwatchColor=RGBA(0, 156, 86, 135))  # disabled
srf_13 = Surface(visueel_11)  # disabled
preview_16 = CustomPreview(Geometry=srf_13, Material=swatch_14)  # disabled

# ----
number_slider_13 = Slider(2, range=0..20)  # disabled
number_slider_14 = Slider(3, range=0..20)  # disabled
number_slider_15 = Slider(4, range=0..20)  # disabled
star_node_4 = GhPythonScript(
    data_nodes=star_node_2.data_tracker,
    n_nodes=number_slider_15,
    connect=star_node_2.i_graphlet_seed,
    i=number_slider_13,
    n_connect=number_slider_14)  # -> st, graphlets, i_graphlet_seed, i_connect, possibilities, visual, data_tracker; inputs planN: list, connect: list, i: Int32; disabled; same code as star_node_2
possibilites_4 = Panel(star_node_4.possibilities)  # disabled
panel_18 = Panel(star_node_4.i_connect)  # disabled
panel_19 = Panel(star_node_4.graphlets)  # disabled
panel_20 = Panel(star_node_4.i_graphlet_seed)  # disabled

number_slider_16 = Slider(0, range=0..20)  # disabled
number_slider_17 = Slider(2, range=0..20)  # disabled
number_slider_18 = Slider(9, range=0..20)  # disabled
star_node_5 = GhPythonScript(n_nodes=number_slider_18, i=number_slider_16, n_connect=number_slider_17)  # -> graphlets, i_graphlet_seed, i_connect, possibilities, visual; inputs planN: list, connect: list, i: Int32; disabled
# ---------- star_node_5: Python ----------
__author__ = "Ellen De Sloovere"
__version__ = "2022.07.29"

import Rhino.Geometry as rg
import ghpythonlib.components as gh




from klasDefinities import *
import scriptcontext
import klasDefinities
reload(klasDefinities)

import rhinoscriptsyntax as rs

graphlets = []

for el in planN:
    if el.getNodeDegree() >= n_nodes:
        
        condition = True
        for n in connect:
            if n not in set(getNodes(el.getBuren(),planN)):
                condition = False
        if condition == True: graphlets.append(el)

possibilities = len(graphlets)

i_graphlet_seed = graphlets[i]
l = [el for el in getNodes(i_graphlet_seed.getBuren(), planN)]
i_connect = ((i_graphlet_seed, n_connect, l))

visual = i_graphlet_seed.refgeo
# ---------- end star_node_5 ----------
possibilites_5 = Panel(star_node_5.possibilities)  # disabled
panel_21 = Panel(star_node_5.graphlets)  # disabled
panel_22 = Panel(star_node_5.i_graphlet_seed)  # disabled

# ---- group: edge score
edge_score = GhPythonScript(planN=merge_3, l=merge_6, shortest_path=static_3.zit_buren)  # -> score; inputs planN: list, l: list; disabled
# ---------- edge_score: Python ----------
__author__ = "info"
__version__ = "2022.08.01"

import rhinoscriptsyntax as rs
import math
import scriptcontext
import Rhino.Geometry as rg
import ghpythonlib.components as gh
import System
import klasDefinities
reload(klasDefinities)
from klasDefinities import *
for el in shortest_path:
    if 
score = sum(el.getType() for el in l_)/len(l_)
# ---------- end edge_score ----------
edge_score_2 = Panel(edge_score)  # disabled

# ---- group: planar graphs original
panel_23 = Panel("""True
False
False""")  # disabled
# pas de kleur van bollen en verbindingen aan naar het type ruimte/ verbinding
hoogte_verdiepen = Panel("""0
3
6""")  # disabled
pt = Point([Point(264.7557839, -168.2297105, 0), Point(233.7605991, -207.6793899, 0), Point(226.1371941, -149.6819029, 0)])  # disabled
merge_9 = Merge()  # disabled
item_18 = ListItem(List=pt, Index=0, Wrap=True)  # disabled
lng = ListLength(List=merge_9)  # disabled
repeat = RepeatData(Data=panel_23, Length=lng)  # disabled
cull = CullPattern(List=merge_9, CullPattern=repeat)  # disabled
pt_2 = Point(cull)  # disabled
planar_graph = GhPythonScript(nodes=merge_3, height_floors=hoogte_verdiepen, n_ref_point=item_18, o_ref_points=pt_2)  # -> planar_graph; inputs nodes: list, height_floors: list, n_ref_point: Point3d, o_ref_points: list of Point3d; disabled
# ---------- planar_graph: Python ----------
__author__ = "Ellen De Sloovere"
__version__ = "2022.07.22"

import rhinoscriptsyntax as rs
import math
import scriptcontext
import Rhino.Geometry as rg
import ghpythonlib.components as gh
import System
import klasDefinities
reload(klasDefinities)

from klasDefinities import *

scriptcontext.doc = Rhino.RhinoDoc.ActiveDoc
klasDefinities.deleteLayer('Planar_layer')
klasDefinities.addRhinoLayer('Planar_layer')
scriptcontext.doc = ghdoc

n_ = [] 
l_ = []

for el in nodes:
    #planar nodes opstellen
    trans = rg.Point3d(n_ref_point[0] - o_ref_points[el.identifier[0]][0], n_ref_point[1] - o_ref_points[el.identifier[0]][1], sum(height_floors[0:el.identifier[0]+1]))
    p1 = rg.Point3d(el.getGeo().CenterPoint()[0] + trans[0], el.getGeo().CenterPoint()[1] + trans[1], trans[2])
    el.plan_vis = p1, float(el.opp)/100
    
    
    #3d edges
        
for el in nodes:
    buren = getNodes(el.getBuren(), nodes)
    n_.append(rs.AddSphere(el.plan_vis[0], el.plan_vis[1]))
    for el2 in buren:
        l_.append(rs.AddLine(el.plan_vis[0], el2.plan_vis[0]))

planar_graph = [] + n_ + l_
# ---------- end planar_graph ----------
swatch_15 = ColourSwatch(SwatchColor=RGBA(255, 255, 255, 0))  # disabled
geo_5 = Geometry(planar_graph)  # disabled
preview_17 = CustomPreview(Geometry=geo_5, Material=swatch_15)  # disabled

# ---- group: CSV
csv_header = Panel("NodeId,NodeType,Area,WallRelation,DoorRelation,AirRelation")  # disabled
csv_values = Panel(total_deviatie.c)  # disabled
merge_10 = Merge(Data1=csv_header, Data2=csv_values)  # disabled
csv = Panel(merge_10)  # disabled

# ---- group: omgevingsrelatie score
relatie_buiten_score = GhPythonScript(n=graph.n_list)  # -> score, zonder_buiten; inputs n: list; disabled
# ---------- relatie_buiten_score: Python ----------
__author__ = "info"
__version__ = "2022.08.01"

import rhinoscriptsyntax as rs
import math
import scriptcontext
import Rhino.Geometry as rg
import ghpythonlib.components as gh
import System
import klasDefinities
reload(klasDefinities)
from klasDefinities import *
nn = ['controle - handscanner',
'toillet bezoekers','fouilleerruimte','inkom','keukenberging','wasruimte','keukenberging']

    
score = 0
niet = 0
zonder_buiten = []
for el in n_:
    if not el.getRoomType() in nn: 
        if el.heeftRaam(): score +=1
        else: 
            score += 0
            zonder_buiten.append((el.getID(), el.getRoomType()))
    else: niet += 1
    
    

 
score /= (len(n_)-niet)
# ---------- end relatie_buiten_score ----------
panel_24 = Panel(relatie_buiten_score.score)  # disabled
panel_25 = Panel(relatie_buiten_score.zonder_buiten)  # disabled

# ----
panel_26 = Panel(star_node_5.visual)  # disabled

# ---- group: Possible node distribution
node_distri_pos = GhPythonScript(nodes=merge_3)  # -> distribution; inputs nodes: list; disabled
# ---------- node_distri_pos: Python ----------
__author__ = "Ellen De Sloovere"
__version__ = "2022.07.22"

import rhinoscriptsyntax as rs
import math
import scriptcontext
import Rhino.Geometry as rg
import ghpythonlib.components as gh
import System
import klasDefinities
reload(klasDefinities)

from klasDefinities import *

distribution = []
for el in nodes:
    distribution.append(el.getNodeDegree(True))
# ---------- end node_distri_pos ----------
node_distributi = BarGraph(node_distri_pos, BarColor=RGB(255, 0, 89))  # disabled
pie = PieChart(node_distri_pos)  # disabled

# ---- group: new planar graph
panel_27 = Panel("""True
False
False""")  # disabled
hoogte_verdiepen_2 = Panel("""0
3
6""")  # disabled
pt_3 = Point([Point(264.7557839, -168.2297105, 0), Point(233.7605991, -207.6793899, 0), Point(226.1371941, -149.6819029, 0)])  # disabled
merge_11 = Merge()  # disabled
item_19 = ListItem(List=pt_3, Index=0, Wrap=True)  # disabled
lng_2 = ListLength(List=merge_11)  # disabled
repeat_2 = RepeatData(Data=panel_27, Length=lng_2)  # disabled
cull_2 = CullPattern(List=merge_11, CullPattern=repeat_2)  # disabled
pt_4 = Point(cull_2)  # disabled
_3d_graph = GhPythonScript(nodes=graph.n_list, height_floors=hoogte_verdiepen_2, n_ref_point=item_19, o_ref_points=pt_4)  # -> planar_graph; inputs nodes: list, height_floors: list, n_ref_point: Point3d, o_ref_points: list of Point3d; disabled
# ---------- _3d_graph: Python ----------
__author__ = "Ellen De Sloovere"
__version__ = "2022.07.22"

import rhinoscriptsyntax as rs
import math
import scriptcontext
import Rhino.Geometry as rg
import ghpythonlib.components as gh
import System
import klasDefinities
reload(klasDefinities)

from klasDefinities import *

scriptcontext.doc = Rhino.RhinoDoc.ActiveDoc
klasDefinities.deleteLayer('Planar_layer')
klasDefinities.addRhinoLayer('Planar_layer')
scriptcontext.doc = ghdoc

n_ = [] 
l_ = []


for el in nodes:
    #planar nodes opstellen
    trans = rg.Point3d(n_ref_point[0] - o_ref_points[el.identifier[0]][0], n_ref_point[1] - o_ref_points[el.identifier[0]][1], sum(height_floors[0:el.identifier[0]+1])-height_floors[0])
    p1 = rg.Point3d(el.getGeo().CenterPoint()[0] + trans[0], el.getGeo().CenterPoint()[1] + trans[1], trans[2])
    el.plan_vis = p1, float(el.opp)/100
    
    
    
    #3d edges
        
for el in nodes:
    buren = getNodes(el.getBuren(), nodes)
    n_.append(rs.AddSphere(el.plan_vis[0], el.plan_vis[1]))
    for el2 in buren:
        l_.append(rs.AddLine(el.plan_vis[0], el2.plan_vis[0]))

planar_graph = [] + n_ + l_

"""
__author__ = "Ellen De Sloovere"
__version__ = "2022.07.22"

import rhinoscriptsyntax as rs
import math
import scriptcontext
import Rhino.Geometry as rg
import ghpythonlib.components as gh
import System
import klasDefinities
reload(klasDefinities)

from klasDefinities import *


n_ = [] 
l_ = []
schlegeldiagram = []

for el in nodes:
    #planar nodes opstellen
    trans = rg.Point3d(n_ref_point[0] - o_ref_points[el.identifier[0]][0], n_ref_point[1] - o_ref_points[el.identifier[0]][1], sum(height_floors[0:el.identifier[0]+1])-height_floors[0])
    p1 = rg.Point3d(el.getGeo().CenterPoint()[0] + trans[0], el.getGeo().CenterPoint()[1] + trans[1], trans[2])
    el.plan_vis = p1, float(el.opp)/100
    
    
    
    #3d edges
        
for el in nodes:
    buren = getNodes(el.getBuren(), nodes)
    n_.append(rs.AddSphere(el.plan_vis[0], el.plan_vis[1]))
    proj = gh.ProjectAlong(rs.AddSphere(el.plan_vis[0], el.plan_vis[1]), rg.Point3d(0,0,0), rg.Vector3d(el.plan_vis[0][0] - projection_p[0], el.plan_vis[0][1] - projection_p[1], el.plan_vis[0][2] - projection_p[2]))
    print proj
    schlegeldiagram.append(rg.Point3d(proj))
    for el2 in buren:
        l_.append(rs.AddLine(el.plan_vis[0], el2.plan_vis[0]))

planar_graph = [] + n_ + l_

print schlegeldiagram
for el in planar_graph:
    print el
    proj = gh.ProjectAlong(el, rg.Point3d(0,0,0), rg.Transform.Translation(el.plan_vis[0][0] - projection_p[0], el.plan_vis[0][1] - projection_p[1], el.plan_vis[0][2] - projection_p[2]))
    schlegeldiagram.append(proj)
"""
# ---------- end _3d_graph ----------
swatch_16 = ColourSwatch(SwatchColor=RGB(101, 5, 255))  # disabled
geo_6 = Geometry(_3d_graph)  # disabled
preview_18 = CustomPreview(Geometry=geo_6, Material=swatch_16)  # disabled
panel_28 = Panel(_3d_graph)  # disabled

# ---- group: Node distribution
node_distri = GhPythonScript(nodes=merge_3)  # -> distribution; inputs nodes: list; disabled
# ---------- node_distri: Python ----------
__author__ = "Ellen De Sloovere"
__version__ = "2022.07.22"

import rhinoscriptsyntax as rs
import math
import scriptcontext
import Rhino.Geometry as rg
import ghpythonlib.components as gh
import System
import klasDefinities
reload(klasDefinities)

from klasDefinities import *

distribution = []
for el in nodes:
    distribution.append(el.getNodeDegree())
# ---------- end node_distri ----------
node_distributi_2 = BarGraph(node_distri, BarColor=RGB(255, 0, 89))  # disabled
pie_2 = PieChart(node_distri)  # disabled

# ----
node_distributi_3 = BarGraph(total_deviatie.distri, BarColor=RGB(255, 0, 89))  # disabled
# Aangezien de graaf wordt geprojecteerd op het grondplan en geen stappen van de graph overlslaat is de 3 de parameter altijd 1(0 tussenstappen - geen kortste weg nodig). De gebruiker dient dan ook het plan naar behoren aan te passen. Misschien extra buffer inbouwen dat als het niet aanwezig is dat er een node verder gekeken wordt. Maar wel weer meer compute time
# 
# 
# Bij de componenten voor de veralgemenisering kan apart gezocht worden naar graphlets. De gebruiker kan zelfs schakels tussenvoegen.
# 
# 4de parameter van buitenlucht nog toevoegen
# kan met heeftraam
pie_3 = PieChart(total_deviatie.distri)  # disabled

pt_5 = Point(Point(235.5674878, -185.6843961, 25))  # disabled

# ---- group: Fase drie / leefgroep 2 / zitruimte
swatch_17 = ColourSwatch(SwatchColor=RGB(0, 41, 156))  # disabled
visueel_12 = GhPythonScript(planNodes=merge_3, knopen=item_8, index=number_slider_3)  # -> visueel; inputs planNodes: list, index: Int32; disabled
# ---------- visueel_12: Python ----------
__author__ = "Ellen De Sloovere"
__version__ = "2022.05.10"

import rhinoscriptsyntax as rs
import math
import scriptcontext
import Rhino.Geometry as rg
import ghpythonlib.components as gh
import System
import klasDefinities
reload(klasDefinities)

from klasDefinities import *
from decimal import *


#afwijking = '%.3f' % (sum(el for el in afw)/len(knopen)),  tuple('%.3f' % el for el in afw)

idKnopen = knopen

visueel = idKnopen[index].getGeo()
print idKnopen
# ---------- end visueel_12 ----------

# ----
pline_2 = PolyLine(Vertices=visueel_12, Closed=False)  # disabled

# ---- group: Fase drie / leefgroep 2 / zitruimte (continued)
srf_14 = Surface(pline_2)  # disabled
preview_19 = CustomPreview(Geometry=srf_14, Material=swatch_17)  # disabled
